# Grasshopper definition TestConnection.gh (Grasshopper 1.0.7)
# Copyright: 2021
# Copyright: 2022-28-21
# plug-ins: GrasshopperRadianceLinuxConnector, LadybugGrasshopper, Human, HDTTreeUtils

# ----
# Connect
panel = Panel("mss")
connect_ssh = ConnectSSH(User=panel, Ip="127.0.0.1", Password="_prompt", _port=22, Connect=Toggle(True))  # -> Status, Run
panel_2 = Panel(connect_ssh.Status)

# ----
# Setup globals
panel_3 = Panel("""proj
projname
projfolder
cpus""")
panel_4 = Panel("""~/simulation/test_project
test_project
simulation/test_project
7""")
globals = SetupGlobals(Keys=panel_3, Values=panel_4)
panel_5 = Panel(globals)

od_outdated = ColourSwatch(SwatchColor=RGBA(97, 97, 97, 150))
u_updated = ColourSwatch(SwatchColor=RGBA(208, 115, 230, 112))
g_general = ColourSwatch(SwatchColor=RGBA(245, 243, 237, 156))
o_outputs = ColourSwatch(SwatchColor=RGBA(160, 218, 242, 203))
s_settings = ColourSwatch(SwatchColor=RGBA(224, 145, 81, 154))
toggle = BooleanToggle(True)
y_yellow = ColourSwatch(SwatchColor=RGBA(247, 244, 64, 188))
i_inputs = ColourSwatch(SwatchColor=RGBA(125, 217, 98, 150))
c_core = ColourSwatch(SwatchColor=RGBA(235, 227, 206, 203))
r_red = ColourSwatch(SwatchColor=RGBA(242, 63, 63, 203))

# ----
# Test connection
testconnection = TestConnection()  # -> Status, Errors
panel_6 = Panel(testconnection.Status)
panel_7 = Panel(testconnection.Errors)

colorgroups = CSharpScript(
    Colors=[i_inputs, s_settings, g_general, c_core, o_outputs, r_red, y_yellow, u_updated, od_outdated],
    Enable=toggle,
    Rename=Toggle(False),
    RunOnce=Button(),
    Debug=Toggle(False))  # -> out; inputs Colors: list of Color, Enable: Boolean, Rename: Boolean, RunOnce: Boolean, Debug: Boolean
# ---------- colorgroups: C# usings ----------
using System.Linq;
using System.Text;
using System.Reflection;
# ---------- colorgroups: C# ----------
    msg.Clear();


    this.Component.Message = "id: " + id.ToString();

    _debug = Debug; //Set to true to have all events printed in rhino log
    _rename = Rename;

    if (Enable)
    {
      msg.AppendFormat("Set up events on ID {0}\n", id);
      SetupDict(); // Create a dictionary of the input swatches
      SetEventHandlers(); // This would do the job.


    }
    else
    {
      RemoveEventHandlers();
    }
    if (RunOnce)
    {
      foreach(Grasshopper.Kernel.Special.GH_Group grp in Grasshopper.Instances.ActiveCanvas.Document.Objects.OfType<Grasshopper.Kernel.Special.GH_Group>())
      {
        ColorGroup(grp, null); // You decide if it should run once on all existing groups

      }
    }

    Print(msg.ToString());


    // Component setup
    Component.Description = "Set up event handlers to color groups based on prefixes such as 'in_' and 'out_'.\n"
      + "Please insert only swatcheds directly into the Colors input\n\n"
      + "MIT License. Copyright Mathias Sønderskov Schaltz 2022";
    Component.Params.Input[0].Description = "Please insert only swatcheds directly into the Colors input.\nRemember to rename them";
    Component.Params.Input[1].Description = "Toggle to run...";
    Component.Params.Input[2].Description = "Set to true if you want to automatically rename the groups and remove prefix. Default is false.";
    Component.Params.Input[3].Description = "Set to true to run it once and color all existing groups.";
    Component.Params.Input[Component.Params.Input.Count - 1].Description = "Set debug to true to get all the events printed in the rhino log";
# ---------- colorgroups: C# additional code ----------
  public static Random rnd = new Random();
  public int id = rnd.Next(0, 1000);
  StringBuilder msg = new StringBuilder();
  Dictionary<string, System.Drawing.Color> colorDict = new Dictionary<string, System.Drawing.Color>();

  bool _debug = false;
  bool _rename = false;

  public bool IdExists(int id)
  {
    IList<IGH_DocumentObject> objs = Grasshopper.Instances.ActiveCanvas.Document.Objects;
    return objs
      .OfType<IGH_Component>()
      .Where(ob => ob.NickName == this.Component.NickName)
      .Where(ob => ob.GetType().ToString() == "ScriptComponents.Component_CSNET_Script")
      .Where(ob => ob.Message == "id: " + id.ToString()).Any();

  }


  public void SetupDict()
  {
    colorDict.Clear();
    // Get all inputs to "Colors"
    IList<IGH_Param> colorSources = this.Component.Params.Input[0].Sources;
    if (colorSources.Count == 0)
    {
      throw new Exception("You forgot to setup the colors. Please input swatch components and rename them");
    }
    foreach(IGH_Param source in colorSources)
    {
      //if (source.Type.ToString() == "Grasshopper.Kernel.Types.GH_Colour")
      if (source is Grasshopper.Kernel.Special.GH_ColourSwatch)
      {
        string nickName = source.NickName.Split('_')[0].Trim() + "_";
        if(!colorDict.ContainsKey(nickName))
        {
          Grasshopper.Kernel.Special.GH_ColourSwatch swatch = (Grasshopper.Kernel.Special.GH_ColourSwatch) source;
          colorDict.Add(nickName, swatch.SwatchColour);
        }
        else
        {
          throw new Exception("Multiple swatches using the same name detected. Please rename");
        }
      }
      else
      {
        throw new Exception("Whacko! Why did you input a non-swatch into the Colors? " + source.Type.ToString());
      }

    }

    msg.AppendFormat("Set up the dictionaries with {0} colors\n", colorDict.Count);
    foreach(var pairs in colorDict)
    {
      msg.AppendFormat("{0} -> {1}\n", ("\"" + pairs.Key + "\"").PadRight(5 + colorDict.Keys.Select(k => k.Length).Max()), pairs.Value);
    }
  }

  public void SetEventHandlers()
  {

    // Always remove events first to avoid duplicates
    GrasshopperDocument.ObjectsAdded -= OnObjectsAdded;
    GrasshopperDocument.ObjectsDeleted -= OnObjectsRemoved;
    GrasshopperDocument.ObjectsDeleted -= OnDeleteThisComponent;

    // Attach events
    GrasshopperDocument.ObjectsAdded += OnObjectsAdded;
    GrasshopperDocument.ObjectsDeleted += OnObjectsRemoved;
    GrasshopperDocument.ObjectsDeleted += OnDeleteThisComponent;


    foreach(Grasshopper.Kernel.Special.GH_Group grp in GrasshopperDocument.Objects.OfType<Grasshopper.Kernel.Special.GH_Group>())
    {
      grp.ObjectChanged -= ColorGroup;
      grp.ObjectChanged += ColorGroup;

      //ColorGroup(grp, null); // Make sure to run it once
    }
    msg.AppendFormat("Added the eventhandlers on {0} existing groups and on future created groups\n", GrasshopperDocument.Objects.OfType<Grasshopper.Kernel.Special.GH_Group>().Count());
  }

  public void OnObjectsAdded(object sender, GH_DocObjectEventArgs e)
  {
    bool any = false;
    foreach (Grasshopper.Kernel.Special.GH_Group grp in e.Objects.OfType<Grasshopper.Kernel.Special.GH_Group>())
    {
      grp.ObjectChanged -= ColorGroup;
      grp.ObjectChanged += ColorGroup;
      any = true;
    }

    DebugWrite(any ? "Group Objects Added: Attaching Events to ObjectChanged" : "Objects Added - but no groups");
  }

  //Same but reversed
  public void OnObjectsRemoved(object sender, GH_DocObjectEventArgs e)
  {
    bool any = false;
    foreach (Grasshopper.Kernel.Special.GH_Group grp in e.Objects.OfType<Grasshopper.Kernel.Special.GH_Group>())
    {
      grp.ObjectChanged -= ColorGroup;
      any = true;
    }

    DebugWrite(any ? "Group Objects Removed, removing event" : "Objects Removed - although not a group");

  }



  public void RemoveEventHandlers()
  {
    GrasshopperDocument.ObjectsAdded -= OnObjectsAdded;
    GrasshopperDocument.ObjectsDeleted -= OnObjectsRemoved;


    foreach(Grasshopper.Kernel.Special.GH_Group grp in GrasshopperDocument.Objects.OfType<Grasshopper.Kernel.Special.GH_Group>())
    {
      grp.ObjectChanged -= ColorGroup;

    }
    msg.AppendFormat("Removed event handlers on document and on {0} groups\n", GrasshopperDocument.Objects.OfType<Grasshopper.Kernel.Special.GH_Group>().Count());

  }

  public void ColorGroup(object sender, EventArgs e)
  {
    if (!IdExists(id))
    {
      DebugWrite("Component not relevant. Disabling old id + " + id.ToString());
      RemoveEventHandlers();
      return;
    }

    Grasshopper.Kernel.Special.GH_Group grp = sender as Grasshopper.Kernel.Special.GH_Group;
    if (grp == null) return; //not type GH_Group
    //if (!grp.NickName.EndsWith("_")) return;

    string[] nameParts = grp.NickName.Split('_');
    if (nameParts.Length <= 1)
      return;
    string prefix = grp.NickName.Split('_')[0].Trim() + '_';

    string prefixes = String.Join(", ", colorDict.Keys.Select(k => "\"" + k + "\""));

    msg.Append("prefix " + prefix + "\n");
    if (colorDict.ContainsKey(prefix))
    {
      //if (grp.NickName.EndsWith("_"))
      grp.Colour = colorDict[prefix];
      if (_rename)
      {
        grp.NickName = grp.NickName.Replace(prefix, "");
      }

      DebugWrite("Colored " + grp.NickName);

    }
    else
    {
      DebugWrite("Group changed but not relevant: prefix " + prefix + " is not among " + prefixes);
    }

  }
  public void DebugWrite(string msg)
  {
    if (_debug)
    {
      Rhino.RhinoApp.WriteLine(String.Format("[ColGrps {0}]: {1}", id, msg));
    }
  }

  public void OnDeleteThisComponent(object sender, GH_DocObjectEventArgs e)
  {

    if (e.Objects.OfType<Grasshopper.Kernel.GH_Component>().Where(o => o.NickName == this.Component.NickName).Any())
    {
      DebugWrite("Removed template component. Removing all the eventhandlers");
      RemoveEventHandlers();
    }

  }
# ---------- end colorgroups ----------

fixparams = CSharpScript(FixOnce=Button(), Enable=toggle, Debug=Toggle(False))  # -> out; inputs FixOnce: Boolean, Enable: Boolean, Debug: Boolean
# ---------- fixparams: C# usings ----------
using System.Text;
using System.Linq;
using Grasshopper.Kernel.Special;
# ---------- fixparams: C# ----------
    _debug = Debug;
    _enable = Enable;
    msg.Clear();
    this.Component.Message = "id: " + id.ToString();




    if (Enable)
    {
      SetEventHandlers();
    }
    else
    {
      RemoveEventHandlers();
    }


    if (FixOnce)
    {
      FixAll();
    }

    Print(msg.ToString());

    // Component setup
    Component.Description = "Set up event handlers to change params to show nickname and not icon"
      + "\n\n"
      + "MIT License. Copyright Mathias Sønderskov Schaltz 2022";
    Component.Params.Input[0].Description = "Run me once on the document";
    Component.Params.Input[1].Description = "Toggle to enable event listener";
    Component.Params.Input[Component.Params.Input.Count - 1].Description = "Set debug to true to get all the events printed in the rhino log";
# ---------- fixparams: C# additional code ----------
  public static Random rnd = new Random();
  public int id = rnd.Next(0, 1000);
  StringBuilder msg = new StringBuilder();
  bool _debug = false;
  bool _enable = false;

  public Dictionary<IGH_ActiveObject, HashSet<GH_Group>> groupsPerObject = new Dictionary<IGH_ActiveObject, HashSet<GH_Group>>();


  public void OnObjectsAdded(object sender, GH_DocObjectEventArgs e)
  {
    if (!IdExists(id))
    {
      DebugWrite("[FixParam] Component not relevant. Disabling old id " + id.ToString());
      RemoveEventHandlers();
      return;
    }


    if(_enable)
    {
      foreach(IGH_Param par in e.Objects.OfType<IGH_Param>())
      {
        FixInputs(par);
      }
    }


  }

  public void FixAll()
  {
    //DebugWrite("Fixing all?");
    foreach(IGH_Param par in GrasshopperDocument.Objects.OfType<IGH_Param>())
    {

      FixInputs(par);
    }
  }




  public void FixInputs(IGH_ActiveObject obj)
  {



    IGH_Param par = obj as IGH_Param;
    if (par != null)
    {

      par.IconDisplayMode = GH_IconDisplayMode.name;


    }

  }


  public void SetEventHandlers()
  {

    GrasshopperDocument.ObjectsAdded -= OnObjectsAdded;
    GrasshopperDocument.ObjectsAdded += OnObjectsAdded;
    GrasshopperDocument.ObjectsDeleted -= OnDeleteThisComponent;
    GrasshopperDocument.ObjectsDeleted += OnDeleteThisComponent;
    msg.AppendFormat("Added the eventhandlers to OnObjectsAdded\n", GrasshopperDocument.Objects.OfType<Grasshopper.Kernel.Special.GH_Group>().Count());
  }

  public void RemoveEventHandlers()
  {
    GrasshopperDocument.ObjectsAdded -= OnObjectsAdded;
    GrasshopperDocument.ObjectsDeleted -= OnDeleteThisComponent;

    msg.AppendFormat("Removed wire event handlers on document\n", GrasshopperDocument.Objects.OfType<Grasshopper.Kernel.Special.GH_Group>().Count());

  }

  public void OnDeleteThisComponent(object sender, GH_DocObjectEventArgs e)
  {

    if (e.Objects.OfType<Grasshopper.Kernel.GH_Component>().Where(o => o.NickName == this.Component.NickName).Any())
    {
      DebugWrite("Removed template component. Removing all the eventhandlers");
      RemoveEventHandlers();
    }

  }

  public bool IdExists(int id)
  {
    IList<IGH_DocumentObject> objs = Grasshopper.Instances.ActiveCanvas.Document.Objects;
    return objs
      .OfType<IGH_Component>()
      .Where(ob => ob.NickName == this.Component.NickName)
      .Where(ob => ob.GetType().ToString() == "ScriptComponents.Component_CSNET_Script")
      .Where(ob => ob.Message == "id: " + id.ToString()).Any();

  }

  public void DebugWrite(string msg)
  {
    if (_debug)
    {
      Rhino.RhinoApp.WriteLine(String.Format("[FixParams {0}]: {1}", id, msg));
    }
  }
# ---------- end fixparams ----------

fixwires = CSharpScript(FixOnce=Button(), Enable=toggle, Debug=Toggle(False))  # -> out; inputs FixOnce: Boolean, Enable: Boolean, Debug: Boolean
# ---------- fixwires: C# ----------
    _debug = Debug;
    _enable = Enable;
    msg.Clear();
    this.Component.Message = "id: " + id.ToString();


    SetDictionary();

    if (Enable)
    {
      SetEventHandlers();
    }
    else
    {
      RemoveEventHandlers();
    }


    if (FixOnce)
    {
      FixAll();
    }

    Print(msg.ToString());
    
    // Component setup
    Component.Description = "Set up event handlers to change all wire types across groups to faint"
      + "\n\n"
      + "MIT License. Copyright Mathias Sønderskov Schaltz 2022";
    Component.Params.Input[0].Description = "Run me once on the document";
    Component.Params.Input[1].Description = "Toggle to enable event listener";
    Component.Params.Input[Component.Params.Input.Count - 1].Description = "Set debug to true to get all the events printed in the rhino log";
# ---------- fixwires: C# additional code ----------
  public static Random rnd = new Random();
  public int id = rnd.Next(0, 1000);
  StringBuilder msg = new StringBuilder();
  bool _debug = false;
  bool _enable = false;

  public Dictionary<IGH_ActiveObject, HashSet<GH_Group>> groupsPerObject = new Dictionary<IGH_ActiveObject, HashSet<GH_Group>>();


  public void OnSolutionExpired(object sender, GH_DocUndoEventArgs e)
  {
    if(_enable)
      FixAll();
  }

  public void FixAll()
  {
    //DebugWrite("Fixing all?");
    foreach(IGH_ActiveObject key in groupsPerObject.Keys.Where(k => groupsPerObject[k].Count() > 0))
    {

      FixInputs(key);
    }
  }



  public bool HasGroup(IGH_ActiveObject obj)
  {
    return groupsPerObject[obj].Count > 0;
  }


  public void FixInputs(IGH_ActiveObject obj)
  {

    if (!IdExists(id))
    {
      DebugWrite("Component not relevant. Disabling old id " + id.ToString());
      RemoveEventHandlers();
      return;
    }

    //List<List<IGH_ActiveObject>> parents = new List<List<IGH_ActiveObject>>();
    IGH_Param par = obj as IGH_Param;
    if (par != null && par.Sources != null)
    {


      IEnumerable<IGH_ActiveObject> p = par.Sources.Select(s => s.Attributes.GetTopLevel.DocObject as IGH_ActiveObject);
      //parents.Add(p);
      if(HasGroup(obj) && p.All(o => !HasGroupsInCommon(o, obj)) && par.WireDisplay != GH_ParamWireDisplay.faint)
      {
        DebugWrite("Fixing " + par.Attributes.GetTopLevel.DocObject.NickName);
        par.WireDisplay = GH_ParamWireDisplay.faint;
      }

    }

    IGH_Component comp = obj as IGH_Component;
    if (comp != null)
    {
      foreach(IGH_Param inp in comp.Params.Input)
      {

        IEnumerable<IGH_ActiveObject> p = inp.Sources.Select(i => i.Attributes.GetTopLevel.DocObject as IGH_ActiveObject);

        if(HasGroup(obj) && p.All(o => !HasGroupsInCommon(o, obj)) && inp.WireDisplay != GH_ParamWireDisplay.faint)
        {
          DebugWrite("Fixing " + inp.Attributes.GetTopLevel.DocObject.NickName);
          inp.WireDisplay = GH_ParamWireDisplay.faint;
        }
      }

    }



  }





  public void SetDictionary()
  {
    IList<IGH_DocumentObject> objects = Grasshopper.Instances.ActiveCanvas.Document.Objects.ToList();
    //Print(String.Join(", ", objects.Select(o => o.NickName)));

    groupsPerObject = objects
      .Where(o => o.GetType() != typeof(GH_Group))
      .OfType<IGH_ActiveObject>()
      .ToDictionary(o => o, o => new HashSet<GH_Group>());

    foreach(GH_Group grp in objects.OfType<GH_Group>())
    {

      foreach(IGH_ActiveObject obj in grp.ObjectsRecursive().OfType<IGH_ActiveObject>())
      {
        groupsPerObject[obj].Add(grp);

      }
    }



  }

  public bool HasGroupsInCommon(IGH_ActiveObject obj1, IGH_ActiveObject obj2)
  {
    HashSet<GH_Group> set1 = groupsPerObject[obj1];
    HashSet<GH_Group> set2 = groupsPerObject[obj2];

    set1.IntersectWith(set2);

    return set1.Any();
  }

  public void SetEventHandlers()
  {

    GrasshopperDocument.UndoStateChanged -= OnSolutionExpired;
    GrasshopperDocument.UndoStateChanged += OnSolutionExpired;
    GrasshopperDocument.ObjectsDeleted -= OnDeleteThisComponent;
    GrasshopperDocument.ObjectsDeleted += OnDeleteThisComponent;
    msg.AppendFormat("Added the eventhandlers to UndoStateChanged\n", GrasshopperDocument.Objects.OfType<Grasshopper.Kernel.Special.GH_Group>().Count());
  }

  public void RemoveEventHandlers()
  {
    GrasshopperDocument.UndoStateChanged -= OnSolutionExpired;
    GrasshopperDocument.ObjectsDeleted -= OnDeleteThisComponent;

    msg.AppendFormat("Removed wire event handlers on document\n", GrasshopperDocument.Objects.OfType<Grasshopper.Kernel.Special.GH_Group>().Count());

  }

  public void OnDeleteThisComponent(object sender, GH_DocObjectEventArgs e)
  {

    if (e.Objects.OfType<Grasshopper.Kernel.GH_Component>().Where(o => o.NickName == this.Component.NickName).Any())
    {
      DebugWrite("Removed template component. Removing all the eventhandlers");
      RemoveEventHandlers();
    }

  }

  public bool IdExists(int id)
  {
    IList<IGH_DocumentObject> objs = Grasshopper.Instances.ActiveCanvas.Document.Objects;
    return objs
      .OfType<IGH_Component>()
      .Where(ob => ob.NickName == this.Component.NickName)
      .Where(ob => ob.GetType().ToString() == "ScriptComponents.Component_CSNET_Script")
      .Where(ob => ob.Message == "id: " + id.ToString()).Any();

  }

  public void DebugWrite(string msg)
  {
    if (_debug)
    {
      Rhino.RhinoApp.WriteLine(String.Format("[FixWire {0}]: {1}", id, msg));
    }
  }
# ---------- end fixwires ----------

# ----
# Template methods
# By Mathias Sønderskov Schaltz 2022
# Check for updates here https://github.com/Sonderwoods/GrasshopperScribbles
panel_8 = Panel(fixwires)
panel_9 = Panel(fixparams)
panel_10 = Panel(colorgroups)

panel_11 = Panel("""export PATH=$PATH.:/usr/local/radiance/bin
export RAYPATH=.:/usr/local/radiance/lib
objview <glowmat> ~/simulation/<name>.rad | meta2tga -x 1048 -y 1048 | ra_t8 -r > ~/simulation/<name>.hdr
normtiff ~/simulation/<name>.hdr ~/simulation/<name>.tif
convert ~/simulation/<name>.tif ~/simulation/<name>.png
echo "C:\Users\mm1013\simulation\<name>.png"
""")
panel_12 = Panel("kill -9 (ps aux | grep <instance> | fgrep -v grep | awk '{ print $1}')")

panel_13 = Panel("""Mesh
Polysurface
Surface
Extrusion""")

falsestart = LBFalseStartToggle(False)

vertical_offset = Panel("0.75m")
grid_size = Panel("0.5m")
docunits = ConvertToDocumentUnits(ValueString=vertical_offset)
docunits_2 = ConvertToDocumentUnits(ValueString=grid_size)

panel_14 = Panel("""echo $PATH
genbox""")  # disabled
falsestart_2 = LBFalseStartToggle(False)  # disabled
execute_ssh_async = ExecuteSSHAsync(SSHCommands=panel_14, Run=falsestart_2)  # -> Stdout, Stderr, Log, Pid, Ran; disabled
panel_15 = Panel(execute_ssh_async.Stderr)  # disabled
panel_16 = Panel(execute_ssh_async.Stdout)  # disabled

execute_ssh_async_2 = ExecuteSSHAsync(
    SSHCommands="ps aux",
    Run=falsestart,
    stdouts="""USER       PID %CPU %MEM    VSZ   RSS TTY      STAT START   TIME COMMAND
root         1  0.0  0.0    896     0 ?        Sl   11:35   0:00 /init
root         8  0.0  0.0    896     0 ?        S    11:35   0:00 /init
root        31  0.0  0.0  12176  2164 ?        Ss   11:35   0:00 sshd: /usr/sbin/sshd [listener] 0 of 10-100 startups
root      1255  0.0  0.0    896     8 ?        Ss   11:55   0:00 /init
root      1256  0.0  0.0    896    16 ?        S    11:55   0:00 /init
mss       1257  0.0  0.0  10168  3316 pts/0    Ss+  11:55   0:00 -bash
root      3849  0.0  0.0    896     0 ?        Ss   12:39   0:00 /init
root      3850  0.0  0.0    896     0 ?        S    12:39   0:00 /init
mss       3851  0.0  0.0  10036  2864 pts/1    Ss+  12:39   0:00 -bash
root      7404  0.0  0.0  13904  8640 ?        Ss   16:27   0:00 sshd: mss [priv]
root      7408  0.0  0.0  13904  8548 ?        Ss   16:27   0:00 sshd: mss [priv]
mss       7501  0.1  0.0  13904  5744 ?        S    16:27   0:02 sshd: mss@notty
mss       7521  0.0  0.0  13904  5744 ?        S    16:27   0:00 sshd: mss@notty
mss       7522  0.0  0.0   6604  5304 ?        Ss   16:27   0:00 /usr/lib/openssh/sftp-server
mss      11746  0.0  0.0  10616  3316 ?        R    17:01   0:00 ps aux""")  # -> Stdout, Stderr, Log, Pid, Ran

dpipeline = DynamicGeometryPipeline(
    LayerFilter="Daylight_Inputs::*",
    TypeFilter=panel_13,
    NameFilter="*",
    GroupByLayer=False,
    GroupByType=False,
    IncludeHidden=True,
    IncludeLocked=True,
    enableFullPath=True,
    listenToAttributes=True)
dam = DataDam(DataA=dpipeline, BufferDelay=10000000, BufferMode=0)
objatts = ObjectAttributes(ObjectOrAttributes=dam)  # -> Name, LayerName, LayerFullPath, Color, MaterialName, LinetypeName, GroupIndices, PlotWeight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
cset = CreateSet(List=objatts.LayerName)  # -> Set, Map
assign_paths = AssignPaths(InputData=flatten(dam), PathsToAssign=flatten(cset.Map))
python = GhPythonScript(layer_name=graft(cset.Set))  # -> is_opaque, is_transparent, is_grid, is_HB_Room, is_HB_Window
# ---------- python: Python ----------
__author__ = "mm1013"
__version__ = "2022.01.16"

import rhinoscriptsyntax as rs

is_grid = layer_name == "Grids"

if layer_name.startswith("HB_"):
    is_opaque = is_transparent = is_grid = False
    
    is_HB_Window = layer_name.endswith("%")
    is_HB_Room = layer_name == "HB_Rooms"
    
    
else:
    if is_grid:
        is_opaque = False
        is_transparent = False
    else:
        is_transparent = layer_name.endswith("%")
        if is_transparent:
            transmittance = layer_name.split("_")[-1].replace("%","")
        is_opaque = not is_transparent
# ---------- end python ----------
layer_name = Text(cset.Set)
geo = Geometry(assign_paths)

mesh = Mesh([<mesh referenced from the Rhino model> x2])
panel_17 = Panel("""dctimestep
rcontrib
rtrace
oconv""")
facen = FaceNormals(Mesh=mesh)  # -> Centers, Normals
demesh = DeconstructMesh(Mesh=mesh)  # -> Vertices, Faces, Colours, Normals

# ----
# you can remove last characters of a value
# 
# Here adding render instead of image
panel_18 = Panel("echo <proj>/<target-8>_render.gif")
applyglobals = ApplyGlobals(Input=panel_18, AdditionalKeys="target", AdditionalValues="myFiles/myImage.hdr")  # -> Output, Pairs
panel_19 = Panel(applyglobals.Output)

panel_20 = Panel(execute_ssh_async_2.Stdout)

# ----
# you can combine globals and locals
panel_21 = Panel("echo <proj>/<target-.>.gif")
applyglobals_2 = ApplyGlobals(Input=panel_21, AdditionalKeys="target", AdditionalValues="myFiles/myImage.hdr")  # -> Output, Pairs
panel_22 = Panel(applyglobals_2.Output)

# ----
# Applyglobals
# try <target-.>  to remove the file ending on <target>
# 
# Here we are changing from hdr to gif
panel_23 = Panel("echo <target-.>.gif")
applyglobals_3 = ApplyGlobals(Input=panel_23, AdditionalKeys="target", AdditionalValues="myFiles/myImage.hdr")  # -> Output, Pairs
panel_24 = Panel(applyglobals_3.Output)

panel_25 = Panel("""up_clock3
up_ccw3""")
panel_26 = Panel("""glowmat
glowmat""")
points = PointList(Points=demesh.Vertices, Size="50")
vdis = VectorDisplay(Anchor=facen.Centers, Vector=expr("x*500", facen.Normals))
panel_27 = Panel("""echo "void glow glowmat
0
0
4 12 12 12 1000" > <target>;echo <target>""")
falsestart_3 = LBFalseStartToggle(False)
overrides = ApplyOverrides(Input=panel_12, AdditionalKeys="instance", AdditionalValues=graft("dctimestep"))  # -> flatten(Output), Pairs
falsestart_4 = LBFalseStartToggle(False)
mesh2obj = MeshToObj(Mesh=graft(mesh), Name=graft(panel_25), ModifierName=graft(panel_26), Run=falsestart_3)  # -> ObjFiles, MapFile, Run
overrides_2 = ApplyOverrides(Input=panel_27, AdditionalKeys="target", AdditionalValues="~/simulation/testglow.rad")  # -> Output, Pairs
execute_ssh_async_3 = ExecuteSSHAsync(SSHCommands=overrides_2.Output, Run=falsestart_3)  # -> Stdout, Stderr, Log, Pid, Ran
overrides_3 = ApplyOverrides(Input=panel_11, AdditionalKeys="glowmat", AdditionalValues=execute_ssh_async_3.Stdout)  # -> Output, Pairs
overrides_4 = ApplyOverrides(Input=overrides_3.Output, AdditionalKeys="name", AdditionalValues=graft(panel_25))  # -> Output, Pairs
panel_28 = Panel("echo hi")
panel_29 = Panel(overrides.Output)
join = TextJoin(Text=overrides.Output, Join=";")
concat = Concatenate(FragmentA=join)
panel_30 = Panel(overrides_4.Output)

# ----
# 5 phase bash script from andy mcneil
panel_31 = Panel("""#!/bin/bash

procs=4

### First let me download and unpacking Axel\'s files for rtcontrib lesson

printf "\nDownloading Axels rtcontrib lesson files...\n"
curl -O http://www.jaloxa.eu/resources/radiance/documentation/docs/rtcontrib_lesson.tgz
tar -xf rtcontrib_lesson.tgz
mv rtcontrib_lesson 5p_tutorial_examples

cd 5p_tutorial_examples

mkdir bsdf hourlypics hourlypics_dir hourlypics_ds hourlyresult \
	matrices octs viewpics viewpics_dir viewpics_ds
	
### Let me download the weather data file for you
printf "\nDownloading weather data...\n"
curl -O http://apps1.eere.energy.gov/buildings/energyplus/weatherdata/4_north_and_central_america_wmo_region_4/1_usa/USA_CA_Oakland.Intl.AP.724930_TMY3.zip
tar -xf USA_CA_Oakland.Intl.AP.724930_TMY3.zip
rm USA_CA_Oakland.Intl.AP.724930_TMY3.ddy 
rm USA_CA_Oakland.Intl.AP.724930_TMY3.stat
rm USA_CA_Oakland.Intl.AP.724930_TMY3.zip 
mv USA_CA_Oakland.Intl.AP.724930_TMY3.epw skies/.

# grabbing reinsrc.cal from CVS
printf "\nDownloading reinsrc.cal...\n"
curl -O http://radiance-online.org/cgi-bin/viewcvs.cgi/ray/src/cal/cal/reinsrc.cal

### Section 6.1 - Model adjustments for five-phase simulation
printf "\nMaking model adjustments...\n"
cat <<EOF > objects/testroom_Swall.rad
!genbox wall_mat wall_s_bottom 4 .3 1 |xform -t 0 -.3 0
!genbox wall_mat wall_s_top 4 .3 .5 |xform -t 0 -.3 2
!genbox wall_mat wall_s_west .5 .3 1 |xform -t 0 -.3 1
!genbox wall_mat wall_s_west .5 .3 1 |xform -t 3.5 -.3 1
EOF

cat <<EOF > objects/testroom.rad
!genbox floor_mat floor 4.6 6.6 .3 |xform -t -.3 -.3 -.3
!genbox ceiling_mat ceiling 4.6 6.6 .3 |xform -t -.3 -.3 2.5

!genbox wall_mat wall_w .3 6.6 2.5 |xform -t -.3 -.3 0
!genbox wall_mat wall_e .3 6.6 2.5 |xform -t 4 -.3 0
!genbox wall_mat wall_n 4 .3 2.5 |xform -t 0 6 0
EOF

cat <<EOF > objects/glazing.rad
void glass glazing
0
0
3 0.73 0.73 0.73

glazing polygon glass
0
0
12    0.5  -0.25   1
        0.5  -0.25   2
        3.5  -0.25   2
        3.5  -0.25   1
EOF

cat <<EOF > objects/venetianblind.rad
void plastic blindslat
0
0
5 .65 .65 .65 .01 0 

!genblinds blindslat blinds .05 3 1 25 0 +r .15 | xform -rz -90 -t 0.5 -.15 1 
EOF

cat <<EOF > objects/viewmtxsurf.rad
void glow viewsurf
0
0
4 1 1 1 0

viewsurf polygon inside
0
0
12    0.5   0   1
        0.5   0   2
        3.5   0   2
        3.5   0   1
EOF

cat <<EOF > objects/daymtxsurf.rad
void plastic daymtxsurf
0
0
5 0 0 0 0 0

daymtxsurf polygon outside
0
0
12    0.5   -0.3   1
        0.5   -0.3   2
        3.5   -0.3   2
        3.5   -0.3  1
EOF

cat <<EOF > objects/glazing_bsdf.rad
void BSDF BSDFproxy
6 0.30 bsdf/fullwindow_t45.xml 0 0 1 .
0
0

BSDFproxy polygon inside
0
0
12    0.5   0   1
        0.5   0   2
        3.5   0   2
        3.5   0   1
EOF

cat <<EOF >> materials/testroom.mat
void plastic black
0
0
5 0 0 0 0 0
EOF


### Section 6.2 - Creating BSDFs
xform -rz 180 -rx -90 -t 4 0 0 objects/glazing.rad objects/venetianblind.rad materials/testroom.mat \
	objects/testroom_Swall.rad > bsdf/fullwindow.rad

### I am going to save you the trouble of generating the High-Res BSDF
#genBSDF -n $procs +f +b -geom meter -dim 0.5 3.5 1 2 -.3 0 -t4 5 \
#	bsdf/fullwindow.rad > bsdf/fullwindow_t45.xml
printf "\nDownloading tensor tree BSDF...\n"
curl -o bsdf/fullwindow_t45.xml http://www.radiance-online.org/learning/tutorials/fivephasetutorialfiles/fullwindow_t45.xml

### I will also save you the trouble with the low-res BSDF
#bsdf2klems bsdf/fullwindow_t45.xml > bsdf/fullwindow_klems.xml
#genBSDF -n $procs +f +b -geom meter -dim 0.5 3.5 1 2 -.3 0 \
#	bsdf/fullwindow.rad > bsdf/fullwindow_klems.xml
printf "\nDownloading klems BSDF...\n"
curl -o bsdf/fullwindow.xml http://www.radiance-online.org/learning/tutorials/fivephasetutorialfiles/fullwindow.xml


### Section 6.3 - View matrix (V)
printf "\nDoing 5-phase simulation for sensor points...\n"
oconv materials/testroom.mat objects/daymtxsurf.rad objects/ground.rad objects/testroom.rad \
	objects/testroom_Swall.rad objects/viewmtxsurf.rad skies/sky_white.rad \
	objects/viewmtxsurf.rad objects/daymtxsurf.rad > octs/model_3ph.oct
printf "\nView Matrix\n"
time rcontrib < data/photocells.pts -n $procs -f klems_int.cal -b kbinS -bn Nkbins -m viewsurf \
	-I+ -ab 10 -ad 65536 -lw 1.52e-5 octs/model_3ph.oct > matrices/viewmatrix.vmx


### Section 6.4 - Direct view matrix (Vd)
printf "\nDirect View Matrix\n"
time rcontrib < data/photocells.pts -n $procs -f klems_int.cal -b kbinS -bn Nkbins -m viewsurf \
	-I+ -ab 1 -ad 65536 -lw 1.52e-5 octs/model_3ph.oct > matrices/viewmatrix_direct.vmx

### Section 6.5 - Daylight matrix (D)
printf "\nDaylight Matrix\n"
time genklemsamp -c 1000 -vd 0 -1 0 objects/daymtxsurf.rad | \
	rcontrib -n $procs -c 1000 -ab 2 -ad 1024 -e MF:1 -f reinhart.cal -b rbin -bn Nrbins \
		-m sky_glow octs/model_3ph.oct > matrices/daylightmatrix.dmx

### Section 6.6 - Direct daylight matrix (Dd)
printf "\nDirect Daylight Matrix\n"
xform -m black objects/testroom_Swall.rad objects/testroom.rad objects/ground.rad \
	objects/venetianblind.rad | oconv materials/testroom.mat - objects/viewmtxsurf.rad \
	objects/daymtxsurf.rad skies/sky_white.rad > octs/model_allblack.oct

time genklemsamp -c 1000 -vd 0 -1 0 objects/daymtxsurf.rad | \
	rcontrib -n $procs -c 1000 -ab 0 -e MF:1 -f reinhart.cal -b rbin -bn Nrbins \
		-m sky_glow octs/model_allblack.oct > matrices/daylightmatrix_direct.dmx

### Section 6.7 - Direct sun coefficient matrix (Cds)
printf "\nDirect Sun Coefficient Matrix\n"
echo void light solar 0 0 3 1e6 1e6 1e6 > skies/suns.rad
cnt 5185  |  rcalc -e MF:6 -f reinsrc.cal -e Rbin=recno \
	-o 'solar source sun 0 0 4 ${ Dx } ${ Dy } ${ Dz } 0.533' >> skies/suns.rad

xform -m black objects/testroom_Swall.rad objects/testroom.rad objects/ground.rad \
	| oconv materials/testroom.mat - objects/glazing.rad objects/venetianblind.rad \
		objects/glazing_bsdf.rad skies/suns.rad > octs/model_suns.oct

time rcontrib < data/photocells.pts -n $procs -I -ab 1 -ad 65536 -lw 1.52e-5 -dc 1 -dt 0 -dj 0 -st 1 -ss 0 -faf  \
	-e MF:6 -f reinhart.cal -b rbin -bn Nrbins -m solar \
	octs/model_suns.oct > matrices/directsun.dsmx

### Section 6.8 - Putting it all together
printf "\nCombining it all\n"
epw2wea skies/USA_CA_Oakland.Intl.AP.724930_TMY3.epw skies/OakLand.wea
gendaymtx -of skies/OakLand.wea > matrices/OakLand.smx
gendaymtx -of -d skies/OakLand.wea > matrices/OakLand_direct.smx
gendaymtx -5 -d -m 6 -of skies/OakLand.wea > matrices/OakLand_direct_m6.smx

time dctimestep -n 8760 -if matrices/viewmatrix.vmx bsdf/fullwindow.xml  \
	matrices/daylightmatrix.dmx matrices/OakLand.smx | \
	rcollate -h -oc 1 > i_3ph.txt

time dctimestep -n 8760 -if  matrices/viewmatrix_direct.vmx bsdf/fullwindow.xml  \
	matrices/daylightmatrix_direct.dmx matrices/OakLand_direct.smx | \
	rcollate -h -oc 1 > i_ds3ph.txt

time dctimestep -n 8760 -if matrices/directsun.dsmx matrices/OakLand_direct_m6.smx | \
	rcollate -h -oc 1 > i_ds5ph.txt

rlam i_3ph.txt i_ds3ph.txt i_ds5ph.txt | \
	rcalc -e 'r=$1-$4+$7;g=$2-$5+$8;b=$3-$6+$9' \
	-e '$1=179*(.265*r+.670*g+.065*b)' | \
	rcollate -h -fa1 -ic 8760 -t > illum.txt

printf "\nAll done with example 1!  look at illum.txt for the result.\n"


printf "\n\n\nDoing 5-phase simulation for rendering...\n"
### 7.1	View matrix (V)
printf "\nView Matrix...\n"
time vwrays -vf views/back.vf  -ff -x 500 -y 500 \
	| rcontrib `vwrays -vf views/back.vf  -x 500 -y 500 -d` -n $procs -ffc -fo -o viewpics/back_%03d.hdr \
		-f klems_int.cal -b kbinS -bn Nkbins -m viewsurf \
		-ab 10 -ad 65536 -lw 1.52e-5 octs/model_3ph.oct

### 7.2	Direct view matrix (Vd)	
printf "\nDirect View Matrix...\n"	
time vwrays -vf views/back.vf  -ff -x 500 -y 500 \
	| rcontrib `vwrays -vf views/back.vf  -x 500 -y 500 -d` -n $procs -ffc -fo -o viewpics_dir/back_%03d.hdr \
		-f klems_int.cal -b kbinS -bn Nkbins -m viewsurf \
		-ab 1 -ad 65536 -lw 1.52e-5 octs/model_3ph.oct

### 7.5	Direct sun coefficient matrix (Cds)
printf "\nDirect Coefficient Matrix...\n"
ulimit -n 9999
xform -m black objects/testroom_Swall.rad objects/testroom.rad objects/ground.rad | \
	oconv materials/testroom.mat - objects/venetianblind.rad > octs/model_nosuns.oct
time vwrays -c 4 -pj 1 -fa -vf views/back.vf -x 500 -y 500 | \
	rtrace -h- -opn -faa -ab 0 octs/model_nosuns.oct | \
	rcontrib `vwrays -vf views/back.vf -x 500 -y 500 -d` -n $procs -fac -fo -o viewpics_ds/back_%04d.hdr \
	-e MF:6 -f reinhart.cal -b rbin -bn Nrbins -m solar -c 4 -I -ab 1 -ad 100 -dt 0 -dc 1 -lw 1e-2 octs/model_suns.oct

oconv materials/testroom.mat objects/testroom_Swall.rad objects/testroom.rad \
	objects/ground.rad objects/glazing.rad objects/venetianblind.rad \
	objects/daymtxsurf.rad > octs/model_material.oct
time rpict -x 1000 -y 1000 -vf views/back.vf -ps 1 -pj 1 -av 0.31831 0.31831 0.31831 -aa 0 \
	octs/model_material.oct | pfilt -x /2 -y /2 -1 -e 1 > materialmap.hdr  

### 7.6	Putting it all together
printf "\nPutting it together...\n"
time dctimestep -n 8760 -if -o hourlypics/back_%04d.hdr viewpics/back_%03d.hdr \
	bsdf/fullwindow.xml matrices/daylightmatrix.dmx matrices/OakLand.smx 

time dctimestep -n 8760 -if -o hourlypics_dir/back_%04d.hdr viewpics_dir/back_%03d.hdr \
	bsdf/fullwindow.xml matrices/daylightmatrix_direct.dmx matrices/OakLand_direct.smx 

time dctimestep -n 8760 -if -o hourlypics_ds/back_%04d.hdr viewpics_ds/back_%04d.hdr \
	matrices/OakLand_direct_m6.smx

time for t in {1..8760} 
do ts=`printf %04d $t `
pcomb -e 'lo=li(1)-li(2)+li(3)*li(4)' -o hourlypics/back_${ts}.hdr -o hourlypics_dir/back_${ts}.hdr \
	-o hourlypics_ds/back_${ts}.hdr -o materialmap.hdr > hourlyresult/back_${ts}.hdr 
done
printf "\nAll Done with 5-phase Rendering sim\n"
pcond hourlyresult/back_0015.hdr | ximage &""")  # disabled

cluster = Cluster(L=execute_ssh_async_3.Stdout)
obj2rad = ObjToRad(ObjFiles=mesh2obj.ObjFiles, MapFile=mesh2obj.MapFile, Run=mesh2obj.Run)  # -> Status, RadFiles, Run
execute_ssh_async_4 = ExecuteSSHAsync(SSHCommands=concat, Run=falsestart_4)  # -> Stdout, Stderr, Log, Pid, Ran
cluster_2 = Cluster(L=overrides_4.Output)
panel_32 = Panel(cluster)
execute_ssh_async_5 = ExecuteSSHAsync(SSHCommands=overrides_4.Output, Run=obj2rad.Run)  # -> Stdout, Stderr, Log, Pid, Ran
panel_33 = Panel(cluster_2)
branch = TreeBranch(Tree=geo, Path="2", MaintainPaths=True)
meshit2 = MeshIt2(mesh_brep=branch)
cluster_3 = Cluster(L=execute_ssh_async_5.Stdout)
item = ListItem(List=flatten(execute_ssh_async_5.Stdout), Index=0, Wrap=True)  # -> Item, Item1
panel_34 = Panel(execute_ssh_async_4.Stderr)
panel_35 = Panel(cluster_3)

cull = CullPattern(List=graft(layer_name), CullPattern=graft(python.is_transparent))  # -> simplify(List)
cull_2 = CullPattern(List=geo, CullPattern=python.is_transparent)
python_2 = GhPythonScript(layer_name=cull)  # -> out, transmittance, name
# ---------- python_2: Python ----------
__author__ = "mm1013"
__version__ = "2022.01.16"

import rhinoscriptsyntax as rs

try:
    transmittance = layer_name.split("_")[-1].replace("%","")
    name = layer_name.replace("%","")
except:
    transmittance = None
    name = None
# ---------- end python_2 ----------
clean = CleanTree(
    RemoveNulls=True,
    RemoveInvalid=True,
    RemoveEmpty=True,
    Tree=simplify(cull_2),
    SynchronousTree1=simplify(python_2.name),
    SynchronousTree2=simplify(python_2.transmittance))  # -> Tree, SynchronousTree1, SynchronousTree2
mesh_2 = MeshBrep(
    Brep=clean.Tree,
    Settings={GridMaxCount=0, GridMinCount=16, JaggedSeams=False, MaxEdgeLength=0, MinEdgeLength=0.0001, MinTolerance=0, Refine=True, RefineAngle=0, RelativeTolerance=0.65, SimplePlanes=True, Tolerance=0})
transmittance = Number(expr("x/100", clean.SynchronousTree2))
name = Text(clean.SynchronousTree1)
geo_2 = Geometry(mesh_2)

c_script = CSharpScript(x=meshit2)  # -> out, A; inputs x: Mesh
# ---------- c_script: C# ----------
    Mesh m = x;
    m.Faces.CullDegenerateFaces();
    A = m;
# ---------- end c_script ----------
imageviewer = LBImageViewer(ImagePath_=item.Item1, _scale_=1, DisableClickable=False, SaveImgWithCoords=False, scale=1)  # -> ImagePath, Values, GIF
panel_36 = Panel(execute_ssh_async_5.Stderr)
panel_37 = Panel(layer_name)

cull_3 = CullPattern(List=graft(layer_name), CullPattern=graft(python.is_grid))  # -> simplify(List)
cull_4 = CullPattern(List=geo, CullPattern=python.is_grid)
grid_size_2 = Number(docunits_2)
offset = Number(docunits)
clean_2 = CleanTree(RemoveNulls=True, RemoveInvalid=True, RemoveEmpty=True, Tree=cull_3, SynchronousTree1=simplify(cull_4))  # -> Tree, SynchronousTree1
geo_3 = Geometry(graft(clean_2.SynchronousTree1))
rectangle = Rectangle(Plane=PlaneXY(0, 0, 0), XSize=Domain(-1, 1), YSize=Domain(-2, 2), Radius=0)  # -> Rectangle, Length
flip = Flip(Surface=geo_3, Guide=rectangle.Rectangle)  # -> Surface, Result
custom_mesh_settings = SettingsCustom(
    StitchSeams=True,
    SimplePlanes=False,
    Refine=True,
    MinCount=16,
    MaxCount=400,
    AspectRatio=20,
    MaxDistance=0,
    MaxAngle=20,
    MinEdge=grid_size_2,
    MaxEdge=grid_size_2)
normals = Normals(geo=flip.Surface, amplitude=offset)  # -> center_2, norm_2, P
mesh_3 = MeshBrep(Brep=flip.Surface, Settings=custom_mesh_settings)
move = Move(Geometry=mesh_3, Motion=normals.norm_2)  # -> Geometry, Transform
facen_2 = FaceNormals(Mesh=move.Geometry)  # -> Centers, Normals

cull_5 = CullPattern(List=graft(layer_name), CullPattern=graft(python.is_opaque))  # -> simplify(List)
cull_6 = CullPattern(List=geo, CullPattern=graft(python.is_opaque))  # -> simplify(List)
panel_38 = Panel(cull_5)
python_3 = GhPythonScript(layer_name=panel_38)  # -> out, reflectance
# ---------- python_3: Python ----------
__author__ = "mm1013"
__version__ = "2022.01.16"

import rhinoscriptsyntax as rs
try:
    reflectance = layer_name.split("_")[-1]
    
except:
    reflectance = None
# ---------- end python_3 ----------
clean_3 = CleanTree(
    RemoveNulls=True,
    RemoveInvalid=True,
    RemoveEmpty=True,
    Tree=cull_5,
    SynchronousTree1=cull_6,
    SynchronousTree2=python_3.reflectance)  # -> Tree, SynchronousTree1, SynchronousTree2
geo_4 = Geometry(clean_3.SynchronousTree1)
refl = Number(clean_3.SynchronousTree2)
name_2 = Text(clean_3.Tree)

imageviewer_2 = LBImageViewer(ImagePath_=item.Item, _scale_=1, DisableClickable=False, SaveImgWithCoords=False, scale=1)  # -> ImagePath, Values, GIF
panel_39 = Panel(refl)
walls = Geometry(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)
floor = Geometry(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)
panel_40 = Panel("""Floors
Walls""")
panel_41 = Panel(name)
mesh_4 = Mesh(floor)
mesh_5 = Mesh(walls)
mesh_6 = Mesh(geo_2)
graft = GraftTree(Tree=panel_40, IncludeEmptyLists=True, IncludeNullItems=True)
entwine = Entwine(Branch00=mesh_4, Branch01=mesh_5, FlattenInputs=True)
concat_2 = Concatenate(FragmentA=panel_41, FragmentB="_mat")
preview = CustomPreview(Geometry=mesh_6, Material=ColourSwatch(SwatchColor=RGBA(35, 174, 186, 25)))
# export PATH=$PATH.:/usr/local/radiance/bin
# export RAYPATH=.:/usr/local/radiance/lib
# obj2rad -m /home/mss/simulation/mapping.map -f /home/mss/simulation/twoMeshes4.obj 2>&1 1>/home/mss/simulation/x.rad
# head /home/mss/simulation/x.rad
panel_42 = Panel("""export PATH=$PATH.:/usr/local/radiance/bin
export RAYPATH=.:/usr/local/radiance/lib
objline ~/simulation/twoMeshes5.rad | meta2tga -x 1048 -y 1048 | ra_t8 -r > ~/simulation/test.hdr
normtiff ~/simulation/test.hdr ~/simulation/test.tif
convert ~/simulation/test.tif ~/simulation/test.png
echo "C:\Users\mm1013\simulation\test.png"
""")  # disabled
preview_2 = CustomPreview(Geometry=geo_4, Material=ColourSwatch(SwatchColor=RGBA(64, 64, 64, 123)))

start_raytracing_2ph_dds = LBFalseStartToggle(False)
prep_octrees = LBFalseStartToggle(False)
raytrace_2ph = Boolean(start_raytracing_2ph_dds)

# ----
# Create working folder
panel_43 = Panel("mkdir -p <proj>;echo <proj>")
applyglobals_4 = ApplyGlobals(Input=panel_43)  # -> Output, Pairs
execute_ssh_async_6 = ExecuteSSHAsync(SSHCommands=applyglobals_4.Output, Run=prep_octrees, stdouts="/home/mss/simulation/test_project")  # -> Stdout, Stderr, Log, Pid, Ran

falsestart_5 = LBFalseStartToggle(False)  # disabled
execute_ssh_async_7 = ExecuteSSHAsync(SSHCommands=panel_42, Run=falsestart_5)  # -> Stdout, Stderr, Log, Pid, Ran; disabled

overrides_5 = ApplyOverrides(Input="<projname>")  # -> Output, Pairs
overrides_6 = ApplyOverrides(Input="<projfolder>/radFiles")  # -> Output, Pairs

imageviewer_3 = LBImageViewer(ImagePath_=execute_ssh_async_7.Stdout, _scale_=1, DisableClickable=False, SaveImgWithCoords=False, scale=1)  # -> ImagePath, Values, GIF; disabled

# ----
# grid points
geo_5 = Geometry(floor)
pt = Point(facen_2.Centers)
vec = Vector(facen_2.Normals)
area = Area(Geometry=geo_5)  # -> Area, Centroid
scale = Scale(Geometry=geo_5, Center=area.Centroid, Factor="1.3")  # -> Geometry, Transform
# Grid
sdivide = DivideSurface(Surface=scale.Geometry, UCount=10, VCount=20)  # -> Points, Normals, Parameters
panel_44 = Panel(sdivide.Parameters)
lng = ListLength(List=flatten(pt))
overrides_7 = ApplyOverrides(Input="<projfolder>")  # -> Output, Pairs
points2pts = PointsToPts(Points=flatten(pt), Vectors=vec, Name="points", SubfolderOverride=overrides_7.Output, Run=execute_ssh_async_6.Ran)  # -> PtsFile, Run
ptscount = Integer(lng)
points_2 = Text(points2pts.PtsFile)

# ----
# Geometry
panel_45 = Panel("_mat")
concat_3 = Concatenate(FragmentA=name_2, FragmentB=panel_45)
mesh2obj_2 = MeshToObj(Mesh=geo_4, Name=name_2, ModifierName=concat_3, SubfolderOverride=overrides_5.Output, Run=execute_ssh_async_6.Ran)  # -> ObjFiles, MapFile, Run
# rad files
obj2rad_2 = ObjToRad(ObjFiles=mesh2obj_2.ObjFiles, MapFile=mesh2obj_2.MapFile, SubfolderOverride=overrides_6.Output, Run=mesh2obj_2.Run)  # -> Status, RadFiles, Run

# ----
# window geometry
mesh2obj_3 = MeshToObj(Mesh=mesh_6, Name=panel_41, ModifierName=concat_2, SubfolderOverride=overrides_5.Output, Run=execute_ssh_async_6.Ran)  # -> ObjFiles, MapFile, Run
obj2rad_3 = ObjToRad(ObjFiles=mesh2obj_3.ObjFiles, MapFile=mesh2obj_3.MapFile, SubfolderOverride=overrides_6.Output, Run=mesh2obj_3.Run)  # -> Status, RadFiles, Run

panel_46 = Panel(execute_ssh_async_7.Stderr)  # disabled

# ----
# WEA file
# create WEA file
path = FilePath("C:\ladybug\NOR_OS_Alna.014870_TMYx.2004-2018\NOR_OS_Alna.014870_TMYx.2004-2018.epw")
upload = Upload(LocalFilePaths=path, SubfolderOverride="simulation/weatherData", Run=execute_ssh_async_6.Ran)  # -> Status, FilePaths, Run
rep = ReplaceText(Text=upload.FilePaths, Find=".epw", Replace=".wea", RecursiveReplace=False)
panel_47 = Panel("""in
out""")
applyglobals_5 = ApplyGlobals(Input="epw2wea <in> <out> 1>&2;echo <out>", AdditionalKeys=panel_47, AdditionalValues=[upload.FilePaths, rep])  # -> Output, Pairs
execute_ssh_async_8 = ExecuteSSHAsync(
    SSHCommands=applyglobals_5.Output,
    Run=upload.Run,
    stdouts="/home/mss/simulation/weatherData/NOR_OS_Alna.014870_TMYx.2004-2018.wea")  # -> Stdout, Stderr, Log, Pid, Ran
file_exists = Panel("[ -f <out> ] && echo \"1\" || echo \"0\"")
panel_48 = Panel(execute_ssh_async_8.Stderr)
panel_49 = Panel(execute_ssh_async_8.Stdout)
applyglobals_6 = ApplyGlobals(Input=file_exists, AdditionalKeys="out", AdditionalValues=execute_ssh_async_8.Stdout)  # -> Output, Pairs
execute_ssh_async_9 = ExecuteSSHAsync(SSHCommands=applyglobals_6.Output, Run=upload.Run, stdouts="1")  # -> Stdout, Stderr, Log, Pid, Ran
wea_file = Text(execute_ssh_async_8.Stdout)

# ----
# opaque materials
panel_50 = Panel("echo \"<mats>\" > <proj>/radFiles/<target>;echo \"<proj>/radFiles/<target>\"")
opaquegreymat = OpaqueGreyMat(Name=concat_3, Reflectance_0_1=refl, Specularity=0, Roughness=0)  # -> flatten(RadMaterials), RadMaterialList
join_2 = TextJoin(Text=opaquegreymat.RadMaterials)
entwine_2 = Entwine(Branch00=join_2, Branch01="opaque_materials.mat", FlattenInputs=True)  # -> flatten(Result)
panel_51 = Panel("""mats
target""")
applyglobals_7 = ApplyGlobals(Input=panel_50, AdditionalKeys=panel_51, AdditionalValues=entwine_2)  # -> Output, Pairs
execute_ssh_async_10 = ExecuteSSHAsync(SSHCommands=applyglobals_7.Output, Run=obj2rad_2.Run, stdouts="~/simulation/test_project/radFiles/opaque_materials.mat")  # -> Stdout, Stderr, Log, Pid, Ran
opaque_mat = Text(execute_ssh_async_10.Stdout)
opaque_rad = Text(obj2rad_2.RadFiles)

# ----
# Setup glass materials
panel_52 = Panel("0.8")
glassmat = GlassMat(Name=concat_2, Transmittance_0_1=transmittance)  # -> RadMaterials, RadMaterialList
# 2phase DDS simulation
# materials
panel_53 = Panel("echo \"<mats>\" > <proj>/radFiles/<target>;echo \"<proj>/radFiles/<target>\"")
entwine_3 = Entwine(Branch00=glassmat.RadMaterials, Branch01="glass_materials.mat", FlattenInputs=True)  # -> flatten(Result)
panel_54 = Panel("""mats
target""")
applyglobals_8 = ApplyGlobals(Input=panel_53, AdditionalKeys=panel_54, AdditionalValues=entwine_3)  # -> Output, Pairs
execute_ssh_async_11 = ExecuteSSHAsync(SSHCommands=applyglobals_8.Output, Run=obj2rad_2.Run, stdouts="~/simulation/test_project/radFiles/glass_materials.mat")  # -> Stdout, Stderr, Log, Pid, Ran
window_mat = Text(execute_ssh_async_11.Stdout)
window_rad = Text(obj2rad_3.RadFiles)

# ----
# -f is frozen (all links embedded)
panel_55 = Panel("oconv -f <rads> > <proj>/<target>.oct;echo <proj>/<target>.oct")

# ----
# Create skyglow.rad
panel_56 = Panel("""#@rfluxmtx u=+Y h=u
void glow groundglow
0
0
4 1 1 1 0

groundglow source ground
0
0
4 0 0 -1 180

#@rfluxmtx u=+Y h=r1
void glow skyglow
0
0
4 1 1 1 0

skyglow source skydome
0
0
4 0 0 1 180""")
panel_57 = Panel("""mkdir -p <proj>/radFiles
echo "<skyglow>" > <proj>/radFiles/<target>; echo <proj>/radFiles/<target>""")
panel_58 = Panel("""skyglow
target""")
applyglobals_9 = ApplyGlobals(Input=panel_57, AdditionalKeys=panel_58, AdditionalValues=[panel_56, "skyglow.rad"])  # -> Output, Pairs
execute_ssh_async_12 = ExecuteSSHAsync(
    SSHCommands=applyglobals_9.Output,
    Run=execute_ssh_async_6.Ran,
    stdouts="/home/mss/simulation/test_project/radFiles/skyglow.rad")  # -> Stdout, Stderr, Log, Pid, Ran
applyglobals_10 = ApplyGlobals(Input="head <proj>/radFiles/<target>", AdditionalKeys=panel_58, AdditionalValues=[panel_56, "skyglow.rad"])  # -> Output, Pairs
execute_ssh_async_13 = ExecuteSSHAsync(
    SSHCommands=applyglobals_10.Output,
    Run=execute_ssh_async_12.Ran,
    stdouts="""#@rfluxmtx u=+Y h=u
void glow groundglow
0
0
4 1 1 1 0

groundglow source ground
0
0
4 0 0 -1 180""")  # -> Stdout, Stderr, Log, Pid, Ran
panel_59 = Panel(execute_ssh_async_12.Stdout)
panel_60 = Panel(execute_ssh_async_13.Stdout)
skyglow = Text(execute_ssh_async_12.Stdout)

# ----
# Create a dummy gensky for renders
panel_61 = Panel("sky_10klx.mat")
panel_62 = Panel("""mkdir -p <proj>/radFiles/
gensky 12 4 +12:00 -c -B 55.866 > <proj>/radFiles/<target>; echo <proj>/radFiles/<target>""")
applyglobals_11 = ApplyGlobals(Input=panel_62, AdditionalKeys="target", AdditionalValues=panel_61)  # -> Output, Pairs
execute_ssh_async_14 = ExecuteSSHAsync(
    SSHCommands=applyglobals_11.Output,
    Run=invert(execute_ssh_async_6.Ran),
    stdouts="/home/mss/simulation/test_project/radFiles/sky_10klx.mat")  # -> Stdout, Stderr, Log, Pid, Ran
applyglobals_12 = ApplyGlobals(Input="head <proj>/radFiles/<target>", AdditionalKeys="target", AdditionalValues=panel_61)  # -> Output, Pairs
execute_ssh_async_15 = ExecuteSSHAsync(
    SSHCommands=applyglobals_12.Output,
    Run=execute_ssh_async_14.Ran,
    stdouts="""# gensky 12 4 +12:00 -c -B 55.866
# Local solar time: 12.00
# Solar altitude and azimuth: 30.0 -0.0
# Ground ambient level: 17.8

void brightfunc skyfunc
2 skybr skybright.cal
0
3 2 2.29e+01 3.56e+00""")  # -> Stdout, Stderr, Log, Pid, Ran
panel_63 = Panel(execute_ssh_async_14.Stdout)
panel_64 = Panel(execute_ssh_async_15.Stdout)
sky10klx = Text(execute_ssh_async_14.Stdout)

# ----
# Annual sky-matrix 145 patches
wea_file_2 = Text(wea_file)
# Skies and Skymatrices
panel_65 = Panel("gendaymtx -m 1 \"<wea>\" > <smx>;echo \"<smx>\"")
rep_2 = ReplaceText(Text=wea_file_2, Find=".wea", Replace=".smx", RecursiveReplace=False)
panel_66 = Panel("""wea
smx""")
applyglobals_13 = ApplyGlobals(Input=panel_65, AdditionalKeys=panel_66, AdditionalValues=[wea_file_2, rep_2])  # -> Output, Pairs
execute_ssh_async_16 = ExecuteSSHAsync(
    SSHCommands=applyglobals_13.Output,
    Run=execute_ssh_async_9.Ran,
    stdouts="/home/mss/simulation/weatherData/NOR_OS_Alna.014870_TMYx.2004-2018.smx")  # -> Stdout, Stderr, Log, Pid, Ran
panel_67 = Panel(execute_ssh_async_16.Stdout)

# ----
# Sun matrix with 5165 suns
wea_file_3 = Text(wea_file)
panel_68 = Panel("gendaymtx -5 0.533 -d -m 6 \"<wea>\" > <smx>;echo \"<smx>\"")
rep_3 = ReplaceText(Text=wea_file_3, Find=".wea", Replace="sunM6.smx", RecursiveReplace=False)
panel_69 = Panel("""wea
smx""")
applyglobals_14 = ApplyGlobals(Input=panel_68, AdditionalKeys=panel_69, AdditionalValues=[wea_file_3, rep_3])  # -> Output, Pairs
execute_ssh_async_17 = ExecuteSSHAsync(
    SSHCommands=applyglobals_14.Output,
    Run=execute_ssh_async_9.Ran,
    stdouts="/home/mss/simulation/weatherData/NOR_OS_Alna.014870_TMYx.2004-2018sunM6.smx")  # -> Stdout, Stderr, Log, Pid, Ran
panel_70 = Panel(execute_ssh_async_17.Stdout)

# ----
# Annual direct only daylight matrix with 145 patches
wea_file_4 = Text(wea_file)
rep_4 = ReplaceText(Text=wea_file_4, Find=".wea", Replace="d.smx", RecursiveReplace=False)
panel_71 = Panel("""wea
smx""")
applyglobals_15 = ApplyGlobals(
    Input="gendaymtx -m 1 -d \"<wea>\" > <smx>;echo \"<smx>\"",
    AdditionalKeys=panel_71,
    AdditionalValues=[wea_file_4, rep_4])  # -> Output, Pairs
execute_ssh_async_18 = ExecuteSSHAsync(
    SSHCommands=applyglobals_15.Output,
    Run=execute_ssh_async_9.Ran,
    stdouts="/home/mss/simulation/weatherData/NOR_OS_Alna.014870_TMYx.2004-2018d.smx")  # -> Stdout, Stderr, Log, Pid, Ran
panel_72 = Panel(execute_ssh_async_18.Stdout)

panel_73 = Panel("""target
rads""")

panel_74 = Panel("""sky
target""")
applyglobals_16 = ApplyGlobals(
    Input="oconv <sky> > <proj>/<target>",
    AdditionalKeys=panel_74,
    AdditionalValues=[execute_ssh_async_14.Stdout, "sky_10klx.oct"])  # -> Output, Pairs
execute_ssh_async_19 = ExecuteSSHAsync(SSHCommands=applyglobals_16.Output, Run=execute_ssh_async_15.Ran)  # -> Stdout, Stderr, Log, Pid, Ran
panel_75 = Panel(execute_ssh_async_19.Stderr)

panel_76 = Panel("""mkdir -p <proj>/images/
objpict <sky> > <proj>/images/<target-.>.hdr
normtif <proj>/images/<target-.>.hdr > <proj>/images/<target>
echo <proj>/images/<target>""")
radfile = Text(execute_ssh_async_14.Stdout)
panel_77 = Panel("""sky
target""")
applyglobals_17 = ApplyGlobals(Input=panel_76, AdditionalKeys=panel_77, AdditionalValues=[radfile, "sky_10klx.png"])  # -> Output, Pairs
execute_ssh_async_20 = ExecuteSSHAsync(
    SSHCommands=applyglobals_17.Output,
    Run=execute_ssh_async_15.Ran,
    stdouts="/home/mss/simulation/test_project/images/sky_10klx.png")  # -> Stdout, Stderr, Log, Pid, Ran
convertpaths = ConvertPaths(I=execute_ssh_async_20.Stdout)  # -> Linux, Windows
hdr_gif = HBHDRToGIF(hdr=convertpaths.Windows)  # -> gif; plug-in component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
imageviewer_4 = LBImageViewer(ImagePath_=hdr_gif, _scale_=1, DisableClickable=False, SaveImgWithCoords=False, scale=1)  # -> ImagePath, Values, GIF

txt = Text(sky10klx)
ptscount_2 = Integer(ptscount)
ptscount_3 = Integer(ptscount)
m6_sky_mtx = Text(panel_70)
panel_78 = Panel("""C:\Users\mm1013\simulation\NRH_J_Para_LT06_Lysning07_WWR055_Facades03\daylight_factor\model\scene\envelope.mat
C:\Users\mm1013\simulation\NRH_J_Para_LT06_Lysning07_WWR055_Facades03\daylight_factor\model\scene\envelope.rad""")  # disabled

view = CreateView(Viewport="MyCamera")  # -> ViewfileContent, ImageRatio
panel_79 = Panel(view.ViewfileContent)

radviewer = RadViewer(RadFiles=panel_78, IsTwoSided=True)  # -> Meshes, Names, ModifierNames, Modifiers, FailedWireFrame; disabled
falsestart_6 = LBFalseStartToggle(False)
crv = Curve(radviewer.FailedWireFrame)  # disabled
panel_80 = Panel(radviewer.Modifiers)
points_3 = Text(points_2)
analysisperiod = LBAnalysisPeriod(start_month=1, start_day=1, start_hour="8", end_hour="18")  # -> period, hoys, dates; plug-in component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
pt_2 = Point(flatten(pt))
Z = UnitZ(Factor=1)
long = LongestList(ListA=pt_2, ListB=Z, PaddingMode=2)  # -> ListA, ListB
honeybee = Honeybee_Honeybee()  # -> Vviiiiiiiiiizzz; plug-in component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
toggle_2 = BooleanToggle(False)
pt_3 = Point(pt_2)
falsestart_7 = LBFalseStartToggle(False)
applyglobals_18 = ApplyGlobals(Input="[ -f <file> ] && echo \"1\" || echo \"0\"", AdditionalKeys="file", AdditionalValues="~/simulation/points.pts2")  # -> Output, Pairs
execute_ssh_async_21 = ExecuteSSHAsync(SSHCommands=applyglobals_18.Output, Run=falsestart_7)  # -> Stdout, Stderr, Log, Pid, Ran
panel_81 = Panel(execute_ssh_async_21.Stdout)

panel_82 = Panel("cat ~/.bashrc")  # disabled
panel_83 = Panel("dwd | tee ~/simulation/log.txt")  # disabled
falsestart_8 = LBFalseStartToggle(False)  # disabled

execute_ssh_async_22 = ExecuteSSHAsync(SSHCommands=[panel_82, panel_83], Run=falsestart_8)  # -> Stdout, Stderr, Log, Pid, Ran; disabled

panel_84 = Panel(execute_ssh_async_22.Stdout)  # disabled
panel_85 = Panel(execute_ssh_async_22.Log)  # disabled
panel_86 = Panel(execute_ssh_async_22.Stderr)  # disabled

# ----
# Check if ximage and other x-commands work.
# Must have Xlaunch running on windows with disabled access control
# Otherwise it will crash!
panel_87 = Panel("""export "DISPLAY=$(ip route list default | awk '{print $3}'):0"
export "LIBGL_ALWAYS_INDIRECT=1"
xclock""")
falsestart_9 = LBFalseStartToggle(False)

execute_ssh_async_23 = ExecuteSSHAsync(SSHCommands=panel_87, Run=falsestart_9)  # -> Stdout, Stderr, Log, Pid, Ran
panel_88 = Panel(execute_ssh_async_23.Log)

panel_89 = Panel(execute_ssh_async_23.Stderr)

# ----
# Black Geometry
item_2 = ListItem(List=geo_4, Index=0, Wrap=True)
concat_4 = Concatenate(FragmentA=name_2, FragmentB="_black")

long_2 = LongestList(ListA=item_2, ListB="blackMaterial", PaddingMode=2)  # -> ListA, ListB

mesh2obj_4 = MeshToObj(Mesh=geo_4, Name=concat_4, ModifierName=long_2.ListB, SubfolderOverride=overrides_5.Output, Run=execute_ssh_async_6.Ran)  # -> ObjFiles, MapFile, Run
obj2rad_4 = ObjToRad(ObjFiles=mesh2obj_4.ObjFiles, MapFile=mesh2obj_4.MapFile, SubfolderOverride=overrides_6.Output, Run=mesh2obj_4.Run)  # -> Status, RadFiles, Run

# ----
# blackmaterials
panel_90 = Panel("0.0")
opaquegreymat_2 = OpaqueGreyMat(Name=flatten("blackMaterial"), Reflectance_0_1=panel_90, Specularity=0, Roughness=0)  # -> RadMaterials, RadMaterialList
panel_91 = Panel("echo \"<mats>\" > <proj>/radFiles/<target>;echo \"<proj>/radFiles/<target>\"")
panel_92 = Panel("""mats
target""")
entwine_4 = Entwine(Branch00=opaquegreymat_2.RadMaterials, Branch01="black_material.mat", FlattenInputs=True)  # -> flatten(Result)
applyglobals_19 = ApplyGlobals(Input=panel_91, AdditionalKeys=panel_92, AdditionalValues=entwine_4)  # -> Output, Pairs
execute_ssh_async_24 = ExecuteSSHAsync(SSHCommands=applyglobals_19.Output, Run=obj2rad_4.Run, stdouts="~/simulation/test_project/radFiles/black_material.mat")  # -> Stdout, Stderr, Log, Pid, Ran
black_rad_files = Text(obj2rad_4.RadFiles)
black_mat = Text(execute_ssh_async_24.Stdout)

# ----
# create black octree
black_rad_files_2 = Text(black_rad_files)
window_mat_2 = Text(window_mat)
window_rad_2 = Text(window_rad)
black_mat_2 = Text(black_mat)
and = GateAnd(A=execute_ssh_async_11.Ran, B=execute_ssh_async_24.Ran)
panel_93 = Panel("oconv -f <rads> > ~/simulation/myscene_black.oct;echo ~/simulation/myscene_black.oct")
entwine_5 = Entwine(Branch02=black_mat_2, Branch03=black_rad_files_2, FlattenInputs=True)  # -> flatten(Result)
join_3 = TextJoin(Text=flatten(entwine_5), Join=" ")
rep_5 = ReplaceText(Text=panel_93, Find="<rads>", Replace=join_3, RecursiveReplace=False)
execute_ssh_async_25 = ExecuteSSHAsync(SSHCommands=rep_5, Run=and, stdouts="/home/mss/simulation/myscene_black.oct")  # -> Stdout, Stderr, Log, Pid, Ran
panel_94 = Panel(execute_ssh_async_25.Stdout)
octree_black = Text(execute_ssh_async_25.Stdout)

# ----
# Sun
# sun primitive
panel_95 = Panel("""export PATH=$PATH.:/usr/local/radiance/bin
export RAYPATH=.:/usr/local/radiance/lib
echo "void light solar 0 0 3 1e6 1e6 1e6" > <target>
echo "<target>"
""")

applyglobals_20 = ApplyGlobals(Input=panel_95, AdditionalKeys="target", AdditionalValues="~/simulation/suns.rad")  # -> Output, Pairs
panel_96 = Panel("""export PATH=$PATH.:/usr/local/radiance/bin
export RAYPATH=.:/usr/local/radiance/lib
cnt 5165 | rcalc -e MF:6 -f reinsrc.cal -e Rbin=recno -o 'solar source sun 0 0 4 ${Dx} ${Dy} ${Dz} 0.553' >> <target>
echo <target>""")

execute_ssh_async_26 = ExecuteSSHAsync(SSHCommands=applyglobals_20.Output, Run=execute_ssh_async_6.Ran, stdouts="~/simulation/suns.rad")  # -> Stdout, Stderr, Log, Pid, Ran

# ----
# solar discs and modifiers for 5165 suns (=MF:6)
panel_97 = Panel("target")
applyglobals_21 = ApplyGlobals(Input=panel_96, AdditionalKeys=panel_97, AdditionalValues=execute_ssh_async_26.Stdout)  # -> Output, Pairs
execute_ssh_async_27 = ExecuteSSHAsync(SSHCommands=applyglobals_21.Output, Run=execute_ssh_async_26.Ran, stdouts="/home/mss/simulation/suns.rad")  # -> Stdout, Stderr, Log, Pid, Ran

# ----
# Octrees
# STANDARD octree
window_mat_3 = Text(window_mat)
opaque_mat_2 = Text(opaque_mat)
opaque_rad_2 = Text(opaque_rad)
window_rad_3 = Text(window_rad)
and_2 = GateAnd(A=execute_ssh_async_11.Ran, B=execute_ssh_async_10.Ran)
entwine_6 = Entwine(Branch00=window_mat_3, Branch01=window_rad_3, Branch02=opaque_mat_2, Branch03=opaque_rad_2, FlattenInputs=True)  # -> flatten(Result)
join_4 = TextJoin(Text=flatten(entwine_6), Join=" ")
or = GateOr(A=and_2)

entwine_7 = Entwine(Branch00="myscene", Branch01=join_4, FlattenInputs=True)  # -> flatten(Result)

# ----
# preview rad files
convertpaths_2 = ConvertPaths(I=entwine_6)  # -> Linux, Windows
item_3 = ListItem(List=convertpaths_2.Windows, Index=0, Wrap=True)
rep_6 = ReplaceText(Text=item_3, Find="~", RecursiveReplace=False)
rep_7 = ReplaceText(Text=convertpaths_2.Linux, Find="~/simulation", Replace=rep_6, RecursiveReplace=False)
rep_8 = ReplaceText(Text=rep_7, Find="/", Replace="\", RecursiveReplace=False)
radviewer_2 = RadViewer(RadFiles=rep_8, IsTwoSided=True)  # -> Meshes, Names, ModifierNames, Modifiers, FailedWireFrame
crv_2 = Curve(radviewer_2.FailedWireFrame)

applyglobals_22 = ApplyGlobals(Input=panel_55, AdditionalKeys=panel_73, AdditionalValues=entwine_7)  # -> Output, Pairs
panel_98 = Panel(applyglobals_22.Output)

execute_ssh_async_28 = ExecuteSSHAsync(SSHCommands=applyglobals_22.Output, Run=Toggle(True), stdouts="/home/mss/simulation/test_project/myscene.oct")  # -> Stdout, Stderr, Log, Pid, Ran
panel_99 = Panel(execute_ssh_async_28.Stdout)
panel_100 = Panel(execute_ssh_async_28.Ran)
octree = Text(execute_ssh_async_28.Stdout)

# ----
# Generate daylight coefficients
panel_101 = Panel("/home/mss/simulation/dc_illum.mtx")
# NO GOOD METHOD (YET) OF MAKING SURE
# THESE 3 DONT RUN AT THE SAME TIME.
# 
# Unless we chain them (doing that as a temp fix)
# Raytracing (rfluxmtx)
panel_102 = Panel("""export PATH=$PATH.:/usr/local/radiance/bin
export RAYPATH=.:/usr/local/radiance/lib
mkdir -p <proj>/mtxs/
rfluxmtx -I+ -y <ptcount> -lw 0.0001 -ab 5 -ad 5000 -n <cpus> - <skyglow> -i <octree> < <points> > <target>;echo <target>""")
raytrace_2ph_2 = Boolean(raytrace_2ph)
skyglow_2 = Text(skyglow)
ptscount_4 = Integer(ptscount)
octree_2 = Text(octree)
points_4 = Text(points_2)
panel_103 = Panel("""points
octree
skyglow
ptcount
target""")
and_3 = GateAnd(
    octree_ok=execute_ssh_async_28.Ran,
    skyglow_ok=execute_ssh_async_12.Ran,
    points_ok=points2pts.Run,
    raytrace=raytrace_2ph_2)
entwine_8 = Entwine(Branch00=points_4, Branch01=octree_2, Branch02=skyglow_2, Branch03=ptscount_4, Branch04=panel_101, FlattenInputs=True)  # -> flatten(Result)
applyglobals_23 = ApplyGlobals(Input=panel_102, AdditionalKeys=panel_103, AdditionalValues=entwine_8)  # -> Output, Pairs
execute_ssh_async_29 = ExecuteSSHAsync(SSHCommands=applyglobals_23.Output, Run=and_3, stdouts="/home/mss/simulation/dc_illum.mtx")  # -> Stdout, Stderr, Log, Pid, Ran
panel_104 = Panel(applyglobals_23.Output)
panel_105 = Panel(execute_ssh_async_29.Stdout)

# ----
# Generate daylight coefficients black (direct only)
panel_106 = Panel("/home/mss/simulation/dcd_illum.mtx")
panel_107 = Panel("""export PATH=$PATH.:/usr/local/radiance/bin
export RAYPATH=.:/usr/local/radiance/lib
mkdir -p <proj>/mtxs/
rfluxmtx -I+ -y <ptcount> -lw 0.0002 -ab 1 -ad 5000 -n <cpus> - <skyglow> -i <octree> < <points> > <target>;echo <target>""")
octree_black_2 = Text(octree_black)
skyglow_3 = Text(skyglow)
points_5 = Text(points_2)
panel_108 = Panel("""points
octree
skyglow
ptcount
target""")
and_4 = GateAnd(
    octree_ok=execute_ssh_async_25.Ran,
    skyglow_ok=execute_ssh_async_25.Ran,
    points_ok=points2pts.Run,
    ran_above=execute_ssh_async_29.Ran)
entwine_9 = Entwine(
    Branch00=points_5,
    Branch01=octree_black_2,
    Branch02=skyglow_3,
    Branch03=ptscount_2,
    Branch04=panel_106,
    FlattenInputs=True)  # -> flatten(Result)
applyglobals_24 = ApplyGlobals(Input=panel_107, AdditionalKeys=panel_108, AdditionalValues=entwine_9)  # -> Output, Pairs
execute_ssh_async_30 = ExecuteSSHAsync(SSHCommands=applyglobals_24.Output, Run=and_4, stdouts="/home/mss/simulation/dcd_illum.mtx")  # -> Stdout, Stderr, Log, Pid, Ran
panel_109 = Panel(execute_ssh_async_30.Stdout)
panel_110 = Panel(applyglobals_24.Output)

# ----
# - Results of daylight coefficients (direct from 145 sample sky)
panel_111 = Panel("""export PATH=$PATH.:/usr/local/radiance/bin
export RAYPATH=.:/usr/local/radiance/lib
mkdir -p <proj>/results/
dctimestep <dcillum> <skymtx> | rmtxop -fa -t -c 47.4 119.9 11.6 - > <proj>/results/<target>;echo <proj>/results/<target>""")
panel_112 = Panel("""dcillum
skymtx
target""")
entwine_10 = Entwine(
    Branch00=execute_ssh_async_30.Stdout,
    Branch01=execute_ssh_async_18.Stdout,
    Branch02="annualR_DCD.ill",
    FlattenInputs=True)  # -> flatten(Result)
and_5 = GateAnd(A=execute_ssh_async_18.Ran, B=execute_ssh_async_30.Ran)
applyglobals_25 = ApplyGlobals(Input=panel_111, AdditionalKeys=panel_112, AdditionalValues=entwine_10)  # -> Output, Pairs
execute_ssh_async_31 = ExecuteSSHAsync(SSHCommands=applyglobals_25.Output, Run=and_5, stdouts="/home/mss/simulation/test_project/results/annualR_DCD.ill")  # -> Stdout, Stderr, Log, Pid, Ran
panel_113 = Panel(applyglobals_25.Output)
panel_114 = Panel(execute_ssh_async_31.Stdout)

panel_115 = Panel("head <ill> -n 13;echo \" \";echo \"Number of lines\";wc -l <ill>")
applyglobals_26 = ApplyGlobals(Input=panel_115, AdditionalKeys="ill", AdditionalValues=execute_ssh_async_31.Stdout)  # -> Output, Pairs
execute_ssh_async_32 = ExecuteSSHAsync(
    SSHCommands=applyglobals_26.Output,
    Run=execute_ssh_async_31.Ran,
    stdouts="""#?RADIANCE
rmtxop -fa -t -c 47.4 119.9 11.6 -
dctimestep /home/mss/simulation/dcd_illum.mtx /home/mss/simulation/weatherData/NOR_OS_Alna.014870_TMYx.2004-2018d.smx
CAPDATE= 2022:06:09 16:56:15
GMT= 2022:06:09 14:56:15
Applied 1x3 matrix transform
Transposed rows and columns
NROWS=8760
NCOLS=108
NCOMP=1
FORMAT=ascii

 0.000000000000000e+00	 0.000000000000000e+00	 0.000000000000000e+00	 0.000000000000000e+00	 0.000000000000000e+00	 0.000000000000000e+00	 0.000000000000000e+00	 0.000000000000000e+00	 0.000000000000000e+00	 0.000000000000000e+00	 0.000000000000000e+00	 0.000000000000000e+00	 0.000000000000000e+00	 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
 
Number of lines
8772 /home/mss/simulation/test_project/results/annualR_DCD.ill""")  # -> Stdout, Stderr, Log, Pid, Ran
panel_116 = Panel(execute_ssh_async_32.Stdout)

# ----
# create black octreeDDS
suns_material = Text(execute_ssh_async_26.Stdout)
black_rad_files_3 = Text(black_rad_files)
window_mat_4 = Text(window_mat)
window_rad_4 = Text(window_rad)
black_mat_3 = Text(black_mat)
mf6_suns = Text(execute_ssh_async_27.Stdout)
entwine_11 = Entwine(
    Branch00=window_mat_4,
    Branch01=window_rad_4,
    Branch02=black_mat_3,
    Branch03=black_rad_files_3,
    Branch04=suns_material,
    Branch05=mf6_suns,
    FlattenInputs=True)  # -> flatten(Result)
join_5 = TextJoin(Text=flatten(entwine_11), Join=" ")
panel_117 = Panel("""rads
target""")
applyglobals_27 = ApplyGlobals(
    Input="oconv -f <rads> > <target>;echo <target>",
    AdditionalKeys=panel_117,
    AdditionalValues=[join_5, "~/simulation/myscene_black_sunCoeffecientsDDS.oct"])  # -> Output, Pairs

execute_ssh_async_33 = ExecuteSSHAsync(
    SSHCommands=applyglobals_27.Output,
    Run=execute_ssh_async_27.Ran,
    stdouts="/home/mss/simulation/myscene_black_sunCoeffecientsDDS.oct")  # -> Stdout, Stderr, Log, Pid, Ran

panel_118 = Panel(execute_ssh_async_33.Stdout)
octree_blackdds = Text(panel_118)

# ----
# Calculate illuminance sun coefficients for illuminance calculations
panel_119 = Panel("cdsDDS_illum.mtx")
# Raytracing suns (rcontrib)
panel_120 = Panel("""export PATH=$PATH.:/usr/local/radiance/bin
export RAYPATH=.:/usr/local/radiance/lib
mkdir -p <proj>/mtxs/
rcontrib -I+ -ab 1 -y <ptcount> -n <cpus> -ad 256 -lw 1.0e-3 -dc 1 -dt 0 -dj 0 -faf -e MF:6 -f reinhart.cal -b rbin -bn Nrbins -m solar <octree> < <points> > <proj>/mtxs/<target>
echo <proj>/mtxs/<target>""")
octree_blackdds_2 = Text(octree_blackdds)
points_6 = Text(points_2)
panel_121 = Panel("""points
octree
ptcount
target""")
entwine_12 = Entwine(Branch00=points_6, Branch01=octree_blackdds_2, Branch02=ptscount_3, Branch03=panel_119, FlattenInputs=True)  # -> flatten(Result)
and_6 = GateAnd(octree_ok=execute_ssh_async_33.Ran, points_ok=points2pts.Run, ran_above=execute_ssh_async_30.Ran)
applyglobals_28 = ApplyGlobals(Input=panel_120, AdditionalKeys=panel_121, AdditionalValues=entwine_12)  # -> Output, Pairs
panel_122 = Panel(applyglobals_28.Output)
execute_ssh_async_34 = ExecuteSSHAsync(SSHCommands=applyglobals_28.Output, Run=and_6, stdouts="/home/mss/simulation/test_project/mtxs/cdsDDS_illum.mtx")  # -> Stdout, Stderr, Log, Pid, Ran
panel_123 = Panel(execute_ssh_async_34.Stdout)

# ----
# + Results of direct sun coefficients (5165 sample sky)
panel_124 = Panel("annualR_CDS.ill")
panel_125 = Panel("""export PATH=$PATH.:/usr/local/radiance/bin
export RAYPATH=.:/usr/local/radiance/lib
mkdir -p <proj>/results/
dctimestep <dcillum> <skymtx> | rmtxop -fa -t -c 47.4 119.9 11.6 - > <proj>/results/<target>;echo <proj>/results/<target>""")
panel_126 = Panel("""dcillum
skymtx
target""")
entwine_13 = Entwine(Branch00=panel_123, Branch01=m6_sky_mtx, Branch02=panel_124, FlattenInputs=True)  # -> flatten(Result)
and_7 = GateAnd(A=execute_ssh_async_34.Ran, B=execute_ssh_async_17.Ran)
applyglobals_29 = ApplyGlobals(Input=panel_125, AdditionalKeys=panel_126, AdditionalValues=entwine_13)  # -> Output, Pairs
execute_ssh_async_35 = ExecuteSSHAsync(SSHCommands=applyglobals_29.Output, Run=and_7, stdouts="/home/mss/simulation/test_project/results/annualR_CDS.ill")  # -> Stdout, Stderr, Log, Pid, Ran
panel_127 = Panel(applyglobals_29.Output)
panel_128 = Panel(execute_ssh_async_35.Stdout)

panel_129 = Panel("head <ill> -n 13;echo \" \";echo \"Number of lines\";wc -l <ill>")
applyglobals_30 = ApplyGlobals(Input=panel_129, AdditionalKeys="ill", AdditionalValues=execute_ssh_async_35.Stdout)  # -> Output, Pairs
execute_ssh_async_36 = ExecuteSSHAsync(
    SSHCommands=applyglobals_30.Output,
    Run=execute_ssh_async_35.Ran,
    stdouts="""#?RADIANCE
rmtxop -fa -t -c 47.4 119.9 11.6 -
dctimestep /home/mss/simulation/test_project/mtxs/cdsDDS_illum.mtx /home/mss/simulation/weatherData/NOR_OS_Alna.014870_TMYx.2004-2018sunM6.smx
CAPDATE= 2022:06:09 16:59:33
GMT= 2022:06:09 14:59:33
Applied 1x3 matrix transform
Transposed rows and columns
NROWS=8760
NCOLS=108
NCOMP=1
FORMAT=ascii

 0.000000000000000e+00	 0.000000000000000e+00	 0.000000000000000e+00	 0.000000000000000e+00	 0.000000000000000e+00	 0.000000000000000e+00	 0.000000000000000e+00	 0.000000000000000e+00	 0.000000000000000e+00	 0.000000000000000e+00	 0.000000000000000e+00	 0.000000000000000e+00	 0.000000000000000e+00	 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
 
Number of lines
8772 /home/mss/simulation/test_project/results/annualR_CDS.ill""")  # -> Stdout, Stderr, Log, Pid, Ran
panel_130 = Panel(execute_ssh_async_36.Stdout)

# ----
# Getting results (dctimestep)
# Results of daylight coefficients
panel_131 = Panel("""export PATH=$PATH.:/usr/local/radiance/bin
export RAYPATH=.:/usr/local/radiance/lib
mkdir -p <proj>/results/
dctimestep <dcillum> <skymtx> | rmtxop -fa -t -c 47.4 119.9 11.6 - > <proj>/results/<target>;echo <proj>/results/<target>""")
panel_132 = Panel("""dcillum
skymtx
target""")
entwine_14 = Entwine(
    Branch00=execute_ssh_async_29.Stdout,
    Branch01=execute_ssh_async_16.Stdout,
    Branch02="annualR_DC.ill",
    FlattenInputs=True)  # -> flatten(Result)
and_8 = GateAnd(A=execute_ssh_async_29.Ran, B=execute_ssh_async_16.Ran)
applyglobals_31 = ApplyGlobals(Input=panel_131, AdditionalKeys=panel_132, AdditionalValues=entwine_14)  # -> Output, Pairs

execute_ssh_async_37 = ExecuteSSHAsync(SSHCommands=applyglobals_31.Output, Run=and_8, stdouts="/home/mss/simulation/test_project/results/annualR_DC.ill")  # -> Stdout, Stderr, Log, Pid, Ran

panel_133 = Panel("head <ill> -n 13;echo \" \";echo \"Number of lines\";wc -l <ill>")
applyglobals_32 = ApplyGlobals(Input=panel_133, AdditionalKeys="ill", AdditionalValues=execute_ssh_async_37.Stdout)  # -> Output, Pairs
execute_ssh_async_38 = ExecuteSSHAsync(
    SSHCommands=applyglobals_32.Output,
    Run=execute_ssh_async_37.Ran,
    stdouts="""#?RADIANCE
rmtxop -fa -t -c 47.4 119.9 11.6 -
dctimestep /home/mss/simulation/dc_illum.mtx /home/mss/simulation/weatherData/NOR_OS_Alna.014870_TMYx.2004-2018.smx
CAPDATE= 2022:06:09 16:55:47
GMT= 2022:06:09 14:55:47
Applied 1x3 matrix transform
Transposed rows and columns
NROWS=8760
NCOLS=108
NCOMP=1
FORMAT=ascii

 0.000000000000000e+00	 0.000000000000000e+00	 0.000000000000000e+00	 0.000000000000000e+00	 0.000000000000000e+00	 0.000000000000000e+00	 0.000000000000000e+00	 0.000000000000000e+00	 0.000000000000000e+00	 0.000000000000000e+00	 0.000000000000000e+00	 0.000000000000000e+00	 0.000000000000000e+00	 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
 
Number of lines
8772 /home/mss/simulation/test_project/results/annualR_DC.ill""")  # -> Stdout, Stderr, Log, Pid, Ran
panel_134 = Panel(execute_ssh_async_38.Stdout)

panel_135 = Panel(execute_ssh_async_37.Stderr)

# ----
# final step: Combine results
panel_136 = Panel("""export PATH=$PATH.:/usr/local/radiance/bin
export RAYPATH=.:/usr/local/radiance/lib
rmtxop <DCannualR> + -s -1 <DCDannualR> + <CDSannualR> > <proj>/results/<target>;echo <proj>/results/<target>""")
panel_137 = Panel("""DCannualR
DCDannualR
CDSannualR
target""")
falsestart_10 = LBFalseStartToggle(False)
and_9 = GateAnd(A=execute_ssh_async_37.Ran, B=execute_ssh_async_31.Ran, C=execute_ssh_async_35.Ran)
entwine_15 = Entwine(
    Branch00=execute_ssh_async_37.Stdout,
    Branch01=execute_ssh_async_31.Stdout,
    Branch02=execute_ssh_async_35.Stdout,
    Branch03="DDS_Total.ill",
    FlattenInputs=True)  # -> flatten(Result)
or_2 = GateOr(A=and_9, B=falsestart_10)
applyglobals_33 = ApplyGlobals(Input=panel_136, AdditionalKeys=panel_137, AdditionalValues=entwine_15)  # -> Output, Pairs
panel_138 = Panel(applyglobals_33.Output)
execute_ssh_async_39 = ExecuteSSHAsync(SSHCommands=applyglobals_33.Output, Run=or_2, stdouts="/home/mss/simulation/test_project/results/DDS_Total.ill")  # -> Stdout, Stderr, Log, Pid, Ran
int = Integer("1")

overrides_8 = ApplyOverrides(Input="<proj>/results/<dds>", AdditionalKeys="dds", AdditionalValues="DDS_Total.ill")  # -> Output, Pairs
replace = ReplaceItems(List=entwine_15, Item=overrides_8.Output, Indices=-1, Wrap=True)
panel_139 = Panel(execute_ssh_async_39.Stdout)

panel_140 = Panel("C:\Users\mm1013\simulation\radTutorialFiles\room\points.txt")
panel_141 = Panel("C:\Users\mm1013\simulation\radTutorialFiles\room\results\dcDDS\annualR.ill")
file = ReadFile(File=panel_140, PerLineParse=True)
c_script_2 = CSharpScript(x=file)  # -> out, A; inputs x: list of String
# ---------- c_script_2: C# ----------
    List<Point3d> pts = new List<Point3d>(x.Count);

    for (int i = 0; i < x.Count; i++)
    {
      string[] split = x[i].Split(' ');
      pts.Add(new Point3d(double.Parse(split[0]),
        double.Parse(split[1]),
        double.Parse(split[2]))
        );
    }

    A = pts;
# ---------- end c_script_2 ----------
falsestart_11 = LBFalseStartToggle(False)
dup = DuplicateData(Data=int, Number="40", Order=True)
annualresults = AnnualResults(IllFile=panel_141, Schedule=dup, Min="300", Max="300000000", Run=falsestart_11)  # -> Headers, Results, Ran
gradient = Gradient(
    LowerLimit="1",
    UpperLimit="0",
    Parameter=annualresults.Results,
    stops=[0: RGB(234, 38, 0), 0.25: RGB(234, 126, 0), 0.5: RGB(254, 244, 84), 0.75: RGB(173, 203, 249), 1: RGB(75, 107, 169)])
preview_3 = CustomPreview(Geometry=c_script_2.A, Material=gradient)

or_3 = GateOr(A=execute_ssh_async_39.Ran, B=falsestart_6)
list = ItemSelector(
    replace,
    {"/home/mss/simulation/test_project/results/annualR_DC.ill", "/home/mss/simulation/test_project/results/annualR_DCD.ill", "/home/mss/simulation/test_project/results/annualR_CDS.ill", "~/simulation/test_project/results/DDS_Total.ill"}, selected="/home/mss/simulation/test_project/results/annualR_DC.ill")
download = Download(LinuxFilePaths=list, Run=or_3)  # -> Status, FilePaths, Run
panel_142 = Panel(download.FilePaths)
dup_2 = DuplicateData(Data=int, Number="8760", Order=True)
annualresults_2 = AnnualResults(IllFile=download.FilePaths, Schedule=dup_2, Min=300, Max=0, Run=download.Run)  # -> Headers, Results, Ran
bnd = Bounds(Numbers=annualresults_2.Results)
readannualresultsi = Honeybee_ReadAnnualResultI(
    illFilesAddress=panel_142,
    testPoints=simplify(long.ListA),
    ptsVectors=long.ListB,
    DLAIllumThresholds=300,
    runIt=download.Run)  # -> DLA, UDLI_Less_100, UDLI_100_2000, UDLI_More_2000, CDA, sDA, annualProfiles, htmReport; plug-in component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
panel_143 = Panel(bnd)
reload_analysisgrid = GhPythonScript(pts_file="C:\Users\mm1013\simulation\points.pts", ill_file=panel_142, hoys=analysisperiod.hoys, run=or_3)  # -> out, analysisGrid; inputs hoys: list
# ---------- reload_analysisgrid: Python ----------
"""
    Args:
        _pts_file: Path to a points (*.pts) file
        _ill_file: Path to an illuminance (*.ill) file
        _hoys: A list of hours of the year. This should be the same list as the
            one used to run the simulation earlier.
            
            If you ran an Annual Simulation (using the Annual Daylight, Annual
            Radiation, DC-Grid Based, 3P or 5P recipe), you should provide a
            list of integers from 0 to 8759. If you used smaller timesteps in
            your simulation (e.g. using 'hoys_' input in HoneybeePlus_SkyMatrix
            component), make sure you provide a list with appropriate matching
            timesteps.
            
            If you ran a Solar Access simulation, you could use the hoys output
            from LadybugPlus_SunPath component i.e. the same you provided for the
            Solar Access Recipe.
            
            If you ran a simulation using HoneybeePlus Grid Based Recipe, you
            should enter the same hoy as was used to create the sky.
            
            You can get this _hoys list from:
            (1) LadybugPlus_SunPath component
            (2) LadybugPlus_Analysis Period component
            (3) LadybugPlus_Calculate HOY component
            (4) Standard grasshopper components
        _gridMode_: 0 > load the values. (Default)
            1 > load values as binary. Any non-zero value will be 1. Useful for studies such as Solar Access a.k.a. Sunlight Hours.
            2 > load the values divided by mode number. Use this mode for daylight factor or radiation analysis
        _run: Set to True to load the AnalysisGrid
    Returns:
        analysisGrid: Outputs a analysis grid loaded with results. Connect this
             grid to standard honeybee[+] copmonents to get the values
"""

import rhinoscriptsyntax as rs
from honeybee_plus.radiance.analysisgrid import AnalysisGrid

if _run == True:


    if _gridMode_ == None:
        gmode = 0
    else:
        gmode = int(_gridMode_)

# first let's create an analysis grid from pts file
    analysisGrid = AnalysisGrid.from_file(_pts_file)

# now let's load the results
    analysisGrid.set_values_from_file(_ill_file, hoys=_hoys, mode=gmode)
# ---------- end reload_analysisgrid ----------
readannualresultsiii = ReadAnnualResultsIII(resultFilesAddress=panel_142, minThreshold=300, maxThreshold=0)  # -> out, lessThanRange, inTheRange, moreThanRange, CDA; inputs resultFilesAddress: list of String, minThreshold: Double, maxThreshold: Double
# ---------- readannualresultsiii: C# usings ----------
using System.IO;
using System.Linq;
using System.Data;
using System.Drawing;
using System.Reflection;
using System.Windows.Forms;
using System.Xml;
using System.Xml.Linq;
using System.Runtime.InteropServices;

using Rhino.DocObjects;
using Rhino.Collections;
using GH_IO;
using GH_IO.Serialization;
# ---------- readannualresultsiii: C# ----------
    List < string > lines = new List<string>{};
    int ptsNumbers = 0;
    double min = minThreshold;
    double max = maxThreshold;

    var underT = new List<int>{};
    var withinT = new List<int>{};
    var aboveT = new List<int>{};

    var underTPercent = new List<double>{};
    var withinTPercent = new List<double>{};
    var aboveTPercent = new List<double>{};
    var cda = new List<double>{};

    double oneHrToPercent = 1 / 36.50;


    double infinity = 1.0 / 0.0;
    if(max == 0)max = infinity;



    for(int f = 0; f < resultFilesAddress.Count; f++){
      lines = File.ReadAllLines(resultFilesAddress[f], System.Text.Encoding.GetEncoding(1252)).ToList();

      int catecount = lines[0].Split(' ').Length - 4;


      for(int i = 0; i < catecount; i++){
        //underT.Add(0);
        //withinT.Add(0);
        //aboveT.Add(0);
        underTPercent.Add(0);
        withinTPercent.Add(0);
        aboveTPercent.Add(0);
        cda.Add(0);
      }

      for(int i = 0; i < 8760; i++){
        string [] items = lines[i].Split(' ');
        //A = items;
        var hr = Convert.ToDouble(items[2]);

        if(hr >= 8 && hr < 18){

          for(int l = 0; l < catecount; l++){
            int item = Convert.ToInt32(items[l + 4]);
            int ptsIndex = l + ptsNumbers;

            if(item < min){
              //underT[ptsIndex] += 1;
              underTPercent[ptsIndex] += oneHrToPercent;
              double factor = item / min;
              cda[ptsIndex] += oneHrToPercent * factor;
            }else if(item > max){
              //aboveT[ptsIndex] += 1;
              aboveTPercent[ptsIndex] += oneHrToPercent;
            }else{
              //withinT[ptsIndex] += 1;
              withinTPercent[ptsIndex] += oneHrToPercent;
              cda[ptsIndex] += oneHrToPercent;
            }
          }

        }
      }

      ptsNumbers += catecount;


    }



    lessThanRange = underTPercent;
    inTheRange = withinTPercent;
    moreThanRange = aboveTPercent;
    CDA = cda;
# ---------- end readannualresultsiii ----------
readannualresultsiii_2 = ReadAnnualResultsIII(resultFilesAddress=panel_142, workingHours=[8, 9, 10, 11, 12, 13, 14, 15, 16, 17], minThreshold=300, maxThreshold=0)  # -> out, lessThanRange, inTheRange, moreThanRange, CDA; inputs resultFilesAddress: list of String, workingHours: list of Int32, minThreshold: Double, maxThreshold: Double
# ---------- readannualresultsiii_2: C# ----------
    Component.Message = "VER 0.0.61\nJUL_06_2017";
    List < string > lines = new List<string>{};
    //int ptsNumbers = 0;
    min = minThreshold;
    max = maxThreshold;
    hours = workingHours;
    oneHrToPercent = 1 / (3.65*hours.Count);

    var AllProcessedData = new List<List<List<double>>>();

    var underTPercent = new List<double>{};
    var withinTPercent = new List<double>{};
    var aboveTPercent = new List<double>{};
    var cda = new List<double>{};


    double infinity = 1.0 / 0.0;
    if(max == 0)max = infinity;

    var illResults = resultFilesAddress.AsParallel().AsOrdered().Select(file => readIllFile(file));
    foreach (var illResult in illResults)
    {
      underTPercent.AddRange(illResult[0]);
      withinTPercent.AddRange(illResult[1]);
      aboveTPercent.AddRange(illResult[2]);
      cda.AddRange(illResult[3]);
    }

    lessThanRange = underTPercent;
    inTheRange = withinTPercent;
    moreThanRange = aboveTPercent;
    CDA = cda;
# ---------- readannualresultsiii_2: C# additional code ----------
  static double min = 300;
  static double max = 0;
  static double oneHrToPercent= 1 / 36.50;
  static List<int> hours;

  static List < List < double >> readIllFile (object file)
  {

    var underTPercent = new List<double>(){};
    var withinTPercent = new List<double>(){};
    var aboveTPercent = new List<double>(){};
    var cda = new List<double>{};
    var lines = File.ReadAllLines((String) file, System.Text.Encoding.GetEncoding(1252)).ToList();

    int ptsCount = lines[0].Split(' ').Length - 4;

    for(int i = 0; i < ptsCount; i++){

      underTPercent.Add(0);
      withinTPercent.Add(0);
      aboveTPercent.Add(0);
      cda.Add(0);
    }

    for(int i = 0; i < 8760; i++){
      string [] items = lines[i].Split(' ');
      //A = items;
      var hr = (int) Convert.ToDouble(items[2]);
      
      //var hrs = new List<int>(){8,9,10};
      int pos = hours.IndexOf(hr);

      if(pos >= 0){

        for(int l = 0; l < ptsCount; l++){
          int item = Convert.ToInt32(items[l + 4]);
          int ptsIndex = l;

          //underTPercent
          if(item < min){
            underTPercent[ptsIndex] += oneHrToPercent;
            cda[ptsIndex] += oneHrToPercent * item / min;
          }
            //aboveTPercent
          else if(item > max)
          {
            aboveTPercent[ptsIndex] += oneHrToPercent;
          }
            //withinTPercent
          else
          {
            withinTPercent[ptsIndex] += oneHrToPercent;
            cda[ptsIndex] += oneHrToPercent;
          }
        }

      }else{
        //underTPercent[hr] = pos;
      }
    }

    //processedData for one ill file
    List < List < double >> processedData = new List<List<double>>(){};

    processedData.Add(underTPercent);
    processedData.Add(withinTPercent);
    processedData.Add(aboveTPercent);
    processedData.Add(cda);

    return processedData;


  }
# ---------- end readannualresultsiii_2 ----------
reload_analysisgrid_2 = GhPythonScript(pts_file="C:\Users\mm1013\simulation\points.pts", ill_file=panel_142, run=Toggle(True))  # -> out, analysisGrid; inputs hoys: list
# ---------- reload_analysisgrid_2: Python ----------
"""
    Args:
        _pts_file: Path to a points (*.pts) file
        _ill_file: Path to an illuminance (*.ill) file
        _hoys: A list of hours of the year. This should be the same list as the
            one used to run the simulation earlier.
            
            If you ran an Annual Simulation (using the Annual Daylight, Annual
            Radiation, DC-Grid Based, 3P or 5P recipe), you should provide a
            list of integers from 0 to 8759. If you used smaller timesteps in
            your simulation (e.g. using 'hoys_' input in HoneybeePlus_SkyMatrix
            component), make sure you provide a list with appropriate matching
            timesteps.
            
            If you ran a Solar Access simulation, you could use the hoys output
            from LadybugPlus_SunPath component i.e. the same you provided for the
            Solar Access Recipe.
            
            If you ran a simulation using HoneybeePlus Grid Based Recipe, you
            should enter the same hoy as was used to create the sky.
            
            You can get this _hoys list from:
            (1) LadybugPlus_SunPath component
            (2) LadybugPlus_Analysis Period component
            (3) LadybugPlus_Calculate HOY component
            (4) Standard grasshopper components
        _gridMode_: 0 > load the values. (Default)
            1 > load values as binary. Any non-zero value will be 1. Useful for studies such as Solar Access a.k.a. Sunlight Hours.
            2 > load the values divided by mode number. Use this mode for daylight factor or radiation analysis
        _run: Set to True to load the AnalysisGrid
    Returns:
        analysisGrid: Outputs a analysis grid loaded with results. Connect this
             grid to standard honeybee[+] copmonents to get the values
"""

import rhinoscriptsyntax as rs
from honeybee_radiance.sensorgrid import SensorGrid
#from honeybee.radiance.analysisgrid import AnalysisGrid

if _run == True:


    if _gridMode_ == None:
        gmode = 0
    else:
        gmode = int(_gridMode_)

# first let's create an analysis grid from pts file
    analysisGrid = SensorGrid.from_file(_pts_file)
    

# now let's load the results
    #analysisGrid.set_values_from_file(_ill_file, hoys=_hoys, mode=gmode)
# ---------- end reload_analysisgrid_2 ----------
readannualresultsii = Honeybee_ReadAnnualResultII(resultFilesAddress=panel_142, testPts=long.ListA, timeStep=1, runIt=download.Run)  # -> readMe, lessThanRange, inTheRange, moreThanRange; plug-in component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
python_4 = GhPythonScript(x=reload_analysisgrid_2.analysisGrid)  # -> out, a
# ---------- python_4: Python ----------
__author__ = "mm1013"
__version__ = "2022.05.02"

import rhinoscriptsyntax as rs

a = x.sensors
# ---------- end python_4 ----------
gradient_2 = Gradient(
    LowerLimit="1",
    UpperLimit="0",
    Parameter=annualresults_2.Results,
    stops=[0: RGB(234, 38, 0), 0.25: RGB(234, 126, 0), 0.5: RGB(254, 244, 84), 0.75: RGB(173, 203, 249), 1: RGB(75, 107, 169)])
bnd_2 = Bounds(Numbers=readannualresultsii.inTheRange)
preview_4 = CustomPreview(Geometry=pt_3, Material=gradient_2)

# ==== cluster Cluster
L = ClusterInput()
item = ListItem(List=flatten(L), Index=0, Wrap=True)
rec = DataRecorder(item, DataLimit=-10, RecordData=True)
lng = ListLength(List=rec)
L_2 = ClusterOutput(lng)

# ==== cluster Normals
amplitude = ClusterInput()
amplitude_2 = Data(amplitude)
geo = ClusterInput()
merge = Merge(Data1=flatten(amplitude_2), Data2=flatten("1m"))
geo_2 = Geometry(geo)
item = ListItem(List=merge, Index=0, Wrap=True)
facen = FaceNormals(Mesh=geo_2)  # -> Centers, Normals
U = Units(ValueString=item)
avr = Average(Input=facen.Centers)
avr_2 = Average(Input=facen.Normals)
unflatten = UnflattenTree(Tree=avr, Guide=geo_2)
unflatten_2 = UnflattenTree(Tree=avr_2, Guide=geo_2)
amp = Amplitude(Vector=unflatten_2, Amplitude=U)
pl = PlaneNormal(Origin=unflatten, ZAxis=unflatten_2)
norm = Vector(amp)
center = Point(unflatten)
P = ClusterOutput(pl)
norm_2 = ClusterOutput(norm)
center_2 = ClusterOutput(center)

# ==== cluster MeshIt2: Meshes everything in the input. Graft the input if you want to make several meshes, otherwise returns a joined mesh.
mesh_brep = ClusterInput()
mesh_brep_2 = Geometry(simplify(mesh_brep))
tmatch = MatchText(Text=mesh_brep_2, RegEx="(mesh)", Case=False)
tmatch_2 = MatchText(Text=mesh_brep_2, RegEx="(brep)|(polysurface)|(surface)|(extrusion)", Case=False)
group = Group(Objects=mesh_brep_2)
cull = CullPattern(List=mesh_brep_2, CullPattern=tmatch_2)
mesh = MeshBrep(
    Brep=cull,
    Settings={GridMaxCount=0, GridMinCount=16, JaggedSeams=False, MaxEdgeLength=0, MinEdgeLength=0.0001, MinTolerance=0, Refine=True, RefineAngle=0, RelativeTolerance=0.65, SimplePlanes=True, Tolerance=0})  # -> simplify(Mesh)
cull_2 = CullPattern(List=mesh_brep_2, CullPattern=tmatch)  # -> simplify(List)

# ----
# Fix invalid mesh
panel = Panel("Invalid Mesh")  # disabled
mesh_2 = Mesh(mesh)  # disabled
tmatch_3 = MatchText(Text=mesh_2, RegEx=panel, Case=False)  # disabled
unweave = Unweave(List=mesh_2, UnweavePattern=tmatch_3)  # -> Data0, Data1; disabled
explode = MeshExplode(Mesh=unweave.Data1, Interpolate=False)  # -> simplify(Faces); disabled
abc_a = ABC(data=explode)  # disabled
panel_2 = Panel("0")  # disabled
num = Number(panel_2)  # disabled
area = MeshArea(Mesh=abc_a)  # -> Area, Centroid; disabled
equals = Equality(FirstNumber=area.Area, SecondNumber=num)  # -> Equality, Inequality; disabled
cull_3 = CullPattern(List=abc_a, CullPattern=equals.Inequality)  # disabled
mjoin = MeshJoin(Meshes=[cull_3, unweave.Data0])  # disabled

# ----
# Fix invalid mesh
panel_3 = Panel("Invalid Mesh")  # disabled
mesh_3 = Mesh(cull_2)  # disabled
tmatch_4 = MatchText(Text=mesh_3, RegEx=panel_3, Case=False)  # disabled
unweave_2 = Unweave(List=mesh_3, UnweavePattern=tmatch_4)  # -> Data0, Data1; disabled
explode_2 = MeshExplode(Mesh=unweave_2.Data1, Interpolate=False)  # -> simplify(Faces); disabled
abc_a_2 = ABC(data=explode_2)  # disabled
panel_4 = Panel("0")  # disabled
num_2 = Number(panel_4)  # disabled
area_2 = MeshArea(Mesh=abc_a_2)  # -> Area, Centroid; disabled
equals_2 = Equality(FirstNumber=area_2.Area, SecondNumber=num_2)  # -> Equality, Inequality; disabled
cull_4 = CullPattern(List=abc_a_2, CullPattern=equals_2.Inequality)  # disabled
mjoin_2 = MeshJoin(Meshes=[cull_4, unweave_2.Data0])  # disabled

mjoin_3 = MeshJoin(Meshes=[mesh, cull_2])
c_script = CSharpScript(mesh=mjoin_3)  # -> A; inputs mesh: Mesh
# ---------- c_script: C# ----------
    mesh.Faces.CullDegenerateFaces();
    A = mesh;
# ---------- end c_script ----------
abc_a_3 = ABC(data=mjoin)  # disabled
abc_a_4 = ABC(data=mjoin_2)  # disabled
clean = CleanTree(RemoveNulls=True, RemoveInvalid=True, RemoveEmpty=False, Tree=[abc_a_3, abc_a_4])  # disabled
mjoin_4 = MeshJoin(Meshes=clean)  # disabled
unflatten = UnflattenTree(Tree=c_script, Guide=group)
mesh_explode = MeshExplode(m=mjoin_4)  # -> out, simplify(A); disabled
# ---------- mesh_explode: VB ----------
    Component.Params.Input(0).Name = "Mesh"
    Component.Params.Input(0).Description = "Open or closed mesh"

    Component.Params.Output(1).Name = "Mesh"
    Component.Params.Output(1).Description = "If successful, a valid mesh"

    If m IsNot Nothing Then
      Dim pts As Rhino.Geometry.Collections.MeshVertexList
      Dim faces As Rhino.Geometry.Collections.MeshFaceList
      Dim clrs As Rhino.Geometry.Collections.MeshVertexColorList
      Dim i As Integer
      Dim mshs As New list(Of mesh)

      faces = m.Faces
      pts = m.Vertices
      If m.VertexColors.count() = 0 Then m.VertexColors.CreateMonotoneMesh(color.FromArgb(100, 100, 100))
      clrs = m.VertexColors

      For i = 0 To faces.count() - 1 Step 1
        Dim fc As New meshFace
        Dim face As New MeshFace
        Dim ptList As New list(Of point3d)
        Dim clrList As New list(Of color)
        Dim msh As New mesh

        face = faces(i)

        ptList.add(New point3d(pts(face.A)))
        ptList.add(New point3d(pts(face.B)))
        ptList.add(New point3d(pts(face.C)))
        If face.IsQuad Then ptList.add(New point3d(pts(face.D)))

        clrList.add(clrs(face.A))
        clrList.add(clrs(face.B))
        clrList.add(clrs(face.C))
        If face.IsQuad Then clrList.add(clrs(face.D))

        If face.IsQuad Then fc = New meshFace(0, 1, 2, 3) Else fc = New meshface(0, 1, 2)

        msh.Vertices.AddVertices(ptList.toarray())
        msh.Faces.AddFace(fc)
        msh.VertexColors.SetColors(clrList.toarray())
        mshs.add(msh)
      Next

      A = mshs
    End If
# ---------- end mesh_explode ----------
c_script_2 = CSharpScript(mesh=mjoin_4)  # -> A; inputs mesh: Mesh; disabled; same code as c_script
c_script_3 = CSharpScript(mesh=mesh_explode.A)  # -> out, A; inputs mesh: list of Mesh; disabled
# ---------- c_script_3: C# ----------
    List<bool> isValid = new List<bool>();
    for (int i = 0; i < mesh.Count; i++)
    {
      isValid.Add(mesh[i].IsValid);
    }
    
    A = isValid;
# ---------- end c_script_3 ----------
mesh_joined = Mesh(unflatten)
cullf = CullFaces(Mesh=mjoin_4, Pattern=invert(c_script_3.A))  # disabled
mesh_joined_2 = ClusterOutput(mesh_joined)

# ==== cluster ABC
data = ClusterInput()
data_2 = Data(data)
path_mapper = PathMapper(
    data_2,
    source=["{A;B;C;D;E;F;G}", "{A;B;C;D;E;F}", "{A;B;C;D;E}", "{A;B;C;D}", "{A;B;C}", "{A;B}", "{A}"],
    target=["{A}", "{A}", "{A}", "{A}", "{A}", "{A}", "{A}"])
data_3 = Data(path_mapper)
data_4 = ClusterOutput(data_3)
