# Grasshopper definition TestRenders.gh (Grasshopper 1.0.7)
# Copyright: 2021
# Copyright: 2022-22-28
# plug-ins: MantaRay, LadybugGrasshopper, Human, HDTTreeUtils, Bombyx 2

panel = Panel("export PATH=$PATH:/usr/local/radiance/bin:/usr/local/accelerad/bin;export RAYPATH=.:/usr/local/accelerad/lib:/usr/local/radiance/lib;export DISPLAY=$(ip route list default | awk '{print $3}'):0;export LIBGL_ALWAYS_INDIRECT=1;export LD_LIBRARY_PATH=/usr/local/accelerad/bin:$LD_LIBRARY_PATH")

# ----
# Setup globals
panel_2 = Panel("""<LinuxHome>
simulation""")
panel_3 = Panel("""proj
projname""")
global_overrides = GlobalOverrides(Keys=panel_3, Values=panel_2)
panel_4 = Panel(global_overrides)

# ----
# Remote Connect
panel_5 = Panel("10.71.5.181")
connect = ConnectSSHFTP(
    User="mm1013",
    Ip=panel_5,
    WindowsDir="C:\simulation",
    Password="_prompt",
    _port=22,
    Connect=Toggle(False),
    Prefixes=". /etc/profile")  # -> Status, Prefixes, Run; disabled
panel_6 = Panel(connect.Status)

# ----
# Local Connect
python = GhPythonScript()  # -> username
# ---------- python: Python ----------
__author__ = "mm1013"
__version__ = "2022.09.25"

import rhinoscriptsyntax as rs

import System

username = System.Environment.UserName

if username == "mm1013":
    username = "mss"
# ---------- end python ----------
panel_7 = Panel("127.0.0.1")
panel_8 = Panel(python)
connect_2 = ConnectSSHFTP(User=panel_8, Ip="127.0.0.1", Password="_prompt", _port=22, Connect=Toggle(True), Prefixes=panel)  # -> Status, Prefixes, Run
panel_9 = Panel(connect_2.Status)

panel_10 = Panel("""Mesh
Polysurface
Surface
Extrusion""")

od_outdated = ColourSwatch(SwatchColor=RGBA(97, 97, 97, 150))
u_updated = ColourSwatch(SwatchColor=RGBA(208, 115, 230, 112))
toggle = BooleanToggle(False)
g_general = ColourSwatch(SwatchColor=RGBA(245, 243, 237, 156))
o_outputs = ColourSwatch(SwatchColor=RGBA(160, 218, 242, 203))
s_settings = ColourSwatch(SwatchColor=RGBA(224, 145, 81, 154))
cc_core2 = ColourSwatch(SwatchColor=RGBA(230, 216, 186, 208))
y_yellow = ColourSwatch(SwatchColor=RGBA(247, 244, 64, 188))
i_inputs = ColourSwatch(SwatchColor=RGBA(125, 217, 98, 150))
c_core = ColourSwatch(SwatchColor=RGBA(235, 227, 206, 203))
r_red = ColourSwatch(SwatchColor=RGBA(242, 63, 63, 203))

# ----
# Test connection
testconnection = TestConnection()  # -> Status, Errors
panel_11 = Panel(testconnection.Status)
panel_12 = Panel(testconnection.Errors)

# ----
# Overview of all running tasks in linux
panel_13 = Panel("ps -aux | grep '<AllRadProgs>'")
logviewer = LogViewer(Number=10)  # -> CurrentTasks, Logs
default = DefaultMSS(data=flatten(panel_13), default_value_flattened=flatten(logviewer.CurrentTasks))
executessh_wip = ExecuteSSHWIP(
    _SSHCommands_=default,
    Run=Toggle(True),
    addPrefix=True,
    description="ps -aux | grep '<AllRadProgs>'",
    fireLogs=False,
    lastRunTime=0,
    suppressWarnings=False,
    commands="ps -aux | grep '<AllRadProgs>'")  # -> Stdout, Stderr_, Ran
python_2 = GhPythonScript(x=executessh_wip.Stdout)  # -> a
# ---------- python_2: Python ----------
__author__ = "mm1013"
__version__ = "2022.08.30"

import rhinoscriptsyntax as rs

a = [l for l in x.split("\n") if "grep" not in l]
# ---------- end python_2 ----------
panel_14 = Panel(python_2)
panel_15 = Panel(logviewer.CurrentTasks)

colorgroups = CSharpScript(
    Colors=[i_inputs, s_settings, g_general, c_core, o_outputs, r_red, y_yellow, u_updated, od_outdated, cc_core2],
    Enable=toggle,
    Rename=Toggle(False),
    RunOnce=Button(),
    Debug=Toggle(False))  # -> out; inputs Colors: list of Color, Enable: Boolean, Rename: Boolean, RunOnce: Boolean, Debug: Boolean
# ---------- colorgroups: C# usings ----------
using System.Linq;
using System.Text;
using System.Reflection;
# ---------- colorgroups: C# ----------
    msg.Clear();


    this.Component.Message = "id: " + id.ToString();

    _debug = Debug; //Set to true to have all events printed in rhino log
    _rename = Rename;

    if (Enable)
    {
      msg.AppendFormat("Set up events on ID {0}\n", id);
      SetupDict(); // Create a dictionary of the input swatches
      SetEventHandlers(); // This would do the job.


    }
    else
    {
      RemoveEventHandlers();
    }
    if (RunOnce)
    {
      foreach(Grasshopper.Kernel.Special.GH_Group grp in Grasshopper.Instances.ActiveCanvas.Document.Objects.OfType<Grasshopper.Kernel.Special.GH_Group>())
      {
        ColorGroup(grp, null); // You decide if it should run once on all existing groups

      }
    }

    Print(msg.ToString());


    // Component setup
    Component.Description = "Set up event handlers to color groups based on prefixes such as 'in_' and 'out_'.\n"
      + "Please insert only swatcheds directly into the Colors input\n\n"
      + "MIT License. Copyright Mathias Sønderskov Schaltz 2022";
    Component.Params.Input[0].Description = "Please insert only swatcheds directly into the Colors input.\nRemember to rename them";
    Component.Params.Input[1].Description = "Toggle to run...";
    Component.Params.Input[2].Description = "Set to true if you want to automatically rename the groups and remove prefix. Default is false.";
    Component.Params.Input[3].Description = "Set to true to run it once and color all existing groups.";
    Component.Params.Input[Component.Params.Input.Count - 1].Description = "Set debug to true to get all the events printed in the rhino log";
# ---------- colorgroups: C# additional code ----------
  public static Random rnd = new Random();
  public int id = rnd.Next(0, 1000);
  StringBuilder msg = new StringBuilder();
  Dictionary<string, System.Drawing.Color> colorDict = new Dictionary<string, System.Drawing.Color>();

  bool _debug = false;
  bool _rename = false;

  public bool IdExists(int id)
  {
    IList<IGH_DocumentObject> objs = Grasshopper.Instances.ActiveCanvas.Document.Objects;
    return objs
      .OfType<IGH_Component>()
      .Where(ob => ob.NickName == this.Component.NickName)
      .Where(ob => ob.GetType().ToString() == "ScriptComponents.Component_CSNET_Script")
      .Where(ob => ob.Message == "id: " + id.ToString()).Any();

  }


  public void SetupDict()
  {
    colorDict.Clear();
    // Get all inputs to "Colors"
    IList<IGH_Param> colorSources = this.Component.Params.Input[0].Sources;
    if (colorSources.Count == 0)
    {
      throw new Exception("You forgot to setup the colors. Please input swatch components and rename them");
    }
    foreach(IGH_Param source in colorSources)
    {
      //if (source.Type.ToString() == "Grasshopper.Kernel.Types.GH_Colour")
      if (source is Grasshopper.Kernel.Special.GH_ColourSwatch)
      {
        string nickName = source.NickName.Split('_')[0].Trim() + "_";
        if(!colorDict.ContainsKey(nickName))
        {
          Grasshopper.Kernel.Special.GH_ColourSwatch swatch = (Grasshopper.Kernel.Special.GH_ColourSwatch) source;
          colorDict.Add(nickName, swatch.SwatchColour);
        }
        else
        {
          throw new Exception("Multiple swatches using the same name detected. Please rename");
        }
      }
      else
      {
        throw new Exception("Whacko! Why did you input a non-swatch into the Colors? " + source.Type.ToString());
      }

    }

    msg.AppendFormat("Set up the dictionaries with {0} colors\n", colorDict.Count);
    foreach(var pairs in colorDict)
    {
      msg.AppendFormat("{0} -> {1}\n", ("\"" + pairs.Key + "\"").PadRight(5 + colorDict.Keys.Select(k => k.Length).Max()), pairs.Value);
    }
  }

  public void SetEventHandlers()
  {

    // Always remove events first to avoid duplicates
    GrasshopperDocument.ObjectsAdded -= OnObjectsAdded;
    GrasshopperDocument.ObjectsDeleted -= OnObjectsRemoved;
    GrasshopperDocument.ObjectsDeleted -= OnDeleteThisComponent;

    // Attach events
    GrasshopperDocument.ObjectsAdded += OnObjectsAdded;
    GrasshopperDocument.ObjectsDeleted += OnObjectsRemoved;
    GrasshopperDocument.ObjectsDeleted += OnDeleteThisComponent;


    foreach(Grasshopper.Kernel.Special.GH_Group grp in GrasshopperDocument.Objects.OfType<Grasshopper.Kernel.Special.GH_Group>())
    {
      grp.ObjectChanged -= ColorGroup;
      grp.ObjectChanged += ColorGroup;

      //ColorGroup(grp, null); // Make sure to run it once
    }
    msg.AppendFormat("Added the eventhandlers on {0} existing groups and on future created groups\n", GrasshopperDocument.Objects.OfType<Grasshopper.Kernel.Special.GH_Group>().Count());
  }

  public void OnObjectsAdded(object sender, GH_DocObjectEventArgs e)
  {
    bool any = false;
    foreach (Grasshopper.Kernel.Special.GH_Group grp in e.Objects.OfType<Grasshopper.Kernel.Special.GH_Group>())
    {
      grp.ObjectChanged -= ColorGroup;
      grp.ObjectChanged += ColorGroup;
      any = true;
    }

    DebugWrite(any ? "Group Objects Added: Attaching Events to ObjectChanged" : "Objects Added - but no groups");
  }

  //Same but reversed
  public void OnObjectsRemoved(object sender, GH_DocObjectEventArgs e)
  {
    bool any = false;
    foreach (Grasshopper.Kernel.Special.GH_Group grp in e.Objects.OfType<Grasshopper.Kernel.Special.GH_Group>())
    {
      grp.ObjectChanged -= ColorGroup;
      any = true;
    }

    DebugWrite(any ? "Group Objects Removed, removing event" : "Objects Removed - although not a group");

  }



  public void RemoveEventHandlers()
  {
    GrasshopperDocument.ObjectsAdded -= OnObjectsAdded;
    GrasshopperDocument.ObjectsDeleted -= OnObjectsRemoved;


    foreach(Grasshopper.Kernel.Special.GH_Group grp in GrasshopperDocument.Objects.OfType<Grasshopper.Kernel.Special.GH_Group>())
    {
      grp.ObjectChanged -= ColorGroup;

    }
    msg.AppendFormat("Removed event handlers on document and on {0} groups\n", GrasshopperDocument.Objects.OfType<Grasshopper.Kernel.Special.GH_Group>().Count());

  }

  public void ColorGroup(object sender, EventArgs e)
  {
    if (!IdExists(id))
    {
      DebugWrite("Component not relevant. Disabling old id + " + id.ToString());
      RemoveEventHandlers();
      return;
    }

    Grasshopper.Kernel.Special.GH_Group grp = sender as Grasshopper.Kernel.Special.GH_Group;
    if (grp == null) return; //not type GH_Group
    //if (!grp.NickName.EndsWith("_")) return;

    string[] nameParts = grp.NickName.Split('_');
    if (nameParts.Length <= 1)
      return;
    string prefix = grp.NickName.Split('_')[0].Trim() + '_';

    string prefixes = String.Join(", ", colorDict.Keys.Select(k => "\"" + k + "\""));

    msg.Append("prefix " + prefix + "\n");
    if (colorDict.ContainsKey(prefix))
    {
      //if (grp.NickName.EndsWith("_"))
      grp.Colour = colorDict[prefix];
      if (_rename)
      {
        grp.NickName = grp.NickName.Replace(prefix, "");
      }

      DebugWrite("Colored " + grp.NickName);

    }
    else
    {
      DebugWrite("Group changed but not relevant: prefix " + prefix + " is not among " + prefixes);
    }

  }
  public void DebugWrite(string msg)
  {
    if (_debug)
    {
      Rhino.RhinoApp.WriteLine(String.Format("[ColGrps {0}]: {1}", id, msg));
    }
  }

  public void OnDeleteThisComponent(object sender, GH_DocObjectEventArgs e)
  {

    if (e.Objects.OfType<Grasshopper.Kernel.GH_Component>().Where(o => o.NickName == this.Component.NickName).Any())
    {
      DebugWrite("Removed template component. Removing all the eventhandlers");
      RemoveEventHandlers();
    }

  }
# ---------- end colorgroups ----------

fixparams = CSharpScript(FixOnce=Button(), Enable=toggle, Debug=Toggle(False))  # -> out; inputs FixOnce: Boolean, Enable: Boolean, Debug: Boolean
# ---------- fixparams: C# usings ----------
using System.Text;
using System.Linq;
using Grasshopper.Kernel.Special;
# ---------- fixparams: C# ----------
    _debug = Debug;
    _enable = Enable;
    msg.Clear();
    this.Component.Message = "id: " + id.ToString();




    if (Enable)
    {
      SetEventHandlers();
    }
    else
    {
      RemoveEventHandlers();
    }


    if (FixOnce)
    {
      FixAll();
    }

    Print(msg.ToString());

    // Component setup
    Component.Description = "Set up event handlers to change params to show nickname and not icon"
      + "\n\n"
      + "MIT License. Copyright Mathias Sønderskov Schaltz 2022";
    Component.Params.Input[0].Description = "Run me once on the document";
    Component.Params.Input[1].Description = "Toggle to enable event listener";
    Component.Params.Input[Component.Params.Input.Count - 1].Description = "Set debug to true to get all the events printed in the rhino log";
# ---------- fixparams: C# additional code ----------
  public static Random rnd = new Random();
  public int id = rnd.Next(0, 1000);
  StringBuilder msg = new StringBuilder();
  bool _debug = false;
  bool _enable = false;

  public Dictionary<IGH_ActiveObject, HashSet<GH_Group>> groupsPerObject = new Dictionary<IGH_ActiveObject, HashSet<GH_Group>>();


  public void OnObjectsAdded(object sender, GH_DocObjectEventArgs e)
  {
    if (!IdExists(id))
    {
      DebugWrite("[FixParam] Component not relevant. Disabling old id " + id.ToString());
      RemoveEventHandlers();
      return;
    }


    if(_enable)
    {
      foreach(IGH_Param par in e.Objects.OfType<IGH_Param>())
      {
        FixInputs(par);
      }
    }


  }

  public void FixAll()
  {
    //DebugWrite("Fixing all?");
    foreach(IGH_Param par in GrasshopperDocument.Objects.OfType<IGH_Param>())
    {

      FixInputs(par);
    }
  }




  public void FixInputs(IGH_ActiveObject obj)
  {



    IGH_Param par = obj as IGH_Param;
    if (par != null)
    {

      par.IconDisplayMode = GH_IconDisplayMode.name;


    }

  }


  public void SetEventHandlers()
  {

    GrasshopperDocument.ObjectsAdded -= OnObjectsAdded;
    GrasshopperDocument.ObjectsAdded += OnObjectsAdded;
    GrasshopperDocument.ObjectsDeleted -= OnDeleteThisComponent;
    GrasshopperDocument.ObjectsDeleted += OnDeleteThisComponent;
    msg.AppendFormat("Added the eventhandlers to OnObjectsAdded\n", GrasshopperDocument.Objects.OfType<Grasshopper.Kernel.Special.GH_Group>().Count());
  }

  public void RemoveEventHandlers()
  {
    GrasshopperDocument.ObjectsAdded -= OnObjectsAdded;
    GrasshopperDocument.ObjectsDeleted -= OnDeleteThisComponent;

    msg.AppendFormat("Removed wire event handlers on document\n", GrasshopperDocument.Objects.OfType<Grasshopper.Kernel.Special.GH_Group>().Count());

  }

  public void OnDeleteThisComponent(object sender, GH_DocObjectEventArgs e)
  {

    if (e.Objects.OfType<Grasshopper.Kernel.GH_Component>().Where(o => o.NickName == this.Component.NickName).Any())
    {
      DebugWrite("Removed template component. Removing all the eventhandlers");
      RemoveEventHandlers();
    }

  }

  public bool IdExists(int id)
  {
    IList<IGH_DocumentObject> objs = Grasshopper.Instances.ActiveCanvas.Document.Objects;
    return objs
      .OfType<IGH_Component>()
      .Where(ob => ob.NickName == this.Component.NickName)
      .Where(ob => ob.GetType().ToString() == "ScriptComponents.Component_CSNET_Script")
      .Where(ob => ob.Message == "id: " + id.ToString()).Any();

  }

  public void DebugWrite(string msg)
  {
    if (_debug)
    {
      Rhino.RhinoApp.WriteLine(String.Format("[FixParams {0}]: {1}", id, msg));
    }
  }
# ---------- end fixparams ----------

fixwires = CSharpScript(FixOnce=Button(), Enable=toggle, Debug=Toggle(False))  # -> out; inputs FixOnce: Boolean, Enable: Boolean, Debug: Boolean
# ---------- fixwires: C# ----------
    _debug = Debug;
    _enable = Enable;
    msg.Clear();
    this.Component.Message = "id: " + id.ToString();


    SetDictionary();

    if (Enable)
    {
      SetEventHandlers();
    }
    else
    {
      RemoveEventHandlers();
    }


    if (FixOnce)
    {
      FixAll();
    }

    Print(msg.ToString());
    
    // Component setup
    Component.Description = "Set up event handlers to change all wire types across groups to faint"
      + "\n\n"
      + "MIT License. Copyright Mathias Sønderskov Schaltz 2022";
    Component.Params.Input[0].Description = "Run me once on the document";
    Component.Params.Input[1].Description = "Toggle to enable event listener";
    Component.Params.Input[Component.Params.Input.Count - 1].Description = "Set debug to true to get all the events printed in the rhino log";
# ---------- fixwires: C# additional code ----------
  public static Random rnd = new Random();
  public int id = rnd.Next(0, 1000);
  StringBuilder msg = new StringBuilder();
  bool _debug = false;
  bool _enable = false;

  public Dictionary<IGH_ActiveObject, HashSet<GH_Group>> groupsPerObject = new Dictionary<IGH_ActiveObject, HashSet<GH_Group>>();


  public void OnSolutionExpired(object sender, GH_DocUndoEventArgs e)
  {
    if(_enable)
      FixAll();
  }

  public void FixAll()
  {
    //DebugWrite("Fixing all?");
    foreach(IGH_ActiveObject key in groupsPerObject.Keys.Where(k => groupsPerObject[k].Count() > 0))
    {

      FixInputs(key);
    }
  }



  public bool HasGroup(IGH_ActiveObject obj)
  {
    return groupsPerObject[obj].Count > 0;
  }


  public void FixInputs(IGH_ActiveObject obj)
  {

    if (!IdExists(id))
    {
      DebugWrite("Component not relevant. Disabling old id " + id.ToString());
      RemoveEventHandlers();
      return;
    }

    //List<List<IGH_ActiveObject>> parents = new List<List<IGH_ActiveObject>>();
    IGH_Param par = obj as IGH_Param;
    if (par != null && par.Sources != null)
    {


      IEnumerable<IGH_ActiveObject> p = par.Sources.Select(s => s.Attributes.GetTopLevel.DocObject as IGH_ActiveObject);
      //parents.Add(p);
      if(HasGroup(obj) && p.All(o => !HasGroupsInCommon(o, obj)) && par.WireDisplay != GH_ParamWireDisplay.faint)
      {
        DebugWrite("Fixing " + par.Attributes.GetTopLevel.DocObject.NickName);
        par.WireDisplay = GH_ParamWireDisplay.faint;
      }

    }

    IGH_Component comp = obj as IGH_Component;
    if (comp != null)
    {
      foreach(IGH_Param inp in comp.Params.Input)
      {

        IEnumerable<IGH_ActiveObject> p = inp.Sources.Select(i => i.Attributes.GetTopLevel.DocObject as IGH_ActiveObject);

        if(HasGroup(obj) && p.All(o => !HasGroupsInCommon(o, obj)) && inp.WireDisplay != GH_ParamWireDisplay.faint)
        {
          DebugWrite("Fixing " + inp.Attributes.GetTopLevel.DocObject.NickName);
          inp.WireDisplay = GH_ParamWireDisplay.faint;
        }
      }

    }



  }





  public void SetDictionary()
  {
    IList<IGH_DocumentObject> objects = Grasshopper.Instances.ActiveCanvas.Document.Objects.ToList();
    //Print(String.Join(", ", objects.Select(o => o.NickName)));

    groupsPerObject = objects
      .Where(o => o.GetType() != typeof(GH_Group))
      .OfType<IGH_ActiveObject>()
      .ToDictionary(o => o, o => new HashSet<GH_Group>());

    foreach(GH_Group grp in objects.OfType<GH_Group>())
    {

      foreach(IGH_ActiveObject obj in grp.ObjectsRecursive().OfType<IGH_ActiveObject>())
      {
        groupsPerObject[obj].Add(grp);

      }
    }



  }

  public bool HasGroupsInCommon(IGH_ActiveObject obj1, IGH_ActiveObject obj2)
  {
    HashSet<GH_Group> set1 = groupsPerObject[obj1];
    HashSet<GH_Group> set2 = groupsPerObject[obj2];

    set1.IntersectWith(set2);

    return set1.Any();
  }

  public void SetEventHandlers()
  {

    GrasshopperDocument.UndoStateChanged -= OnSolutionExpired;
    GrasshopperDocument.UndoStateChanged += OnSolutionExpired;
    GrasshopperDocument.ObjectsDeleted -= OnDeleteThisComponent;
    GrasshopperDocument.ObjectsDeleted += OnDeleteThisComponent;
    msg.AppendFormat("Added the eventhandlers to UndoStateChanged\n", GrasshopperDocument.Objects.OfType<Grasshopper.Kernel.Special.GH_Group>().Count());
  }

  public void RemoveEventHandlers()
  {
    GrasshopperDocument.UndoStateChanged -= OnSolutionExpired;
    GrasshopperDocument.ObjectsDeleted -= OnDeleteThisComponent;

    msg.AppendFormat("Removed wire event handlers on document\n", GrasshopperDocument.Objects.OfType<Grasshopper.Kernel.Special.GH_Group>().Count());

  }

  public void OnDeleteThisComponent(object sender, GH_DocObjectEventArgs e)
  {

    if (e.Objects.OfType<Grasshopper.Kernel.GH_Component>().Where(o => o.NickName == this.Component.NickName).Any())
    {
      DebugWrite("Removed template component. Removing all the eventhandlers");
      RemoveEventHandlers();
    }

  }

  public bool IdExists(int id)
  {
    IList<IGH_DocumentObject> objs = Grasshopper.Instances.ActiveCanvas.Document.Objects;
    return objs
      .OfType<IGH_Component>()
      .Where(ob => ob.NickName == this.Component.NickName)
      .Where(ob => ob.GetType().ToString() == "ScriptComponents.Component_CSNET_Script")
      .Where(ob => ob.Message == "id: " + id.ToString()).Any();

  }

  public void DebugWrite(string msg)
  {
    if (_debug)
    {
      Rhino.RhinoApp.WriteLine(String.Format("[FixWire {0}]: {1}", id, msg));
    }
  }
# ---------- end fixwires ----------

# ----
# processes to kill
panel_16 = Panel("""dctimestep
rcontrib
rtrace
oconv
rvu
rmtxop""")
kill = LBFalseStartToggle(False)

# ----
# Kill processes running on linux
panel_17 = Panel("pkill -f <instance>")
overrides = ApplyOverrides(Input_=panel_17, Instance=graft(panel_16))  # -> flatten(Output), Pairs
join = TextJoin(Text=overrides.Output, Join=";")
executessh_wip_2 = ExecuteSSHWIP(
    _SSHCommands_=join,
    Run=kill,
    addPrefix=True,
    description="pkill -f dctimestep;pkill -f rcontrib;pkill -f rtrace;pkill -f oconv;pkill -f rvu;pkill -f rmtxop",
    fireLogs=False,
    lastRunTime=0,
    suppressWarnings=False)  # -> Stdout, Stderr_, Ran
panel_18 = Panel(executessh_wip_2.Stderr_)

nickname = GH_TestComponentColor(Color=ColourSwatch(SwatchColor=RGB(188, 118, 194)), SelColor=ColourSwatch(SwatchColor=RGB(191, 128, 128)))

# ----
# importing from rhino layers
dpipeline = DynamicGeometryPipeline(
    LayerFilter="Daylight_Inputs::*",
    TypeFilter=panel_10,
    NameFilter="*",
    GroupByLayer=False,
    GroupByType=False,
    IncludeHidden=True,
    IncludeLocked=True,
    enableFullPath=True,
    listenToAttributes=True)
dam = DataDam(DataA=dpipeline, BufferDelay=10000000, BufferMode=0)
objatts = ObjectAttributes(ObjectOrAttributes=dam)  # -> Name, LayerName, LayerFullPath, Color, MaterialName, LinetypeName, GroupIndices, PlotWeight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
cset = CreateSet(List=objatts.LayerName)  # -> Set, Map
assign_paths = AssignPaths(InputData=flatten(dam), PathsToAssign=flatten(cset.Map))
python_3 = GhPythonScript(layer_name=graft(cset.Set))  # -> is_opaque, is_transparent, is_grid, is_HB_Room, is_HB_Window
# ---------- python_3: Python ----------
__author__ = "mm1013"
__version__ = "2022.01.16"

import rhinoscriptsyntax as rs

is_grid = layer_name == "Grids"

if layer_name.startswith("HB_"):
    is_opaque = is_transparent = is_grid = False
    
    is_HB_Window = layer_name.endswith("%")
    is_HB_Room = layer_name == "HB_Rooms"
    
    
else:
    if is_grid:
        is_opaque = False
        is_transparent = False
    else:
        is_transparent = layer_name.endswith("%")
        if is_transparent:
            transmittance = layer_name.split("_")[-1].replace("%","")
        is_opaque = not is_transparent
# ---------- end python_3 ----------
layer_name = Text(cset.Set)
geo = Geometry(assign_paths)

# ----
# Template methods
# By Mathias Sønderskov Schaltz 2022
# Check for updates here https://github.com/Sonderwoods/GrasshopperScribbles
panel_19 = Panel(colorgroups)
panel_20 = Panel(fixwires)
panel_21 = Panel(fixparams)

# ----
# Glass geometries
cull = CullPattern(List=graft(layer_name), CullPattern=graft(python_3.is_transparent))  # -> simplify(List)
cull_2 = CullPattern(List=geo, CullPattern=python_3.is_transparent)
python_4 = GhPythonScript(layer_name=cull)  # -> out, transmittance, name
# ---------- python_4: Python ----------
__author__ = "mm1013"
__version__ = "2022.01.16"

import rhinoscriptsyntax as rs

try:
    transmittance = layer_name.split("_")[-1].replace("%","")
    name = layer_name.replace("%","")
except:
    transmittance = None
    name = None
# ---------- end python_4 ----------
clean = CleanTree(
    RemoveNulls=True,
    RemoveInvalid=True,
    RemoveEmpty=True,
    Tree=simplify(cull_2),
    SynchronousTree1=simplify(python_4.name),
    SynchronousTree2=simplify(python_4.transmittance))  # -> Tree, SynchronousTree1, SynchronousTree2
python_5 = GhPythonScript(x=clean.SynchronousTree1)  # -> a
# ---------- python_5: Python ----------
__author__ = "mm1013"
__version__ = "2022.09.02"

import rhinoscriptsyntax as rs

a = x[1:]
# ---------- end python_5 ----------
meshit2 = MeshIt2(mesh_brep=graft(clean.Tree))
name = Text(python_5)
panel_22 = Panel(name)
unflatten = UnflattenTree(Tree=meshit2, Guide=clean.Tree)
geo_2 = Geometry(unflatten)
transmittance = Number(expr("x/100", clean.SynchronousTree2))
concat = Concatenate(FragmentA=panel_22, FragmentB="_mat")
mesh = Mesh(geo_2)

# ----
# opaque geometries
cull_3 = CullPattern(List=graft(layer_name), CullPattern=graft(python_3.is_opaque))  # -> simplify(List)
cull_4 = CullPattern(List=geo, CullPattern=graft(python_3.is_opaque))  # -> simplify(List)
python_6 = GhPythonScript(layer_name=cull_3)  # -> out, reflectance
# ---------- python_6: Python ----------
__author__ = "mm1013"
__version__ = "2022.01.16"

import rhinoscriptsyntax as rs
try:
    reflectance = layer_name.split("_")[-1]
    
except:
    reflectance = None
# ---------- end python_6 ----------
clean_2 = CleanTree(
    RemoveNulls=True,
    RemoveInvalid=True,
    RemoveEmpty=True,
    Tree=cull_3,
    SynchronousTree1=cull_4,
    SynchronousTree2=python_6.reflectance)  # -> Tree, SynchronousTree1, SynchronousTree2
name_2 = Text(clean_2.Tree)
geo_3 = Geometry(clean_2.SynchronousTree1)
refl = Number(clean_2.SynchronousTree2)
python_7 = GhPythonScript(x=name_2)  # -> a; same code as python_5
meshit2_2 = MeshIt2(mesh_brep=geo_3)
concat_2 = Concatenate(FragmentA=python_7, FragmentB="_mat")

# ----
# Grid
cull_5 = CullPattern(List=graft(layer_name), CullPattern=graft(python_3.is_grid))  # -> simplify(List)
cull_6 = CullPattern(List=geo, CullPattern=python_3.is_grid)
clean_3 = CleanTree(RemoveNulls=True, RemoveInvalid=True, RemoveEmpty=True, Tree=cull_5, SynchronousTree1=simplify(cull_6))  # -> Tree, SynchronousTree1
geo_4 = Geometry(graft(clean_3.SynchronousTree1))

# ----
# Read more
# 
# 
# Ambient cache
# https://discourse.radiance-online.org/t/what-data-does-ambfile-store/4785/2
# Vertex order (and normal)
# 
# source : https://www.radiance-online.org/learning/tutorials/Tutorial-ThreePhaseMethod.pdf
# FILE NAMES: *.vmx - view matrix (data)
# *.hdr - view matrix (renderings)
# *.dmx - daylight matrix
# *.skv - sky vector
# *.smx – sky matrix
# *.xml - transmission matrix (the file is xml format)
# 
# *.rad - radiance scene data
# *.oct - octree file
# *.vf - view file
# *.dat - data
# 
# source : https://www.radiance-online.org/learning/tutorials/Tutorial-ThreePhaseMethod.pdf
image = ImageSampler(Filter="Colour", Interpolate=True, Umax=1, Umin=0, Vmax=1, Vmin=0, Wrap=1)  # disabled
logviewer_2 = LogViewer(Number=10)  # -> CurrentTasks, Logs
largest_brep = LargestBREP(window_breps=[<geometry referenced from the Rhino model> x224])
# Log of latest(10) SSH Commands
panel_23 = Panel(logviewer_2.Logs)

overrides_2 = ApplyOverrides(Input="<LinuxHome>")
overrides_3 = ApplyOverrides(Input="<LinuxHome>/radFiles")

# ----
# Create working folder
panel_24 = Panel("""mkdir -p <LinuxHome>
mkdir -p <LinuxHome>/radFiles
echo <LinuxHome>""")
prep_octrees = LBFalseStartToggle(True)
overrides_4 = ApplyOverrides(Input=panel_24)  # -> Output, DynamicOutput
executessh = ExecuteSSH(
    _SSHCommands_=overrides_4.DynamicOutput,
    Run=prep_octrees,
    addPrefix=True,
    description="""mkdir -p ~/MantaRay/UnnamedProject
mkdir -p ~/MantaRay/UnnamedProject/radFiles
echo ~/MantaRay/UnnamedProject""",
    fireLogs=False,
    lastRunTime=7.4329,
    name="Create working dir",
    suppressWarnings=False,
    results="/home/mss/MantaRay/UnnamedProject",
    commands="""mkdir -p ~/MantaRay/UnnamedProject
mkdir -p ~/MantaRay/UnnamedProject/radFiles
echo ~/MantaRay/UnnamedProject""")  # -> Stdout, Stderr_, Ran

# ----
# Opaque geometry
panel_25 = Panel("mapping_opaque")
modnames = Text(concat_2)
names = Text(python_7)
mesh_2 = Mesh(meshit2_2)
mesh2obj = MeshToObj(
    Mesh=mesh_2,
    Name=graft(names),
    MapFileName=panel_25,
    ModifierName=graft(modnames),
    SubfolderOverride=overrides_2,
    Run=executessh.Ran)  # -> ObjFiles, MapFile, Run
obj2rad = ObjToRad(
    ObjFiles=mesh2obj.ObjFiles,
    MapFile=mesh2obj.MapFile,
    SubfolderOverride=overrides_3,
    Run=mesh2obj.Run,
    stdouts="~/MantaRay/UnnamedProject/radFiles/CurvedCeiling_0.80.rad>JOIN<~/MantaRay/UnnamedProject/radFiles/ConcreteGrey_0.5.rad>JOIN<~/MantaRay/UnnamedProject/radFiles/ConcreteDarker_0.1.rad>JOIN<~/MantaRay/UnnamedProject/radFiles/Cladding_0.5.rad>JOIN<~/MantaRay/UnnamedProject/radFiles/ConcreteStructure_0.3.rad>JOIN<~/MantaRay/UnnamedProject/radFiles/Black_0.01.rad>JOIN<~/MantaRay/UnnamedProject/radFiles/Floor_FloorMat_0.7.rad>JOIN<~/MantaRay/UnnamedProject/radFiles/ConcreteWhite_0.8.rad>JOIN<~/MantaRay/UnnamedProject/radFiles/IntWalls_0.9.rad>JOIN<~/MantaRay/UnnamedProject/radFiles/IntWalls_0.80.rad>JOIN<~/MantaRay/UnnamedProject/radFiles/Pipes_0.03.rad>JOIN<~/MantaRay/UnnamedProject/radFiles/FloorBox_0.75.rad>JOIN<~/MantaRay/UnnamedProject/radFiles/Frames_0.6.rad")  # -> Status, RadFiles, Run
opaque_rad = Text(obj2rad.RadFiles)
panel_26 = Panel(obj2rad.Status)

panel_27 = Panel("/mnt/c/simulation/aah.tmp")

# ----
# rad files
# Window geometry
panel_28 = Panel("mapping_windows")
mesh2obj_2 = MeshToObj(
    Mesh=mesh,
    Name=graft(panel_22),
    MapFileName=panel_28,
    ModifierName=graft(concat),
    SubfolderOverride=overrides_2,
    Run=executessh.Ran)  # -> ObjFiles, MapFile, Run
obj2rad_2 = ObjToRad(
    ObjFiles=mesh2obj_2.ObjFiles,
    MapFile=mesh2obj_2.MapFile,
    SubfolderOverride=overrides_3,
    Run=mesh2obj_2.Run,
    stdouts="~/MantaRay/UnnamedProject/radFiles/Glass_70.rad")  # -> Status, RadFiles, Run
window_rad = Text(obj2rad_2.RadFiles)

# ----
# Setup glass materials
python_8 = GhPythonScript(matname=concat)  # -> filename
# ---------- python_8: Python ----------
__author__ = "mm1013"
__version__ = "2022.07.06"

import rhinoscriptsyntax as rs

filename = matname.replace(" ","_").replace(".","_")
# ---------- end python_8 ----------
glassmat = GlassMat(Name=concat, Transmittance_0_1=transmittance)  # -> RadMaterials, RadMaterialList
# materials
panel_29 = Panel("echo \"<mats>\" > <LinuxHome>/radFiles/<target>;echo \"<LinuxHome>/radFiles/<target>\"")
overrides_5 = ApplyOverrides(Input="<mat>.mat", Mat=graft(python_8))
overrides_6 = ApplyOverrides(Input=panel_29, Mats=graft(glassmat.RadMaterials), Target=graft(overrides_5))  # -> Output, DynamicOutput
executessh_2 = ExecuteSSH(
    _SSHCommands_=overrides_6.DynamicOutput,
    Run=obj2rad.Run,
    addPrefix=True,
    description="""echo "void glass Glass_70_mat
0
0
3 0.763 0.763 0.763" > ~/MantaRay/UnnamedProject/radFiles/Glass_70_mat.mat;echo "~/MantaRay/UnnamedProject/radFiles/Glass_70_mat.mat"
""",
    fireLogs=False,
    lastRunTime=13.9963,
    name="glassMats",
    suppressWarnings=False,
    results="~/MantaRay/UnnamedProject/radFiles/Glass_70_mat.mat",
    commands="""echo "void glass Glass_70_mat
0
0
3 0.763 0.763 0.763" > ~/MantaRay/UnnamedProject/radFiles/Glass_70_mat.mat;echo "~/MantaRay/UnnamedProject/radFiles/Glass_70_mat.mat"
""")  # -> Stdout, Stderr_, Ran
cluster = Cluster(L=glassmat.RadMaterials)
cull_7 = CullPattern(List=executessh_2.Stdout, CullPattern=cluster)
window_mat = Text(flatten(cull_7))

# ----
# opaque materials
panel_30 = Panel("echo \"<mats>\" > <LinuxHome>/radFiles/<target>;echo \"<LinuxHome>/radFiles/<target>\"")
opaquegreymat = OpaqueGreyMat(Name=concat_2, Reflectance_0_1=refl, Specularity=0, Roughness=0)  # -> flatten(RadMaterials), RadMaterialList
join_2 = TextJoin(Text=opaquegreymat.RadMaterials)
overrides_7 = ApplyOverrides(Input=panel_30, Mats=graft(join_2), Target=graft("opaque_materials.mat"))  # -> Output, DynamicOutput
executessh_3 = ExecuteSSH(
    _SSHCommands_=overrides_7.DynamicOutput,
    Run=obj2rad.Run,
    addPrefix=True,
    description="""echo "void plastic Frames_0.6_mat
0
0
5 0.600 0.600 0.600 0.000 0.000
void plastic FloorBox_0.75_mat
0
0
5 0.750 0.750 0.750 0.000 0.000
void plastic Pipes_0.03_mat
0
0
5 0.030 0.030 0.030 0.000 0.000
void plastic IntWalls_0.80_mat
0
0
5 0.800 0.800 0.800 0.000 0.000
void plastic IntWalls_0.9_mat
0
0
5 0.900 0.900 0.900 0.000 0.000
void plastic ConcreteWhite_0.8_mat
0
0
5 0.800 0.800 0.800 0.000 0.000
void plastic Floor_FloorMat_0.7_mat
0
0
5 0.700 0.700 0.700 0.000 0.000
void plastic Black_0.01_mat
0
0
5 0.010 0.010 0.010 0.000 0.000
void plastic ConcreteStructure_0.3_mat
0
0
5 0.300 0.300 0.300 0.000 0.000
void plastic Cladding_0.5_mat
0
0
5 0.500 0.500 0.500 0.000 0.000
void plastic ConcreteDarker_0.1_mat
0
0
5 0.100 0.100 0.100 0.000 0.000
void plastic ConcreteGrey_0.5_mat
0
0
5 0.500 0.500 0.500 0.000 0.000
void plastic CurvedCeiling_0.80_mat
0
0
5 0.800 0.800 0.800 0.000 0.000" > ~/MantaRay/UnnamedProject/radFiles/opaque_materials.mat;echo "~/MantaRay/UnnamedProject/radFiles/opaque_materials.mat"
""",
    fireLogs=False,
    lastRunTime=9.691,
    name="opaqueMats",
    suppressWarnings=False,
    results="~/MantaRay/UnnamedProject/radFiles/opaque_materials.mat",
    commands="""echo "void plastic Frames_0.6_mat
0
0
5 0.600 0.600 0.600 0.000 0.000
void plastic FloorBox_0.75_mat
0
0
5 0.750 0.750 0.750 0.000 0.000
void plastic Pipes_0.03_mat
0
0
5 0.030 0.030 0.030 0.000 0.000
void plastic IntWalls_0.80_mat
0
0
5 0.800 0.800 0.800 0.000 0.000
void plastic IntWalls_0.9_mat
0
0
5 0.900 0.900 0.900 0.000 0.000
void plastic ConcreteWhite_0.8_mat
0
0
5 0.800 0.800 0.800 0.000 0.000
void plastic Floor_FloorMat_0.7_mat
0
0
5 0.700 0.700 0.700 0.000 0.000
void plastic Black_0.01_mat
0
0
5 0.010 0.010 0.010 0.000 0.000
void plastic ConcreteStructure_0.3_mat
0
0
5 0.300 0.300 0.300 0.000 0.000
void plastic Cladding_0.5_mat
0
0
5 0.500 0.500 0.500 0.000 0.000
void plastic ConcreteDarker_0.1_mat
0
0
5 0.100 0.100 0.100 0.000 0.000
void plastic ConcreteGrey_0.5_mat
0
0
5 0.500 0.500 0.500 0.000 0.000
void plastic CurvedCeiling_0.80_mat
0
0
5 0.800 0.800 0.800 0.000 0.000" > ~/MantaRay/UnnamedProject/radFiles/opaque_materials.mat;echo "~/MantaRay/UnnamedProject/radFiles/opaque_materials.mat"
""")  # -> Stdout, Stderr_, Ran
opaque_mat = Text(executessh_3.Stdout)

# ----
# Octrees
# STANDARD octree
window_mat_2 = Text(window_mat)
opaque_mat_2 = Text(opaque_mat)
window_rad_2 = Text(window_rad)
opaque_rad_2 = Text(opaque_rad)
entwine = Entwine(Branch00=window_mat_2, Branch01=window_rad_2, Branch02=opaque_mat_2, Branch03=opaque_rad_2, FlattenInputs=True)  # -> flatten(Result)

# ----
# Preview a RAD file with objpict
# can also use ra_tiff/normtiff/pfilt
# gamma will vary
# 
# check axel jacobs radiance tutorial p26
panel_31 = Panel("""mkdir -p <proj>/images/
objpict <rad> > <proj>/images/<target-.>.hdr
normtiff <proj>/images/<target-.>.hdr <proj>/images/<target-.>.tif
convert <proj>/images/<target-.>.tif <proj>/images/<target>
echo <proj>/images/<target>""")  # disabled
falsestart = LBFalseStartToggle(False)
radfile = Text(flatten(entwine))  # disabled
panel_32 = Panel("quickRender.png")  # disabled
item = ListItem(List=radfile, Index=0, Wrap=True)
panel_33 = Panel("""rad
target""")  # disabled
applyglobals = ApplyGlobals(Input=panel_31, AdditionalKeys=panel_33, AdditionalValues=[item, panel_32])  # -> Output, Pairs; disabled
execute_ssh_async = ExecuteSSHAsync(
    SSHCommands=applyglobals.Output,
    Run=falsestart,
    addPrefix=True,
    addSuffix=True,
    fireLogs=False,
    stdouts="/home/mss/simulation/test_project/images/quickRender.png",
    suppressWarnings=False)  # -> Stdout, Stderr, Log, port, Ran; disabled
convertpaths = ConvertPaths(I=execute_ssh_async.Stdout)  # -> Linux, Windows; disabled
imageviewer = LBImageViewer(ImagePath_=convertpaths.Windows, _scale_=1, DisableClickable=False, SaveImgWithCoords=False, scale=1)  # -> ImagePath, Values, GIF; disabled

entwine_2 = Entwine(Branch00=window_mat_2, Branch01=window_rad_2, FlattenInputs=True)
entwine_3 = Entwine(Branch00=opaque_mat_2, Branch01=opaque_rad_2, FlattenInputs=True)

# ----
# Download and preview rad files
panel_34 = Panel("<WinHome>\Downloads")
falsestart_2 = LBFalseStartToggle(True)
overrides_8 = ApplyOverrides(Input=panel_34)
falsestart_3 = LBFalseStartToggle(False)
download = Download(
    LinuxFilePaths=flatten(entwine_2),
    TargetLocalFolder=overrides_8,
    Run=falsestart_3,
    stdouts="C:\Users\mm1013\MantaRay\UnnamedProject\Downloads\Glass_70_mat.mat>JOIN<C:\Users\mm1013\MantaRay\UnnamedProject\Downloads\Glass_70.rad")  # -> Status, FilePaths, Ran
download_2 = Download(
    LinuxFilePaths=flatten(entwine_3),
    TargetLocalFolder=overrides_8,
    Run=falsestart_2,
    stdouts="C:\Users\mm1013\MantaRay\UnnamedProject\Downloads\opaque_materials.mat>JOIN<C:\Users\mm1013\MantaRay\UnnamedProject\Downloads\CurvedCeiling_0.80.rad>JOIN<C:\Users\mm1013\MantaRay\UnnamedProject\Downloads\ConcreteGrey_0.5.rad>JOIN<C:\Users\mm1013\MantaRay\UnnamedProject\Downloads\ConcreteDarker_0.1.rad>JOIN<C:\Users\mm1013\MantaRay\UnnamedProject\Downloads\Cladding_0.5.rad>JOIN<C:\Users\mm1013\MantaRay\UnnamedProject\Downloads\ConcreteStructure_0.3.rad>JOIN<C:\Users\mm1013\MantaRay\UnnamedProject\Downloads\Black_0.01.rad>JOIN<C:\Users\mm1013\MantaRay\UnnamedProject\Downloads\Floor_FloorMat_0.7.rad>JOIN<C:\Users\mm1013\MantaRay\UnnamedProject\Downloads\ConcreteWhite_0.8.rad>JOIN<C:\Users\mm1013\MantaRay\UnnamedProject\Downloads\IntWalls_0.9.rad>JOIN<C:\Users\mm1013\MantaRay\UnnamedProject\Downloads\IntWalls_0.80.rad>JOIN<C:\Users\mm1013\MantaRay\UnnamedProject\Downloads\Pipes_0.03.rad>JOIN<C:\Users\mm1013\MantaRay\UnnamedProject\Downloads\FloorBox_0.75.rad>JOIN<C:\Users\mm1013\MantaRay\UnnamedProject\Downloads\Frames_0.6.rad")  # -> Status, FilePaths, Ran
cull_8 = CullPattern(List=download.FilePaths, CullPattern=falsestart_3)
cull_9 = CullPattern(List=download_2.FilePaths, CullPattern=falsestart_2)
radviewer = RadViewer(
    RadFiles=flatten(cull_8),
    IsTwoSided=False,
    Polychromatic=True,
    ShowEdges=True,
    Transparent=True,
    ColorNames=["GlassTak_70_mat", "GlassInt_74_mat", "GlassFacade_74_mat", "GlassBSDF_70_mat", "SkylightWall_70_mat", "SlabCeiling_80_mat", "SlabFloor_30_mat", "SlabWall_50_mat", "SlabJ_50_mat", "WallExterior_50_mat", "Roofs_50_mat", "Doors_50_mat", "FramesCW_50_mat", "FacadeBright_70_mat", "ContextBright_70_mat", "WallInterior_70_mat", "FacadeDark_30_mat", "Frames_50_mat", "Terrain_20_mat", "Buildings_50_mat", "Glass_70_mat"],
    Colors=[RGB(177, 203, 218), RGB(149, 243, 118), RGB(218, 247, 105), RGB(165, 199, 252), RGB(100, 251, 165), RGB(203, 230, 172), RGB(169, 243, 224), RGB(238, 176, 232), RGB(242, 222, 239), RGB(146, 222, 239), RGB(144, 119, 233), RGB(174, 245, 124), RGB(120, 214, 159), RGB(156, 153, 225), RGB(117, 221, 150), RGB(184, 150, 138), RGB(158, 205, 172), RGB(189, 132, 143), RGB(106, 135, 236), RGB(102, 168, 232), RGB(245, 194, 251)])  # -> Geo, ModifierNames, Modifiers, FailedWireFrame
radviewer_2 = RadViewer(
    RadFiles=flatten(cull_9),
    IsTwoSided=False,
    Polychromatic=True,
    ShowEdges=True,
    Transparent=True,
    ColorNames=["GlassTak_70_mat", "GlassInt_74_mat", "GlassFacade_74_mat", "GlassBSDF_70_mat", "SkylightWall_70_mat", "SlabCeiling_80_mat", "SlabFloor_30_mat", "SlabWall_50_mat", "SlabJ_50_mat", "WallExterior_50_mat", "Roofs_50_mat", "Doors_50_mat", "FramesCW_50_mat", "FacadeBright_70_mat", "ContextBright_70_mat", "WallInterior_70_mat", "FacadeDark_30_mat", "Frames_50_mat", "Terrain_20_mat", "Buildings_50_mat", "CurvedCeiling_0.80_mat", "ConcreteGrey_0.5_mat", "ConcreteDarker_0.1_mat", "Cladding_0.5_mat", "ConcreteStructure_0.3_mat", "Black_0.01_mat", "Floor_FloorMat_0.7_mat", "ConcreteWhite_0.8_mat", "IntWalls_0.9_mat", "IntWalls_0.80_mat", "Pipes_0.03_mat", "FloorBox_0.75_mat", "Frames_0.6_mat"],
    Colors=[RGB(177, 203, 218), RGB(149, 243, 118), RGB(218, 247, 105), RGB(165, 199, 252), RGB(100, 251, 165), RGB(203, 230, 172), RGB(169, 243, 224), RGB(238, 176, 232), RGB(242, 222, 239), RGB(146, 222, 239)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])  # -> Geo, ModifierNames, Modifiers, FailedWireFrame

falsestart_4 = LBFalseStartToggle(True)

resolution = ValueList({"750x330": 750, "1500x750": 1500, "3000x1500": 3000, "5000x2500": 5000, "7000x3500": 7000, "8000x4000": 8000, "16000x8000": 16000, "20000x12000": 20000}, selected="5000x2500")
x = Number(resolution)

panel_35 = Panel("-ab 3 -ad 2048")

resolution_2 = ValueList({"750x330": 750, "1500x750": 1500, "3000x1500": 3000, "5000x2500": 5000, "7000x3500": 7000, "8000x4000": 8000, "16000x8000": 16000, "20000x12000": 20000}, selected="1500x750")
x_2 = Number(resolution_2)

# ----
# attempt to do overcast discretized sky (rtcontrib tutorial p20)
panel_37 = Panel("gensky 3 21 10 -c -a 51 -o 0 -m 0 -b 22.86")
falsestart_5 = LBFalseStartToggle(False)
panel_38 = Panel("""gensky 3 21 10 -c -a 51 -o 0 -m 0 -b 22.86 \
|rcalc -i '3 2 <zenithbr> <groundbr>' \
-e '$1=<groundbr>'""")
executessh_4 = ExecuteSSH(
    _SSHCommands_=panel_37,
    Run=falsestart_5,
    addPrefix=True,
    fireLogs=False,
    lastRunTime=5,
    suppressWarnings=False,
    results="""# gensky 3 21 10 -c -a 51 -o 0 -m 0 -b 22.86
# Local solar time: 9.88
# Solar altitude and azimuth: 31.9 -38.5
# Ground ambient level: 17.8

void brightfunc skyfunc
2 skybr skybright.cal
0
3 2 2.29e+01 3.56e+00""",
    commands="gensky 3 21 10 -c -a 51 -o 0 -m 0 -b 22.86")  # -> Stdout, Stderr_, Ran
python_9 = GhPythonScript(x=executessh_4.Stdout)  # -> a
# ---------- python_9: Python ----------
__author__ = "mm1013"
__version__ = "2022.09.27"

import rhinoscriptsyntax as rs

a = float(x.split("\n")[3].split(" ")[-1])
# ---------- end python_9 ----------
python_10 = GhPythonScript(x=executessh_4.Stdout)  # -> a
# ---------- python_10: Python ----------
__author__ = "mm1013"
__version__ = "2022.09.27"

import rhinoscriptsyntax as rs

a = float(x.split(" ")[-2])
# ---------- end python_10 ----------
panel_39 = Panel(executessh_4.Stdout)
overrides_9 = ApplyOverrides(Input=panel_38, Zenithbr=graft(python_10), Groundbr=graft(python_9))  # -> Output, DynamicOutput
executessh_5 = ExecuteSSH(
    _SSHCommands_=overrides_9.Output,
    Run=executessh_4.Ran,
    addPrefix=True,
    fireLogs=False,
    lastRunTime=6,
    suppressWarnings=False,
    stderr="3 2 22.9 17.8: cannot open",
    commands="""gensky 3 21 10 -c -a 51 -o 0 -m 0 -b 22.86 \
|rcalc -i '3 2 22.9 17.8' \
-e '$1=17.8'""")  # -> Stdout, Stderr_, Ran
panel_40 = Panel(executessh_5.Stderr_)

panel_41 = Panel("/home/mss/MantaRay/UnnamedProject/myRenderX.hdr")

# ---- group: Extracted Coordinates
pt = Point()

# ----
panel_42 = Panel("falsecolor -lw 0 -s 50 -n 10 -m 1.79 -l DF -p <rad-.>_exposed.hdr -i <irrad> -cp > <rad-.>_fc4_lw0.hdr;echo <rad-.>_fc4_lw0.hdr")
panel_43 = Panel("""pcond -h <rad> <rad-.>_exposed2.hdr
pcomb <rad-.>_exposed2.hdr -s 0.2 <fc> > <rad-.>_overlay.hdr
echo <rad-.>_overlay.hdr""")
panel_44 = Panel("pcomb -o <hdr> | pcompos -x 2 -y 2 - -<x> -<y> | pvalue -h -H -df | total -if3 -m | sed -r 's/[\t]+/1/g'")

# ---- group: Extracted Coordinates
pt_2 = Point([Point(811, 630, 0), Point(812, 668, 0), Point(814, 715, 0), Point(816, 753, 0), Point(816, 798, 0), Point(1312, 468, 0), Point(1308, 506, 0), Point(1305, 547, 0), Point(1305, 574, 0), Point(1299, 606, 0), Point(1627, 410, 0), Point(1619, 440, 0), Point(1614, 468, 0), Point(1608, 500, 0), Point(132, 21, 0)])

# ----
item_2 = ListItem(List=pt_2, Index=0, Wrap=True)
pdecon = Deconstruct(Point=pt_2)  # -> XComponent, YComponent, ZComponent

# ----
# 10klx overcast sky (RwR p357)
# # start of sky definition for daylighting studies
# # location name: COPENHAGEN_DNK LAT: 55.63
# !gensky 5 14 14.0 -c -a 55.63 -o -12.67 -m -15.0 | xform -rz 0.0
# skyfunc glow sky_mat
# 0
# 0
# 4
# 1 1 1 0
# sky_mat source sky
# 0
# 0
# 4
# 0 0 1 180
# skyfunc glow ground_glow
# 0
# 0
# 4
# 1 .8 .5 0
# ground_glow source ground
# 0
# 0
# 4
# 0 0 -1 180
# # end of sky definition for daylighting studies
falsestart_6 = LBFalseStartToggle(False)
bool = Boolean(falsestart_6)
and_append_the_ground = Panel("""##The 1 will be multiplie with brightfunc
skyfunc glow sky_glow
0
0
4 1 1 1 0

##Set to 1 as it will be multiplied with the gensky result
sky_glow source sky
0
0
4 0 0 1 180

##Set to 1 as it will be multiplied with the gensky result
skyfunc glow ground_glow
0
0
4 1 1 1 0

##The ground pane
ground_glow source ground
0
0
4 0 0 -1 180""")
panel_45 = Panel("""mkdir -p <proj>/skies/
echo "<sky>" > <proj>/skies/<target>
echo "<proj>/skies/<target>"
""")

executessh_6 = ExecuteSSH(
    _SSHCommands_="gensky -ang 45 0 -c -B 55.866",
    Run=bool,
    addPrefix=True,
    fireLogs=False,
    lastRunTime=5,
    suppressWarnings=False,
    results="""# gensky -ang 45 0 -c -B 55.866
# Ground ambient level: 17.8

void brightfunc skyfunc
2 skybr skybright.cal
0
3 2 2.29e+01 3.56e+00""",
    commands="gensky -ang 45 0 -c -B 55.866")  # -> Stdout, Stderr_, Ran

concat_3 = Concatenate(FragmentC="##Will control the gradient of the sky", FragmentA=executessh_6.Stdout, FragmentB=and_append_the_ground)
panel_46 = Panel(concat_3)
overrides_10 = ApplyOverrides(Input=panel_45, Sky=graft(panel_46), Target=graft("overcast_sky.rad"))  # -> Output, DynamicOutput
executessh_7 = ExecuteSSH(
    _SSHCommands_=overrides_10.DynamicOutput,
    Run=executessh_6.Ran,
    addPrefix=True,
    description="""mkdir -p <proj>/skies/
echo "##Will control the gradient of the sky
# gensky -ang 45 0 -c -B 55.866
# Ground ambient level: 17.8

void brightfunc skyfunc
2 skybr skybright.cal
0
3 2 2.29e+01 3.56e+00

##The 1 will be multiplie with brightfunc
skyfunc glow sky_glow
0
0
4 1 1 1 0

##Set to 1 as it will be multiplied with the gensky result
sky_glow source sky
0
0
4 0 0 1 180

##Set to 1 as it will be multiplied with the gensky result
skyfunc glow ground_glow
0
0
4 1 1 1 0

##The ground pane
ground_glow source ground
0
0
4 0 0 -1 180" > <proj>/skies/overcast_sky.rad
echo "<proj>/skies/overcast_sky.rad"
""",
    fireLogs=False,
    lastRunTime=6,
    suppressWarnings=False,
    results="""_JOIN_
_JOIN_
~/MantaRay/UnnamedProject/skies/overcast_sky.rad""",
    commands="""mkdir -p ~/MantaRay/UnnamedProject/skies/
_JOIN_
echo "##Will control the gradient of the sky
# gensky -ang 45 0 -c -B 55.866
# Ground ambient level: 17.8

void brightfunc skyfunc
2 skybr skybright.cal
0
3 2 2.29e+01 3.56e+00

##The 1 will be multiplie with brightfunc
skyfunc glow sky_glow
0
0
4 1 1 1 0

##Set to 1 as it will be multiplied with the gensky result
sky_glow source sky
0
0
4 0 0 1 180

##Set to 1 as it will be multiplied with the gensky result
skyfunc glow ground_glow
0
0
4 1 1 1 0

##The ground pane
ground_glow source ground
0
0
4 0 0 -1 180" > ~/MantaRay/UnnamedProject/skies/overcast_sky.rad
_JOIN_
echo "~/MantaRay/UnnamedProject/skies/overcast_sky.rad"
""")  # -> Stdout, Stderr_, Ran
panel_47 = Panel(overrides_10.DynamicOutput)
sky_ovc = Text(executessh_7.Stdout)

overrides_11 = ApplyOverrides(Input="cat <target>", Target=graft(executessh_7.Stdout))  # -> Output, DynamicOutput
executessh_8 = ExecuteSSH(
    _SSHCommands_=overrides_11.Output,
    Run=False,
    addPrefix=True,
    fireLogs=False,
    lastRunTime=0,
    suppressWarnings=False,
    results="""##Will control the gradient of the sky
# gensky -ang 45 0 -c -B 55.866
# Ground ambient level: 17.8

void brightfunc skyfunc
2 skybr skybright.cal
0
3 2 2.29e+01 3.56e+00

##The 1 will be multiplie with brightfunc
skyfunc glow sky_glow
0
0
4 1 1 1 0

##Set to 1 as it will be multiplied with the gensky result
sky_glow source sky
0
0
4 0 0 1 180

##Set to 1 as it will be multiplied with the gensky result
skyfunc glow ground_glow
0
0
4 1 1 1 0

##The ground pane
ground_glow source ground
0
0
4 0 0 -1 180""",
    commands="cat ~/MantaRay/UnnamedProject/skies/overcast_sky.rad")  # -> Stdout, Stderr_, Ran
panel_48 = Panel(executessh_8.Stdout)

panel_49 = Panel(executessh_7.Stderr_)

# ----
# OCTREE (overcast)
scene_rads = Text(entwine)
sky_ovc_2 = Text(sky_ovc)
python_11 = GhPythonScript(x=flatten(scene_rads))  # -> a; inputs x: list
# ---------- python_11: Python ----------
__author__ = "mm1013"
__version__ = "2022.06.15"

import rhinoscriptsyntax as rs

a = None not in x
# ---------- end python_11 ----------
entwine_4 = Entwine(Branch01=sky_ovc_2, Branch02=scene_rads, FlattenInputs=True)  # -> flatten(Radfiles)
panel_50 = Panel("""mkdir -p <proj>/octrees/
oconv -r 2048 -w -f <rads> > <proj>/octrees/<target>
echo <proj>/octrees/<target>""")
and = GateAnd(A=python_11, B=falsestart_4)
join_3 = TextJoin(Text=entwine_4, Join=" ")
overrides_12 = ApplyOverrides(Input=panel_50, Rads=graft(join_3), Target=graft("my_test_scene.oct"))  # -> Output, DynamicOutput
executessh_9 = ExecuteSSH(
    _SSHCommands=overrides_12.DynamicOutput,
    Run=and,
    addPrefix=True,
    description="""mkdir -p ~/MantaRay/UnnamedProject/octrees/
oconv -r 2048 -w -f ~/MantaRay/UnnamedProject/skies/overcast_sky.rad ~/MantaRay/UnnamedProject/radFiles/Glass_70_mat.mat ~/MantaRay/UnnamedProject/radFiles/Glass_70.rad ~/MantaRay/UnnamedProject/radFiles/opaque_materials.mat ~/MantaRay/UnnamedProject/radFiles/CurvedCeiling_0.80.rad ~/MantaRay/UnnamedProject/radFiles/ConcreteGrey_0.5.rad ~/MantaRay/UnnamedProject/radFiles/ConcreteDarker_0.1.rad ~/MantaRay/UnnamedProject/radFiles/Cladding_0.5.rad ~/MantaRay/UnnamedProject/radFiles/ConcreteStructure_0.3.rad ~/MantaRay/UnnamedProject/radFiles/Black_0.01.rad ~/MantaRay/UnnamedProject/radFiles/Floor_FloorMat_0.7.rad ~/MantaRay/UnnamedProject/radFiles/ConcreteWhite_0.8.rad ~/MantaRay/UnnamedProject/radFiles/IntWalls_0.9.rad ~/MantaRay/UnnamedProject/radFiles/IntWalls_0.80.rad ~/MantaRay/UnnamedProject/radFiles/Pipes_0.03.rad ~/MantaRay/UnnamedProject/radFiles/FloorBox_0.75.rad ~/MantaRay/UnnamedProject/radFiles/Frames_0.6.rad > ~/MantaRay/UnnamedProject/octrees/my_test_scene.oct
echo ~/MantaRay/UnnamedProject/octrees/my_test_scene.oct""",
    fireLogs=False,
    lastRunTime=6963.431,
    suppressWarnings=False,
    results="/home/mss/MantaRay/UnnamedProject/octrees/my_test_scene.oct",
    commands="""mkdir -p ~/MantaRay/UnnamedProject/octrees/
oconv -r 2048 -w -f ~/MantaRay/UnnamedProject/skies/overcast_sky.rad ~/MantaRay/UnnamedProject/radFiles/Glass_70_mat.mat ~/MantaRay/UnnamedProject/radFiles/Glass_70.rad ~/MantaRay/UnnamedProject/radFiles/opaque_materials.mat ~/MantaRay/UnnamedProject/radFiles/CurvedCeiling_0.80.rad ~/MantaRay/UnnamedProject/radFiles/ConcreteGrey_0.5.rad ~/MantaRay/UnnamedProject/radFiles/ConcreteDarker_0.1.rad ~/MantaRay/UnnamedProject/radFiles/Cladding_0.5.rad ~/MantaRay/UnnamedProject/radFiles/ConcreteStructure_0.3.rad ~/MantaRay/UnnamedProject/radFiles/Black_0.01.rad ~/MantaRay/UnnamedProject/radFiles/Floor_FloorMat_0.7.rad ~/MantaRay/UnnamedProject/radFiles/ConcreteWhite_0.8.rad ~/MantaRay/UnnamedProject/radFiles/IntWalls_0.9.rad ~/MantaRay/UnnamedProject/radFiles/IntWalls_0.80.rad ~/MantaRay/UnnamedProject/radFiles/Pipes_0.03.rad ~/MantaRay/UnnamedProject/radFiles/FloorBox_0.75.rad ~/MantaRay/UnnamedProject/radFiles/Frames_0.6.rad > ~/MantaRay/UnnamedProject/octrees/my_test_scene.oct
echo ~/MantaRay/UnnamedProject/octrees/my_test_scene.oct""")  # -> Stdout, Stderr_, Ran
convertpaths_2 = ConvertPaths(I=executessh_9.Stdout)  # -> Linux, Windows
panel_51 = Panel(executessh_9.Stderr_)
panel_52 = Panel(convertpaths_2.Windows)
octree_overcast = Text(executessh_9.Stdout)

panel_53 = Panel(overrides_12.DynamicOutput)

# ----
# sunny sky (SET LAT AND LON)
panel_54 = Panel("gensky 7 4 <h>:00CEST +s -a <lat> -o <lon>")
falsestart_7 = LBFalseStartToggle(False)
# Colored skies! Why not?
# from https://discourse.radiance-online.org/t/new-tool-for-generating-colored-sky/5891
series = Series(Start=8, Step=1, Count=10)
bool_2 = Boolean(falsestart_7)
overrides_13 = ApplyOverrides(Input_=panel_54, Lat=graft("59.9"), Lon=graft("10.7"), H=graft(series))  # -> Output, Pairs
and_append_the_ground_2 = Panel("""##The 1 will be multiplie with brightfunc
skyfunc glow sky_glow
0
0
4 1 1 1 0

##Set to 1 as it will be multiplied with the gensky result
sky_glow source sky
0
0
4 0 0 1 180

##Set to 1 as it will be multiplied with the gensky result
skyfunc glow ground_glow
0
0
4 1 1 1 0

##The ground pane
ground_glow source ground
0
0
4 0 0 -1 180""")
executessh_wip_3 = ExecuteSSHWIP(
    _SSHCommands_=overrides_13.Output,
    Run=bool_2,
    addPrefix=True,
    description="""gensky 7 4 8:00CEST +s -a 59.9 -o 10.7


- - -

gensky 7 4 9:00CEST +s -a 59.9 -o 10.7


- - -

gensky 7 4 10:00CEST +s -a 59.9 -o 10.7


- - -

gensky 7 4 11:00CEST +s -a 59.9 -o 10.7


- - -

gensky 7 4 12:00CEST +s -a 59.9 -o 10.7


- - -

gensky 7 4 13:00CEST +s -a 59.9 -o 10.7


- - -

gensky 7 4 14:00CEST +s -a 59.9 -o 10.7


- - -

gensky 7 4 15:00CEST +s -a 59.9 -o 10.7


- - -

gensky 7 4 16:00CEST +s -a 59.9 -o 10.7


- - -

gensky 7 4 17:00CEST +s -a 59.9 -o 10.7""",
    fireLogs=False,
    lastRunTime=133,
    suppressWarnings=False,
    results=["""# gensky 7 4 8:00CEST +s -a 59.9 -o 10.7
# Local solar time: 5.22
# Solar altitude and azimuth: 14.1 -111.6
# Ground ambient level: 8.8

void light solar
0
0
3 3.92e+06 3.92e+06 3.92e+06

solar source sun
0
0
4 0.901641 0.357186 0.243849 0.5

void brightfunc skyfunc
2 skybr skybright.cal
0
7 1 3.81e+00 5.41e+00 3.08e-01 0.901641 0.357186 0.243849""", """# gensky 7 4 9:00CEST +s -a 59.9 -o 10.7
# Local solar time: 6.22
# Solar altitude and azimuth: 21.4 -99.3
# Ground ambient level: 10.8

void light solar
0
0
3 5.36e+06 5.36e+06 5.36e+06

solar source sun
0
0
4 0.919246 0.149788 0.364073 0.5

void brightfunc skyfunc
2 skybr skybright.cal
0
7 1 4.88e+00 9.62e+00 3.41e-01 0.919246 0.149788 0.364073""", """# gensky 7 4 10:00CEST +s -a 59.9 -o 10.7
# Local solar time: 7.22
# Solar altitude and azimuth: 28.8 -86.4
# Ground ambient level: 12.6

void light solar
0
0
3 6.07e+06 6.07e+06 6.07e+06

solar source sun
0
0
4 0.874207 -0.054485 0.482486 0.5

void brightfunc skyfunc
2 skybr skybright.cal
0
7 1 6.11e+00 1.37e+01 3.90e-01 0.874207 -0.054485 0.482486""", """# gensky 7 4 11:00CEST +s -a 59.9 -o 10.7
# Local solar time: 8.22
# Solar altitude and azimuth: 36.2 -72.6
# Ground ambient level: 13.8

void light solar
0
0
3 6.48e+06 6.48e+06 6.48e+06

solar source sun
0
0
4 0.769592 -0.241712 0.591018 0.5

void brightfunc skyfunc
2 skybr skybright.cal
0
7 1 7.51e+00 1.74e+01 4.56e-01 0.769592 -0.241712 0.591018""", """# gensky 7 4 12:00CEST +s -a 59.9 -o 10.7
# Local solar time: 9.22
# Solar altitude and azimuth: 43.0 -56.9
# Ground ambient level: 14.6

void light solar
0
0
3 6.72e+06 6.72e+06 6.72e+06

solar source sun
0
0
4 0.612531 -0.399135 0.682273 0.5

void brightfunc skyfunc
2 skybr skybright.cal
0
7 1 9.05e+00 2.04e+01 5.41e-01 0.612531 -0.399135 0.682273""", """# gensky 7 4 13:00CEST +s -a 59.9 -o 10.7
# Local solar time: 10.22
# Solar altitude and azimuth: 48.6 -38.7
# Ground ambient level: 15.0

void light solar
0
0
3 6.86e+06 6.86e+06 6.86e+06

solar source sun
0
0
4 0.413727 -0.516025 0.750032 0.5

void brightfunc skyfunc
2 skybr skybright.cal
0
7 1 1.06e+01 2.26e+01 6.32e-01 0.413727 -0.516025 0.750032"""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],
    commands=["gensky 7 4 8:00CEST +s -a 59.9 -o 10.7", "gensky 7 4 9:00CEST +s -a 59.9 -o 10.7", "gensky 7 4 10:00CEST +s -a 59.9 -o 10.7", "gensky 7 4 11:00CEST +s -a 59.9 -o 10.7", "gensky 7 4 12:00CEST +s -a 59.9 -o 10.7", "gensky 7 4 13:00CEST +s -a 59.9 -o 10.7", "gensky 7 4 14:00CEST +s -a 59.9 -o 10.7", "gensky 7 4 15:00CEST +s -a 59.9 -o 10.7", "gensky 7 4 16:00CEST +s -a 59.9 -o 10.7", "gensky 7 4 17:00CEST +s -a 59.9 -o 10.7"])  # -> Stdout, Stderr_, Ran
panel_55 = Panel(executessh_wip_3.Stdout)
concat_4 = Concatenate(FragmentC="##Will control the gradient of the sky", FragmentA=executessh_wip_3.Stdout, FragmentB=and_append_the_ground_2)
panel_56 = Panel("""mkdir -p <proj>/skies/
echo "<sky>" > <proj>/skies/<target>
echo "<proj>/skies/<target>"
""")
overrides_14 = ApplyOverrides(Input=panel_56, Sky=graft(concat_4), Target=graft("sunny_sky_<h>.rad"), H=graft(series))  # -> Output, Pairs
python_12 = GhPythonScript(x=series)  # -> a; inputs x: Int32
# ---------- python_12: Python ----------
__author__ = "mm1013"
__version__ = "2022.08.30"

import rhinoscriptsyntax as rs

a = "%02d00" % x
# ---------- end python_12 ----------
hours = Number(python_12)
hours_2 = Text(python_12)

executessh_wip_4 = ExecuteSSHWIP(
    _SSHCommands_=overrides_14.Output,
    Run=executessh_wip_3.Ran,
    addPrefix=True,
    description="""mkdir -p <proj>/skies/
echo "##Will control the gradient of the sky
# gensky 7 4 8:00CEST +s -a 59.9 -o 10.7
# Local solar time: 5.22
# Solar altitude and azimuth: 14.1 -111.6
# Ground ambient level: 8.8

void light solar
0
0
3 3.92e+06 3.92e+06 3.92e+06

solar source sun
0
0
4 0.901641 0.357186 0.243849 0.5

void brightfunc skyfunc
2 skybr skybright.cal
0
7 1 3.81e+00 5.41e+00 3.08e-01 0.901641 0.357186 0.243849

##The 1 will be multiplie with brightfunc
skyfunc glow sky_glow
0
0
4 1 1 1 0

##Set to 1 as it will be multiplied with the gensky result
sky_glow source sky
0
0
4 0 0 1 180

##Set to 1 as it will be multiplied with the gensky result
skyfunc glow ground_glow
0
0
4 1 1 1 0

##The ground pane
ground_glow source ground
0
0
4 0 0 -1 180" > <proj>/skies/sunny_sky_8.rad
echo "<proj>/skies/sunny_sky_8.rad"


- - -

mkdir -p <proj>/skies/
echo "##Will control the gradient of the sky
# gensky 7 4 9:00CEST +s -a 59.9 -o 10.7
# Local solar time: 6.22
# Solar altitude and azimuth: 21.4 -99.3
# Ground ambient level: 10.8

void light solar
0
0
3 5.36e+06 5.36e+06 5.36e+06

solar source sun
0
0
4 0.919246 0.149788 0.364073 0.5

void brightfunc skyfunc
2 skybr skybright.cal
0
7 1 4.88e+00 9.62e+00 3.41e-01 0.919246 0.149788 0.364073

##The 1 will be multiplie with brightfunc
skyfunc glow sky_glow
0
0
4 1 1 1 0

##Set to 1 as it will be multiplied with the gensky result
sky_glow source sky
0
0
4 0 0 1 180

##Set to 1 as it will be multiplied with the gensky result
skyfunc glow ground_glow
0
0
4 1 1 1 0

##The ground pane
ground_glow source ground
0
0
4 0 0 -1 180" > <proj>/skies/sunny_sky_9.rad
echo "<proj>/skies/sunny_sky_9.rad"


- - -

mkdir -p <proj>/skies/
echo "##Will control the gradient of the sky
# gensky 7 4 10:00CEST +s -a 59.9 -o 10.7
# Local solar time: 7.22
# Solar altitude and azimuth: 28.8 -86.4
# Ground ambient level: 12.6

void light solar
0
0
3 6.07e+06 6.07e+06 6.07e+06

solar source sun
0
0
4 0.874207 -0.054485 0.482486 0.5

void brightfunc skyfunc
2 skybr skybright.cal
0
7 1 6.11e+00 1.37e+01 3.90e-01 0.874207 -0.054485 0.482486

##The 1 will be multiplie with brightfunc
skyfunc glow sky_glow
0
0
4 1 1 1 0

##Set to 1 as it will be multiplied with the gensky result
sky_glow source sky
0
0
4 0 0 1 180

##Set to 1 as it will be multiplied with the gensky result
skyfunc glow ground_glow
0
0
4 1 1 1 0

##The ground pane
ground_glow source ground
0
0
4 0 0 -1 180" > <proj>/skies/sunny_sky_10.rad
echo "<proj>/skies/sunny_sky_10.rad"


- - -

mkdir -p <proj>/skies/
echo "##Will control the gradient of the sky
# gensky 7 4 11:00CEST +s -a 59.9 -o 10.7
# Local solar time: 8.22
# Solar altitude and azimuth: 36.2 -72.6
# Ground ambient level: 13.8

void light solar
0
0
3 6.48e+06 6.48e+06 6.48e+06

solar source sun
0
0
4 0.769592 -0.241712 0.591018 0.5

void brightfunc skyfunc
2 skybr skybright.cal
0
7 1 7.51e+00 1.74e+01 4.56e-01 0.769592 -0.241712 0.591018

##The 1 will be multiplie with brightfunc
skyfunc glow sky_glow
0
0
4 1 1 1 0

##Set to 1 as it will be multiplied with the gensky result
sky_glow source sky
0
0
4 0 0 1 180

##Set to 1 as it will be multiplied with the gensky result
skyfunc glow ground_glow
0
0
4 1 1 1 0

##The ground pane
ground_glow source ground
0
0
4 0 0 -1 180" > <proj>/skies/sunny_sky_11.rad
echo "<proj>/skies/sunny_sky_11.rad"


- - -

mkdir -p <proj>/skies/
echo "##Will control the gradient of the sky
# gensky 7 4 12:00CEST +s -a 59.9 -o 10.7
# Local solar time: 9.22
# Solar altitude and azimuth: 43.0 -56.9
# Ground ambient level: 14.6

void light solar
0
0
3 6.72e+06 6.72e+06 6.72e+06

solar source sun
0
0
4 0.612531 -0.399135 0.682273 0.5

void brightfunc skyfunc
2 skybr skybright.cal
0
7 1 9.05e+00 2.04e+01 5.41e-01 0.612531 -0.399135 0.682273

##The 1 will be multiplie with brightfunc
skyfunc glow sky_glow
0
0
4 1 1 1 0

##Set to 1 as it will be multiplied with the gensky result
sky_glow source sky
0
0
4 0 0 1 180

##Set to 1 as it will be multiplied with the gensky result
skyfunc glow ground_glow
0
0
4 1 1 1 0

##The ground pane
ground_glow source ground
0
0
4 0 0 -1 180" > <proj>/skies/sunny_sky_12.rad
echo "<proj>/skies/sunny_sky_12.rad"


- - -

mkdir -p <proj>/skies/
echo "##Will control the gradient of the sky
# gensky 7 4 13:00CEST +s -a 59.9 -o 10.7
# Local solar time: 10.22
# Solar altitude and azimuth: 48.6 -38.7
# Ground ambient level: 15.0

void light solar
0
0
3 6.86e+06 6.86e+06 6.86e+06

solar source sun
0
0
4 0.413727 -0.516025 0.750032 0.5

void brightfunc skyfunc
2 skybr skybright.cal
0
7 1 1.06e+01 2.26e+01 6.32e-01 0.413727 -0.516025 0.750032

##The 1 will be multiplie with brightfunc
skyfunc glow sky_glow
0
0
4 1 1 1 0

##Set to 1 as it will be multiplied with the gensky result
sky_glow source sky
0
0
4 0 0 1 180

##Set to 1 as it will be multiplied with the gensky result
skyfunc glow ground_glow
0
0
4 1 1 1 0

##The ground pane
ground_glow source ground
0
0
4 0 0 -1 180" > <proj>/skies/sunny_sky_13.rad
echo "<proj>/skies/sunny_sky_13.rad"


- - -

mkdir -p <proj>/skies/
echo "##Will control the gradient of the sky
# gensky 7 4 14:00CEST +s -a 59.9 -o 10.7
# Local solar time: 11.22
# Solar altitude and azimuth: 52.2 -17.7
# Ground ambient level: 15.1

void light solar
0
0
3 6.93e+06 6.93e+06 6.93e+06

solar source sun
0
0
4 0.186727 -0.584417 0.789677 0.5

void brightfunc skyfunc
2 skybr skybright.cal
0
7 1 1.18e+01 2.39e+01 7.04e-01 0.186727 -0.584417 0.789677

##The 1 will be multiplie with brightfunc
skyfunc glow sky_glow
0
0
4 1 1 1 0

##Set to 1 as it will be multiplied with the gensky result
sky_glow source sky
0
0
4 0 0 1 180

##Set to 1 as it will be multiplied with the gensky result
skyfunc glow ground_glow
0
0
4 1 1 1 0

##The ground pane
ground_glow source ground
0
0
4 0 0 -1 180" > <proj>/skies/sunny_sky_14.rad
echo "<proj>/skies/sunny_sky_14.rad"


- - -

mkdir -p <proj>/skies/
echo "##Will control the gradient of the sky
# gensky 7 4 15:00CEST +s -a 59.9 -o 10.7
# Local solar time: 12.22
# Solar altitude and azimuth: 53.0 5.1
# Ground ambient level: 15.2

void light solar
0
0
3 6.94e+06 6.94e+06 6.94e+06

solar source sun
0
0
4 -0.052997 -0.599649 0.798507 0.5

void brightfunc skyfunc
2 skybr skybright.cal
0
7 1 1.21e+01 2.42e+01 7.23e-01 -0.052997 -0.599649 0.798507

##The 1 will be multiplie with brightfunc
skyfunc glow sky_glow
0
0
4 1 1 1 0

##Set to 1 as it will be multiplied with the gensky result
sky_glow source sky
0
0
4 0 0 1 180

##Set to 1 as it will be multiplied with the gensky result
skyfunc glow ground_glow
0
0
4 1 1 1 0

##The ground pane
ground_glow source ground
0
0
4 0 0 -1 180" > <proj>/skies/sunny_sky_15.rad
echo "<proj>/skies/sunny_sky_15.rad"


- - -

mkdir -p <proj>/skies/
echo "##Will control the gradient of the sky
# gensky 7 4 16:00CEST +s -a 59.9 -o 10.7
# Local solar time: 13.22
# Solar altitude and azimuth: 50.9 27.3
# Ground ambient level: 15.1

void light solar
0
0
3 6.91e+06 6.91e+06 6.91e+06

solar source sun
0
0
4 -0.289110 -0.560683 0.775919 0.5

void brightfunc skyfunc
2 skybr skybright.cal
0
7 1 1.13e+01 2.35e+01 6.77e-01 -0.289110 -0.560683 0.775919

##The 1 will be multiplie with brightfunc
skyfunc glow sky_glow
0
0
4 1 1 1 0

##Set to 1 as it will be multiplied with the gensky result
sky_glow source sky
0
0
4 0 0 1 180

##Set to 1 as it will be multiplied with the gensky result
skyfunc glow ground_glow
0
0
4 1 1 1 0

##The ground pane
ground_glow source ground
0
0
4 0 0 -1 180" > <proj>/skies/sunny_sky_16.rad
echo "<proj>/skies/sunny_sky_16.rad"


- - -

mkdir -p <proj>/skies/
echo "##Will control the gradient of the sky
# gensky 7 4 17:00CEST +s -a 59.9 -o 10.7
# Local solar time: 14.22
# Solar altitude and azimuth: 46.3 47.1
# Ground ambient level: 14.8

void light solar
0
0
3 6.81e+06 6.81e+06 6.81e+06

solar source sun
0
0
4 -0.505520 -0.470175 0.723454 0.5

void brightfunc skyfunc
2 skybr skybright.cal
0
7 1 9.93e+00 2.18e+01 5.92e-01 -0.505520 -0.470175 0.723454

##The 1 will be multiplie with brightfunc
skyfunc glow sky_glow
0
0
4 1 1 1 0

##Set to 1 as it will be multiplied with the gensky result
sky_glow source sky
0
0
4 0 0 1 180

##Set to 1 as it will be multiplied with the gensky result
skyfunc glow ground_glow
0
0
4 1 1 1 0

##The ground pane
ground_glow source ground
0
0
4 0 0 -1 180" > <proj>/skies/sunny_sky_17.rad
echo "<proj>/skies/sunny_sky_17.rad"
""",
    fireLogs=False,
    lastRunTime=153,
    suppressWarnings=False,
    results=["""_JOIN_
_JOIN_
~/MantaRay/UnnamedProject/skies/sunny_sky_8.rad""", """_JOIN_
_JOIN_
~/MantaRay/UnnamedProject/skies/sunny_sky_9.rad""", """_JOIN_
_JOIN_
~/MantaRay/UnnamedProject/skies/sunny_sky_10.rad""", """_JOIN_
_JOIN_
~/MantaRay/UnnamedProject/skies/sunny_sky_11.rad""", """_JOIN_
_JOIN_
~/MantaRay/UnnamedProject/skies/sunny_sky_12.rad""", """_JOIN_
_JOIN_
~/MantaRay/UnnamedProject/skies/sunny_sky_13.rad""", """_JOIN_
_JOIN_
~/MantaRay/UnnamedProject/skies/sunny_sky_14.rad""", """_JOIN_
_JOIN_
~/MantaRay/UnnamedProject/skies/sunny_sky_15.rad""", """_JOIN_
_JOIN_
~/MantaRay/UnnamedProject/skies/sunny_sky_16.rad""", """_JOIN_
_JOIN_
~/MantaRay/UnnamedProject/skies/sunny_sky_17.rad"""],
    commands=["""mkdir -p ~/MantaRay/UnnamedProject/skies/
_JOIN_
echo "##Will control the gradient of the sky
# gensky 7 4 8:00CEST +s -a 59.9 -o 10.7
# Local solar time: 5.22
# Solar altitude and azimuth: 14.1 -111.6
# Ground ambient level: 8.8

void light solar
0
0
3 3.92e+06 3.92e+06 3.92e+06

solar source sun
0
0
4 0.901641 0.357186 0.243849 0.5

void brightfunc skyfunc
2 skybr skybright.cal
0
7 1 3.81e+00 5.41e+00 3.08e-01 0.901641 0.357186 0.243849

##The 1 will be multiplie with brightfunc
skyfunc glow sky_glow
0
0
4 1 1 1 0

##Set to 1 as it will be multiplied with the gensky result
sky_glow source sky
0
0
4 0 0 1 180

##Set to 1 as it will be multiplied with the gensky result
skyfunc glow ground_glow
0
0
4 1 1 1 0

##The ground pane
ground_glow source ground
0
0
4 0 0 -1 180" > ~/MantaRay/UnnamedProject/skies/sunny_sky_8.rad
_JOIN_
echo "~/MantaRay/UnnamedProject/skies/sunny_sky_8.rad"
""", """mkdir -p ~/MantaRay/UnnamedProject/skies/
_JOIN_
echo "##Will control the gradient of the sky
# gensky 7 4 9:00CEST +s -a 59.9 -o 10.7
# Local solar time: 6.22
# Solar altitude and azimuth: 21.4 -99.3
# Ground ambient level: 10.8

void light solar
0
0
3 5.36e+06 5.36e+06 5.36e+06

solar source sun
0
0
4 0.919246 0.149788 0.364073 0.5

void brightfunc skyfunc
2 skybr skybright.cal
0
7 1 4.88e+00 9.62e+00 3.41e-01 0.919246 0.149788 0.364073

##The 1 will be multiplie with brightfunc
skyfunc glow sky_glow
0
0
4 1 1 1 0

##Set to 1 as it will be multiplied with the gensky result
sky_glow source sky
0
0
4 0 0 1 180

##Set to 1 as it will be multiplied with the gensky result
skyfunc glow ground_glow
0
0
4 1 1 1 0

##The ground pane
ground_glow source ground
0
0
4 0 0 -1 180" > ~/MantaRay/UnnamedProject/skies/sunny_sky_9.rad
_JOIN_
echo "~/MantaRay/UnnamedProject/skies/sunny_sky_9.rad"
""", """mkdir -p ~/MantaRay/UnnamedProject/skies/
_JOIN_
echo "##Will control the gradient of the sky
# gensky 7 4 11:00CEST +s -a 59.9 -o 10.7
# Local solar time: 8.22
# Solar altitude and azimuth: 36.2 -72.6
# Ground ambient level: 13.8

void light solar
0
0
3 6.48e+06 6.48e+06 6.48e+06

solar source sun
0
0
4 0.769592 -0.241712 0.591018 0.5

void brightfunc skyfunc
2 skybr skybright.cal
0
7 1 7.51e+00 1.74e+01 4.56e-01 0.769592 -0.241712 0.591018

##The 1 will be multiplie with brightfunc
skyfunc glow sky_glow
0
0
4 1 1 1 0

##Set to 1 as it will be multiplied with the gensky result
sky_glow source sky
0
0
4 0 0 1 180

##Set to 1 as it will be multiplied with the gensky result
skyfunc glow ground_glow
0
0
4 1 1 1 0

##The ground pane
ground_glow source ground
0
0
4 0 0 -1 180" > ~/MantaRay/UnnamedProject/skies/sunny_sky_11.rad
_JOIN_
echo "~/MantaRay/UnnamedProject/skies/sunny_sky_11.rad"
""", """mkdir -p ~/MantaRay/UnnamedProject/skies/
_JOIN_
echo "##Will control the gradient of the sky
# gensky 7 4 12:00CEST +s -a 59.9 -o 10.7
# Local solar time: 9.22
# Solar altitude and azimuth: 43.0 -56.9
# Ground ambient level: 14.6

void light solar
0
0
3 6.72e+06 6.72e+06 6.72e+06

solar source sun
0
0
4 0.612531 -0.399135 0.682273 0.5

void brightfunc skyfunc
2 skybr skybright.cal
0
7 1 9.05e+00 2.04e+01 5.41e-01 0.612531 -0.399135 0.682273

##The 1 will be multiplie with brightfunc
skyfunc glow sky_glow
0
0
4 1 1 1 0

##Set to 1 as it will be multiplied with the gensky result
sky_glow source sky
0
0
4 0 0 1 180

##Set to 1 as it will be multiplied with the gensky result
skyfunc glow ground_glow
0
0
4 1 1 1 0

##The ground pane
ground_glow source ground
0
0
4 0 0 -1 180" > ~/MantaRay/UnnamedProject/skies/sunny_sky_12.rad
_JOIN_
echo "~/MantaRay/UnnamedProject/skies/sunny_sky_12.rad"
""", """mkdir -p ~/MantaRay/UnnamedProject/skies/
_JOIN_
echo "##Will control the gradient of the sky
# gensky 7 4 13:00CEST +s -a 59.9 -o 10.7
# Local solar time: 10.22
# Solar altitude and azimuth: 48.6 -38.7
# Ground ambient level: 15.0

void light solar
0
0
3 6.86e+06 6.86e+06 6.86e+06

solar source sun
0
0
4 0.413727 -0.516025 0.750032 0.5

void brightfunc skyfunc
2 skybr skybright.cal
0
7 1 1.06e+01 2.26e+01 6.32e-01 0.413727 -0.516025 0.750032

##The 1 will be multiplie with brightfunc
skyfunc glow sky_glow
0
0
4 1 1 1 0

##Set to 1 as it will be multiplied with the gensky result
sky_glow source sky
0
0
4 0 0 1 180

##Set to 1 as it will be multiplied with the gensky result
skyfunc glow ground_glow
0
0
4 1 1 1 0

##The ground pane
ground_glow source ground
0
0
4 0 0 -1 180" > ~/MantaRay/UnnamedProject/skies/sunny_sky_13.rad
_JOIN_
echo "~/MantaRay/UnnamedProject/skies/sunny_sky_13.rad"
""", """mkdir -p ~/MantaRay/UnnamedProject/skies/
_JOIN_
echo "##Will control the gradient of the sky
# gensky 7 4 15:00CEST +s -a 59.9 -o 10.7
# Local solar time: 12.22
# Solar altitude and azimuth: 53.0 5.1
# Ground ambient level: 15.2

void light solar
0
0
3 6.94e+06 6.94e+06 6.94e+06

solar source sun
0
0
4 -0.052997 -0.599649 0.798507 0.5

void brightfunc skyfunc
2 skybr skybright.cal
0
7 1 1.21e+01 2.42e+01 7.23e-01 -0.052997 -0.599649 0.798507

##The 1 will be multiplie with brightfunc
skyfunc glow sky_glow
0
0
4 1 1 1 0

##Set to 1 as it will be multiplied with the gensky result
sky_glow source sky
0
0
4 0 0 1 180

##Set to 1 as it will be multiplied with the gensky result
skyfunc glow ground_glow
0
0
4 1 1 1 0

##The ground pane
ground_glow source ground
0
0
4 0 0 -1 180" > ~/MantaRay/UnnamedProject/skies/sunny_sky_15.rad
_JOIN_
echo "~/MantaRay/UnnamedProject/skies/sunny_sky_15.rad"
"""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])  # -> Stdout, Stderr_, Ran

item_3 = ListItem(List=executessh_wip_4.Stdout, Index=0, Wrap=True)  # -> Item1, Item

# ----
# OCTREE (Sunny - 10 hourly skies!)
scene_rads_2 = Text(entwine)
falsestart_8 = LBFalseStartToggle(False)
python_13 = GhPythonScript(x=flatten(scene_rads_2))  # -> a; inputs x: list; same code as python_11
entwine_5 = Entwine(Branch02=scene_rads_2, FlattenInputs=True)  # -> flatten(Radfiles)
panel_57 = Panel("""mkdir -p <proj>/octrees/
oconv -r 2048 -f -w <rads> > <proj>/octrees/<target>
echo <proj>/octrees/<target>""")
and_2 = GateAnd(A=python_13, B=falsestart_8)
join_4 = TextJoin(Text=entwine_5, Join=" ")
panel_58 = Panel("oconv -r 2048 -i <oldOct> -f <newRads> > <proj>/octrees/<target>_<h>.oct;echo <proj>/octrees/<target>_<h>.oct")
overrides_15 = ApplyOverrides(Input=panel_57, Rads=graft(join_4), Target=graft("my_test_scene_NOSKY.oct"))  # -> Output, Pairs
sky_sunny = Text(graft(item_3.Item1))
executessh_wip_5 = ExecuteSSHWIP(
    _SSHCommands_=overrides_15.Output,
    Run=and_2,
    addPrefix=True,
    description="""mkdir -p ~/MantaRay/UnnamedProject/octrees/
oconv -r 2048 -f -w ~/MantaRay/UnnamedProject/radFiles/Glass_70_mat.mat ~/MantaRay/UnnamedProject/radFiles/Glass_70.rad ~/MantaRay/UnnamedProject/radFiles/opaque_materials.mat ~/MantaRay/UnnamedProject/radFiles/CurvedCeiling_0.80.rad ~/MantaRay/UnnamedProject/radFiles/ConcreteGrey_0.5.rad ~/MantaRay/UnnamedProject/radFiles/ConcreteDarker_0.1.rad ~/MantaRay/UnnamedProject/radFiles/Cladding_0.5.rad ~/MantaRay/UnnamedProject/radFiles/ConcreteStructure_0.3.rad ~/MantaRay/UnnamedProject/radFiles/Black_0.01.rad ~/MantaRay/UnnamedProject/radFiles/Floor_FloorMat_0.7.rad ~/MantaRay/UnnamedProject/radFiles/ConcreteWhite_0.8.rad ~/MantaRay/UnnamedProject/radFiles/IntWalls_0.9.rad ~/MantaRay/UnnamedProject/radFiles/IntWalls_0.80.rad ~/MantaRay/UnnamedProject/radFiles/Pipes_0.03.rad ~/MantaRay/UnnamedProject/radFiles/FloorBox_0.75.rad ~/MantaRay/UnnamedProject/radFiles/Frames_0.6.rad > ~/MantaRay/UnnamedProject/octrees/my_test_scene_NOSKY.oct
echo ~/MantaRay/UnnamedProject/octrees/my_test_scene_NOSKY.oct""",
    fireLogs=False,
    lastRunTime=1121,
    suppressWarnings=False,
    results="/home/mss/MantaRay/UnnamedProject/octrees/my_test_scene_NOSKY.oct",
    commands="""mkdir -p ~/MantaRay/UnnamedProject/octrees/
oconv -r 2048 -f -w ~/MantaRay/UnnamedProject/radFiles/opaque_materials.mat ~/MantaRay/UnnamedProject/radFiles/Terrain_20.rad ~/MantaRay/UnnamedProject/radFiles/Buildings_50.rad > ~/MantaRay/UnnamedProject/octrees/my_test_scene_NOSKY.oct
echo ~/MantaRay/UnnamedProject/octrees/my_test_scene_NOSKY.oct""")  # -> Stdout, Stderr_, Ran
hours_3 = Text(hours_2)
overrides_16 = ApplyOverrides(
    Input_=panel_58,
    OldOct=graft(executessh_wip_5.Stdout),
    NewRads=graft(sky_sunny),
    Target=graft("my_test_scene"),
    H=graft(hours_3))  # -> Output, Pairs
convertpaths_3 = ConvertPaths(I=executessh_wip_5.Stdout)  # -> Linux, Windows
panel_59 = Panel(executessh_wip_5.Stdout)
panel_60 = Panel(convertpaths_3.Windows)
executessh_10 = ExecuteSSH(
    _SSHCommands_=overrides_16.Output,
    Run=executessh_wip_5.Ran,
    addPrefix=True,
    description="""oconv -r 2048 -i /home/mss/MantaRay/UnnamedProject/octrees/my_test_scene_NOSKY.oct -f ~/MantaRay/UnnamedProject/skies/sunny_sky_8.rad > ~/MantaRay/UnnamedProject/octrees/my_test_scene_0800.oct;echo ~/MantaRay/UnnamedProject/octrees/my_test_scene_0800.oct


- - -

oconv -r 2048 -i /home/mss/MantaRay/UnnamedProject/octrees/my_test_scene_NOSKY.oct -f ~/MantaRay/UnnamedProject/skies/sunny_sky_9.rad > ~/MantaRay/UnnamedProject/octrees/my_test_scene_0900.oct;echo ~/MantaRay/UnnamedProject/octrees/my_test_scene_0900.oct


- - -

oconv -r 2048 -i /home/mss/MantaRay/UnnamedProject/octrees/my_test_scene_NOSKY.oct -f ~/MantaRay/UnnamedProject/skies/sunny_sky_10.rad > ~/MantaRay/UnnamedProject/octrees/my_test_scene_1000.oct;echo ~/MantaRay/UnnamedProject/octrees/my_test_scene_1000.oct


- - -

oconv -r 2048 -i /home/mss/MantaRay/UnnamedProject/octrees/my_test_scene_NOSKY.oct -f ~/MantaRay/UnnamedProject/skies/sunny_sky_11.rad > ~/MantaRay/UnnamedProject/octrees/my_test_scene_1100.oct;echo ~/MantaRay/UnnamedProject/octrees/my_test_scene_1100.oct


- - -

oconv -r 2048 -i /home/mss/MantaRay/UnnamedProject/octrees/my_test_scene_NOSKY.oct -f ~/MantaRay/UnnamedProject/skies/sunny_sky_12.rad > ~/MantaRay/UnnamedProject/octrees/my_test_scene_1200.oct;echo ~/MantaRay/UnnamedProject/octrees/my_test_scene_1200.oct


- - -

oconv -r 2048 -i /home/mss/MantaRay/UnnamedProject/octrees/my_test_scene_NOSKY.oct -f ~/MantaRay/UnnamedProject/skies/sunny_sky_13.rad > ~/MantaRay/UnnamedProject/octrees/my_test_scene_1300.oct;echo ~/MantaRay/UnnamedProject/octrees/my_test_scene_1300.oct


- - -

oconv -r 2048 -i /home/mss/MantaRay/UnnamedProject/octrees/my_test_scene_NOSKY.oct -f ~/MantaRay/UnnamedProject/skies/sunny_sky_14.rad > ~/MantaRay/UnnamedProject/octrees/my_test_scene_1400.oct;echo ~/MantaRay/UnnamedProject/octrees/my_test_scene_1400.oct


- - -

oconv -r 2048 -i /home/mss/MantaRay/UnnamedProject/octrees/my_test_scene_NOSKY.oct -f ~/MantaRay/UnnamedProject/skies/sunny_sky_15.rad > ~/MantaRay/UnnamedProject/octrees/my_test_scene_1500.oct;echo ~/MantaRay/UnnamedProject/octrees/my_test_scene_1500.oct


- - -

oconv -r 2048 -i /home/mss/MantaRay/UnnamedProject/octrees/my_test_scene_NOSKY.oct -f ~/MantaRay/UnnamedProject/skies/sunny_sky_16.rad > ~/MantaRay/UnnamedProject/octrees/my_test_scene_1600.oct;echo ~/MantaRay/UnnamedProject/octrees/my_test_scene_1600.oct


- - -

oconv -r 2048 -i /home/mss/MantaRay/UnnamedProject/octrees/my_test_scene_NOSKY.oct -f ~/MantaRay/UnnamedProject/skies/sunny_sky_17.rad > ~/MantaRay/UnnamedProject/octrees/my_test_scene_1700.oct;echo ~/MantaRay/UnnamedProject/octrees/my_test_scene_1700.oct""",
    fireLogs=False,
    lastRunTime=621,
    suppressWarnings=False,
    results=["/home/mss/MantaRay/UnnamedProject/octrees/my_test_scene_0800.oct", "/home/mss/MantaRay/UnnamedProject/octrees/my_test_scene_0900.oct", "/home/mss/MantaRay/UnnamedProject/octrees/my_test_scene_1000.oct", "/home/mss/MantaRay/UnnamedProject/octrees/my_test_scene_1100.oct", "/home/mss/MantaRay/UnnamedProject/octrees/my_test_scene_1200.oct", "/home/mss/MantaRay/UnnamedProject/octrees/my_test_scene_1300.oct", "/home/mss/MantaRay/UnnamedProject/octrees/my_test_scene_1400.oct", "/home/mss/MantaRay/UnnamedProject/octrees/my_test_scene_1500.oct", "/home/mss/MantaRay/UnnamedProject/octrees/my_test_scene_1600.oct", "/home/mss/MantaRay/UnnamedProject/octrees/my_test_scene_1700.oct"],
    commands=["oconv -r 2048 -i /home/mss/MantaRay/UnnamedProject/octrees/my_test_scene_NOSKY.oct -f ~/MantaRay/UnnamedProject/skies/sunny_sky_8.rad > ~/MantaRay/UnnamedProject/octrees/my_test_scene_0800.oct;echo ~/MantaRay/UnnamedProject/octrees/my_test_scene_0800.oct", "oconv -r 2048 -i /home/mss/MantaRay/UnnamedProject/octrees/my_test_scene_NOSKY.oct -f ~/MantaRay/UnnamedProject/skies/sunny_sky_11.rad > ~/MantaRay/UnnamedProject/octrees/my_test_scene_1100.oct;echo ~/MantaRay/UnnamedProject/octrees/my_test_scene_1100.oct", "oconv -r 2048 -i /home/mss/MantaRay/UnnamedProject/octrees/my_test_scene_NOSKY.oct -f ~/MantaRay/UnnamedProject/skies/sunny_sky_9.rad > ~/MantaRay/UnnamedProject/octrees/my_test_scene_0900.oct;echo ~/MantaRay/UnnamedProject/octrees/my_test_scene_0900.oct", "oconv -r 2048 -i /home/mss/MantaRay/UnnamedProject/octrees/my_test_scene_NOSKY.oct -f ~/MantaRay/UnnamedProject/skies/sunny_sky_10.rad > ~/MantaRay/UnnamedProject/octrees/my_test_scene_1000.oct;echo ~/MantaRay/UnnamedProject/octrees/my_test_scene_1000.oct", "oconv -r 2048 -i /home/mss/MantaRay/UnnamedProject/octrees/my_test_scene_NOSKY.oct -f ~/MantaRay/UnnamedProject/skies/sunny_sky_13.rad > ~/MantaRay/UnnamedProject/octrees/my_test_scene_1300.oct;echo ~/MantaRay/UnnamedProject/octrees/my_test_scene_1300.oct", "oconv -r 2048 -i /home/mss/MantaRay/UnnamedProject/octrees/my_test_scene_NOSKY.oct -f ~/MantaRay/UnnamedProject/skies/sunny_sky_12.rad > ~/MantaRay/UnnamedProject/octrees/my_test_scene_1200.oct;echo ~/MantaRay/UnnamedProject/octrees/my_test_scene_1200.oct", "oconv -r 2048 -i /home/mss/MantaRay/UnnamedProject/octrees/my_test_scene_NOSKY.oct -f ~/MantaRay/UnnamedProject/skies/sunny_sky_15.rad > ~/MantaRay/UnnamedProject/octrees/my_test_scene_1500.oct;echo ~/MantaRay/UnnamedProject/octrees/my_test_scene_1500.oct", "oconv -r 2048 -i /home/mss/MantaRay/UnnamedProject/octrees/my_test_scene_NOSKY.oct -f ~/MantaRay/UnnamedProject/skies/sunny_sky_16.rad > ~/MantaRay/UnnamedProject/octrees/my_test_scene_1600.oct;echo ~/MantaRay/UnnamedProject/octrees/my_test_scene_1600.oct", "oconv -r 2048 -i /home/mss/MantaRay/UnnamedProject/octrees/my_test_scene_NOSKY.oct -f ~/MantaRay/UnnamedProject/skies/sunny_sky_14.rad > ~/MantaRay/UnnamedProject/octrees/my_test_scene_1400.oct;echo ~/MantaRay/UnnamedProject/octrees/my_test_scene_1400.oct", "oconv -r 2048 -i /home/mss/MantaRay/UnnamedProject/octrees/my_test_scene_NOSKY.oct -f ~/MantaRay/UnnamedProject/skies/sunny_sky_17.rad > ~/MantaRay/UnnamedProject/octrees/my_test_scene_1700.oct;echo ~/MantaRay/UnnamedProject/octrees/my_test_scene_1700.oct"])  # -> Stdout, Stderr_, Ran

overrides_17 = ApplyOverrides(Input="head <target>", Target=graft(item_3.Item1))  # -> Output, Pairs

executessh_wip_6 = ExecuteSSHWIP(
    _SSHCommands_=overrides_17.Output,
    Run=executessh_wip_4.Ran,
    addPrefix=True,
    description="""head ~/MantaRay/UnnamedProject/skies/sunny_sky_8.rad


- - -

head ~/MantaRay/UnnamedProject/skies/sunny_sky_9.rad


- - -

head ~/MantaRay/UnnamedProject/skies/sunny_sky_10.rad


- - -

head ~/MantaRay/UnnamedProject/skies/sunny_sky_11.rad


- - -

head ~/MantaRay/UnnamedProject/skies/sunny_sky_12.rad


- - -

head ~/MantaRay/UnnamedProject/skies/sunny_sky_13.rad


- - -

head ~/MantaRay/UnnamedProject/skies/sunny_sky_14.rad


- - -

head ~/MantaRay/UnnamedProject/skies/sunny_sky_15.rad


- - -

head ~/MantaRay/UnnamedProject/skies/sunny_sky_16.rad


- - -

head ~/MantaRay/UnnamedProject/skies/sunny_sky_17.rad""",
    fireLogs=False,
    lastRunTime=209,
    suppressWarnings=False,
    results=["""##Will control the gradient of the sky
# gensky 7 4 8:00CEST +s -a 59.9 -o 10.7
# Local solar time: 5.22
# Solar altitude and azimuth: 14.1 -111.6
# Ground ambient level: 8.8

void light solar
0
0
3 3.92e+06 3.92e+06 3.92e+06""", """##Will control the gradient of the sky
# gensky 7 4 9:00CEST +s -a 59.9 -o 10.7
# Local solar time: 6.22
# Solar altitude and azimuth: 21.4 -99.3
# Ground ambient level: 10.8

void light solar
0
0
3 5.36e+06 5.36e+06 5.36e+06""", """##Will control the gradient of the sky
# gensky 7 4 10:00CEST +s -a 59.9 -o 10.7
# Local solar time: 7.22
# Solar altitude and azimuth: 28.8 -86.4
# Ground ambient level: 12.6

void light solar
0
0
3 6.07e+06 6.07e+06 6.07e+06""", """##Will control the gradient of the sky
# gensky 7 4 11:00CEST +s -a 59.9 -o 10.7
# Local solar time: 8.22
# Solar altitude and azimuth: 36.2 -72.6
# Ground ambient level: 13.8

void light solar
0
0
3 6.48e+06 6.48e+06 6.48e+06""", """##Will control the gradient of the sky
# gensky 7 4 12:00CEST +s -a 59.9 -o 10.7
# Local solar time: 9.22
# Solar altitude and azimuth: 43.0 -56.9
# Ground ambient level: 14.6

void light solar
0
0
3 6.72e+06 6.72e+06 6.72e+06""", """##Will control the gradient of the sky
# gensky 7 4 13:00CEST +s -a 59.9 -o 10.7
# Local solar time: 10.22
# Solar altitude and azimuth: 48.6 -38.7
# Ground ambient level: 15.0

void light solar
0
0
3 6.86e+06 6.86e+06 6.86e+06""", """##Will control the gradient of the sky
# gensky 7 4 14:00CEST +s -a 59.9 -o 10.7
# Local solar time: 11.22
# Solar altitude and azimuth: 52.2 -17.7
# Ground ambient level: 15.1

void light solar
0
0
3 6.93e+06 6.93e+06 6.93e+06""", """##Will control the gradient of the sky
# gensky 7 4 15:00CEST +s -a 59.9 -o 10.7
# Local solar time: 12.22
# Solar altitude and azimuth: 53.0 5.1
# Ground ambient level: 15.2

void light solar
0
0
3 6.94e+06 6.94e+06 6.94e+06""", """##Will control the gradient of the sky
# gensky 7 4 16:00CEST +s -a 59.9 -o 10.7
# Local solar time: 13.22
# Solar altitude and azimuth: 50.9 27.3
# Ground ambient level: 15.1

void light solar
0
0
3 6.91e+06 6.91e+06 6.91e+06""", """##Will control the gradient of the sky
# gensky 7 4 17:00CEST +s -a 59.9 -o 10.7
# Local solar time: 14.22
# Solar altitude and azimuth: 46.3 47.1
# Ground ambient level: 14.8

void light solar
0
0
3 6.81e+06 6.81e+06 6.81e+06"""],
    commands=["head ~/MantaRay/UnnamedProject/skies/sunny_sky_9.rad", "head ~/MantaRay/UnnamedProject/skies/sunny_sky_13.rad", "head ~/MantaRay/UnnamedProject/skies/sunny_sky_10.rad", "head ~/MantaRay/UnnamedProject/skies/sunny_sky_14.rad", "head ~/MantaRay/UnnamedProject/skies/sunny_sky_15.rad", "head ~/MantaRay/UnnamedProject/skies/sunny_sky_17.rad", "head ~/MantaRay/UnnamedProject/skies/sunny_sky_16.rad"])  # -> Stdout, Stderr_, Ran

panel_61 = Panel(executessh_wip_6.Stdout)

panel_62 = Panel("""mkdir -p <proj>/views/
echo "<vf>" > <proj>/views/<target>.vf
echo <proj>/views/<target>.vf""")
concat_5 = Concatenate(FragmentA="Perspective", FragmentB="1")

# ----
# Doubleclick Me To update view
view = CreateView(Viewport="Perspective")  # -> ViewfileContent, ImageRatio

panel_63 = Panel(view.ViewfileContent)
vf = Text(view.ViewfileContent)
overrides_18 = ApplyOverrides(Input=panel_62, Vf=graft(vf), Target=graft(concat_5))  # -> Output, DynamicOutput
executessh_11 = ExecuteSSH(
    _SSHCommands_=overrides_18.DynamicOutput,
    Run=Toggle(True),
    addPrefix=True,
    description="""mkdir -p ~/MantaRay/UnnamedProject/views/
echo "rvu -vtv -vp 70.3649228339276 14.9259793913805 1.78853978695151 -vd 0.317763786063118 0.921962886394164 0.221383405833804 -vu -0.0721375902336246 -0.20930069386856 0.975186847543293 -vh 91.058 -vv 50.000" > ~/MantaRay/UnnamedProject/views/Perspective1.vf
echo ~/MantaRay/UnnamedProject/views/Perspective1.vf""",
    fireLogs=False,
    lastRunTime=14.3156,
    suppressWarnings=False,
    results="/home/mss/MantaRay/UnnamedProject/views/Perspective1.vf",
    commands="""mkdir -p ~/MantaRay/UnnamedProject/views/
echo "rvu -vtv -vp 70.3649228339276 14.9259793913805 1.78853978695151 -vd 0.317763786063118 0.921962886394164 0.221383405833804 -vu -0.0721375902336246 -0.20930069386856 0.975186847543293 -vh 91.058 -vv 50.000" > ~/MantaRay/UnnamedProject/views/Perspective1.vf
echo ~/MantaRay/UnnamedProject/views/Perspective1.vf""")  # -> Stdout, Stderr_, Ran

# ----
# VIEW
file_exists = Panel("[ -f <out> ] && echo \"1\" || echo \"0\"")
item_4 = ListItem(List=flatten(executessh_11.Stdout), Index=0, Wrap=True)
panel_64 = Panel(executessh_11.Stdout)
overrides_19 = ApplyOverrides(Input=file_exists, Out=graft(item_4))  # -> Output, DynamicOutput
executessh_12 = ExecuteSSH(
    _SSHCommands_=overrides_19.DynamicOutput,
    Run=executessh_9.Ran,
    addPrefix=True,
    description="[ -f /home/mss/MantaRay/UnnamedProject/views/Perspective1.vf ] && echo \"1\" || echo \"0\"",
    fireLogs=False,
    lastRunTime=13.5382,
    suppressWarnings=False,
    results="1",
    commands="[ -f /home/mss/MantaRay/UnnamedProject/views/Perspective1.vf ] && echo \"1\" || echo \"0\"")  # -> Stdout, Stderr_, Ran

# ----
# Parallel ACCELERAD RTRACE render
# echo "rvu -vtv -vp 0.5 4.5 1.6 -vd 0.830824 -1.13002 -0.181063 -vu 0 0 1 -vh 98.2132 -vv 79.2785 -vo 0 -va 0 -vs 0 -vl 0" > <proj>/views/myview.vf;echo <proj>/views/myview.vf
run = LBFalseStartToggle(False)
octree = Text(executessh_9.Stdout)
viewfile = Text(executessh_11.Stdout)
panel_65 = Panel("""mkdir -p <proj>/images/
vwrays -ff -x <x> -y <y> -vf <vf> -pa 1 | accelerad_rtrace <radOptions> -w `vwrays -d -ff -x <x> -y <y> -vf <vf> -pa 1` -ffc <oct> > <proj>/images/<target-.>.hdr
echo <proj>/images/<target-.>.hdr""")
overrides_20 = ApplyOverrides(
    Input=panel_65,
    X=graft("600"),
    Y=graft("300"),
    Vf=graft(viewfile),
    RadOptions=graft("-as 0 -ab 3 -aa 0.2 -ad 128"),
    Oct=graft(octree),
    Target=graft("accelerad_rtrace_rendering.png"),
    Af=graft("ambfile2_<time>.af"))  # -> Output, DynamicOutput
executessh_13 = ExecuteSSH(
    _SSHCommands_=overrides_20.DynamicOutput,
    Run=run,
    addPrefix=True,
    description="""mkdir -p ~/MantaRay/UnnamedProject/images/
vwrays -ff -x 600 -y 300 -vf /home/mss/MantaRay/UnnamedProject/views/Perspective1.vf -pa 1 | accelerad_rtrace -as 0 -ab 3 -aa 0.2 -ad 128 -w `vwrays -d -ff -x 600 -y 300 -vf /home/mss/MantaRay/UnnamedProject/views/Perspective1.vf -pa 1` -ffc /home/mss/MantaRay/UnnamedProject/octrees/my_test_scene.oct > ~/MantaRay/UnnamedProject/images/accelerad_rtrace_rendering.hdr
echo ~/MantaRay/UnnamedProject/images/accelerad_rtrace_rendering.hdr""",
    fireLogs=False,
    lastRunTime=535,
    suppressWarnings=False,
    results="/home/mss/simulation/Boston_Skylights/images/accelerad_rtrace_rendering.hdr",
    stderr="""accelerad_rtrace: internal - A supported NVIDIA GPU could not be found
(/media/nathaniel/DATA/Accelerad/src/rt/optix_radiance.c:255)""",
    commands="""mkdir -p ~/simulation/Boston_Skylights/images/
vwrays -ff -x 600 -y 300 -vf /home/mss/MantaRay/UnnamedProject/views/Perspective1.vf -pa 1 | accelerad_rtrace -as 0 -ab 3 -aa 0.2 -ad 128 -w `vwrays -d -ff -x 600 -y 300 -vf /home/mss/MantaRay/UnnamedProject/views/Perspective1.vf -pa 1` -ffc /home/mss/MantaRay/UnnamedProject/octrees/my_test_scene.oct > ~/simulation/Boston_Skylights/images/accelerad_rtrace_rendering.hdr
echo ~/simulation/Boston_Skylights/images/accelerad_rtrace_rendering.hdr""")  # -> Stdout, Stderr_, Ran

# ----
# rpict RENDER
# single core render, using normtiff to set
# exposure and convert to png
# -ps 8 -pt 0.15 -pj 0.6 -dj 0 -ds 0.5 -dt 0.5 -dc 0.25 -dr 0 -dp 64 -st 0.85 -ab 2 -ad 512 -as 128 -ar 16 -aa 0.250 -lr 4 -lw 0.050 -av 0 0 0
panel_66 = Panel("""mkdir -p <proj>/images/
rpict -t 10 -vf <vf> -x <x> -y <y> <radPar> <octree> > <proj>/images/<target-.>_<vn>.hdr
normtiff <proj>/images/<target-.>_<vn>.hdr <proj>/images/<target-.>_<vn>.tif
convert <proj>/images/<target-.>_<vn>.tif <proj>/images/<target-.>_<vn>.png
echo <proj>/images/<target-.>_<vn>.png""")  # disabled
viewfiles = Text(executessh_11.Stdout)  # disabled
panel_67 = Panel("rpict_render")  # disabled
octree_2 = Text(executessh_9.Stdout)  # disabled
python_14 = GhPythonScript(viewfile=viewfiles)  # -> viewname; disabled
# ---------- python_14: Python ----------
__author__ = "mm1013"
__version__ = "2022.07.09"

import rhinoscriptsyntax as rs

viewname = viewfile.split("/")[-1].split(".")[0]
# ---------- end python_14 ----------
falsestart_9 = LBFalseStartToggle(False)  # disabled
panel_68 = Panel("-ab 1 -ad 2048 -ar 128 -as 512 -aa 0.12 -lw 5e-2")  # disabled
panel_69 = Panel("600")  # disabled
panel_70 = Panel("500")  # disabled
and_3 = GateAnd(A=executessh_9.Ran, B=executessh_12.Stdout, C=falsestart_9)  # disabled
overrides_21 = ApplyOverrides(
    Input=panel_66,
    Vf=graft(viewfiles),
    X=graft(panel_69),
    Y=graft(panel_70),
    RadPar=graft(panel_68),
    Octree=graft(octree_2),
    Target=graft(panel_67),
    Vn=graft(python_14))  # -> Output, Pairs; disabled
execute_ssh_async_2 = ExecuteSSHAsync(
    _SSHCommands_=overrides_21.Output,
    Run=falsestart_9,
    addPrefix=True,
    addSuffix=True,
    description="""mkdir -p ~/simulation/boston/images/
rpict -t 10 -vf /home/mss/simulation/boston/views/Perspective.vf -x 600 -y 500 -ab 1 -ad 2048 -ar 128 -as 512 -aa 0.12 -lw 5e-2 /home/mss/simulation/boston/octrees/my_test_scene.oct > ~/simulation/boston/images/_Perspective.hdr
normtiff ~/simulation/boston/images/_Perspective.hdr ~/simulation/boston/images/_Perspective.tif
convert ~/simulation/boston/images/_Perspective.tif ~/simulation/boston/images/_Perspective.png
echo ~/simulation/boston/images/_Perspective.png""",
    fireLogs=False,
    stdouts="/home/mss/simulation/boston/images/_Perspective.png",
    suppressWarnings=False)  # -> Stdout, Stderr_, port, port_2, Ran; disabled
convertpaths_4 = ConvertPaths(I=execute_ssh_async_2.Stdout)  # -> Linux, Windows; disabled
imageviewer_2 = LBImageViewer(ImagePath_=convertpaths_4.Windows, _scale_=1, DisableClickable=False, SaveImgWithCoords=False, scale=1)  # -> ImagePath, Values, GIF; disabled

# ----
# Parallel RTPICT render (luminance)
viewfile_2 = Text(executessh_11.Stdout)
octree_3 = Text(executessh_10.Stdout)
resolution_3 = ValueList({"750x330": 750, "1500x750": 1500, "3000x1500": 3000, "5000x2500": 5000, "7000x3500": 7000, "8000x4000": 8000}, selected="1500x750")
panel_71 = Panel("""mkdir -p <proj>/images/
rtpict -n 11 -vf <vf> -x <x> -y <y> -o <proj>/images/<target> <radOptions> <oct>;echo <proj>/images/<target>""")
division = Division(A=resolution_3, B=2)
run_2 = LBFalseStartToggle(False)
python_15 = GhPythonScript(update=run_2)  # -> time; inputs update: tree
# ---------- python_15: Python ----------
__author__ = "mm1013"
__version__ = "2022.08.30"

import rhinoscriptsyntax as rs

from datetime import datetime
dt = datetime.now()

time = "%02d_%02d_%02d_%02d%02d" % (dt.year, dt.month, dt.day, dt.hour, dt.minute)
# ---------- end python_15 ----------
hours_4 = Number(hours)
overrides_22 = ApplyOverrides(
    Input=panel_71,
    RadOptions=graft("-ab 3 -ad 32 -aa 0"),
    X=graft(resolution_3),
    Y=graft(division),
    Vf=graft(viewfile_2),
    Oct=graft(octree_3),
    Target=graft("<time>_rtpict_rendering_aa0_<x>_sunny_ad32_<h>.hdr"),
    Time=graft(python_15),
    H=graft(hours_4))  # -> Output, Pairs
executessh_14 = ExecuteSSH(
    _SSHCommands_=flatten(overrides_22.Output),
    Run=run_2,
    addPrefix=True,
    description="""mkdir -p ~/MantaRay/UnnamedProject/images/
rtpict -n 11 -vf /home/mss/MantaRay/UnnamedProject/views/Perspective1.vf -x 1500 -y 750 -o ~/MantaRay/UnnamedProject/images/2022_09_28_2126_rtpict_rendering_aa0_1500_sunny_ad32_800.hdr -ab 3 -ad 32 -aa 0 /home/mss/MantaRay/UnnamedProject/octrees/my_test_scene_0800.oct;echo ~/MantaRay/UnnamedProject/images/2022_09_28_2126_rtpict_rendering_aa0_1500_sunny_ad32_800.hdr
mkdir -p ~/MantaRay/UnnamedProject/images/
rtpict -n 11 -vf /home/mss/MantaRay/UnnamedProject/views/Perspective1.vf -x 1500 -y 750 -o ~/MantaRay/UnnamedProject/images/2022_09_28_2126_rtpict_rendering_aa0_1500_sunny_ad32_900.hdr -ab 3 -ad 32 -aa 0 /home/mss/MantaRay/UnnamedProject/octrees/my_test_scene_0900.oct;echo ~/MantaRay/UnnamedProject/images/2022_09_28_2126_rtpict_rendering_aa0_1500_sunny_ad32_900.hdr
mkdir -p ~/MantaRay/UnnamedProject/images/
rtpict -n 11 -vf /home/mss/MantaRay/UnnamedProject/views/Perspective1.vf -x 1500 -y 750 -o ~/MantaRay/UnnamedProject/images/2022_09_28_2126_rtpict_rendering_aa0_1500_sunny_ad32_1000.hdr -ab 3 -ad 32 -aa 0 /home/mss/MantaRay/UnnamedProject/octrees/my_test_scene_1000.oct;echo ~/MantaRay/UnnamedProject/images/2022_09_28_2126_rtpict_rendering_aa0_1500_sunny_ad32_1000.hdr
mkdir -p ~/MantaRay/UnnamedProject/images/
rtpict -n 11 -vf /home/mss/MantaRay/UnnamedProject/views/Perspective1.vf -x 1500 -y 750 -o ~/MantaRay/UnnamedProject/images/2022_09_28_2126_rtpict_rendering_aa0_1500_sunny_ad32_1100.hdr -ab 3 -ad 32 -aa 0 /home/mss/MantaRay/UnnamedProject/octrees/my_test_scene_1100.oct;echo ~/MantaRay/UnnamedProject/images/2022_09_28_2126_rtpict_rendering_aa0_1500_sunny_ad32_1100.hdr
mkdir -p ~/MantaRay/UnnamedProject/images/
rtpict -n 11 -vf /home/mss/MantaRay/UnnamedProject/views/Perspective1.vf -x 1500 -y 750 -o ~/MantaRay/UnnamedProject/images/2022_09_28_2126_rtpict_rendering_aa0_1500_sunny_ad32_1200.hdr -ab 3 -ad 32 -aa 0 /home/mss/MantaRay/UnnamedProject/octrees/my_test_scene_1200.oct;echo ~/MantaRay/UnnamedProject/images/2022_09_28_2126_rtpict_rendering_aa0_1500_sunny_ad32_1200.hdr
mkdir -p ~/MantaRay/UnnamedProject/images/
rtpict -n 11 -vf /home/mss/MantaRay/UnnamedProject/views/Perspective1.vf -x 1500 -y 750 -o ~/MantaRay/UnnamedProject/images/2022_09_28_2126_rtpict_rendering_aa0_1500_sunny_ad32_1300.hdr -ab 3 -ad 32 -aa 0 /home/mss/MantaRay/UnnamedProject/octrees/my_test_scene_1300.oct;echo ~/MantaRay/UnnamedProject/images/2022_09_28_2126_rtpict_rendering_aa0_1500_sunny_ad32_1300.hdr
mkdir -p ~/MantaRay/UnnamedProject/images/
rtpict -n 11 -vf /home/mss/MantaRay/UnnamedProject/views/Perspective1.vf -x 1500 -y 750 -o ~/MantaRay/UnnamedProject/images/2022_09_28_2126_rtpict_rendering_aa0_1500_sunny_ad32_1400.hdr -ab 3 -ad 32 -aa 0 /home/mss/MantaRay/UnnamedProject/octrees/my_test_scene_1400.oct;echo ~/MantaRay/UnnamedProject/images/2022_09_28_2126_rtpict_rendering_aa0_1500_sunny_ad32_1400.hdr
mkdir -p ~/MantaRay/UnnamedProject/images/
rtpict -n 11 -vf /home/mss/MantaRay/UnnamedProject/views/Perspective1.vf -x 1500 -y 750 -o ~/MantaRay/UnnamedProject/images/2022_09_28_2126_rtpict_rendering_aa0_1500_sunny_ad32_1500.hdr -ab 3 -ad 32 -aa 0 /home/mss/MantaRay/UnnamedProject/octrees/my_test_scene_1500.oct;echo ~/MantaRay/UnnamedProject/images/2022_09_28_2126_rtpict_rendering_aa0_1500_sunny_ad32_1500.hdr
mkdir -p ~/MantaRay/UnnamedProject/images/
rtpict -n 11 -vf /home/mss/MantaRay/UnnamedProject/views/Perspective1.vf -x 1500 -y 750 -o ~/MantaRay/UnnamedProject/images/2022_09_28_2126_rtpict_rendering_aa0_1500_sunny_ad32_1600.hdr -ab 3 -ad 32 -aa 0 /home/mss/MantaRay/UnnamedProject/octrees/my_test_scene_1600.oct;echo ~/MantaRay/UnnamedProject/images/2022_09_28_2126_rtpict_rendering_aa0_1500_sunny_ad32_1600.hdr
mkdir -p ~/MantaRay/UnnamedProject/images/
rtpict -n 11 -vf /home/mss/MantaRay/UnnamedProject/views/Perspective1.vf -x 1500 -y 750 -o ~/MantaRay/UnnamedProject/images/2022_09_28_2126_rtpict_rendering_aa0_1500_sunny_ad32_1700.hdr -ab 3 -ad 32 -aa 0 /home/mss/MantaRay/UnnamedProject/octrees/my_test_scene_1700.oct;echo ~/MantaRay/UnnamedProject/images/2022_09_28_2126_rtpict_rendering_aa0_1500_sunny_ad32_1700.hdr""",
    fireLogs=True,
    lastRunTime=1329254,
    name="rtpict",
    suppressWarnings=False)  # -> Stdout, Stderr_, Ran

panel_72 = Panel(overrides_20.Output)

# ----
# Using PCOND to set automatic exposure
# and convert to PNG
panel_73 = Panel("""pcond -h <hdr> <hdr-.>_exposed.hdr
ra_tiff <hdr-.>_exposed.hdr <hdr-.>_exposed.tif
convert <hdr-.>_exposed.tif <hdr-.>_exposed.png
echo <hdr-.>_exposed.png""")
overrides_23 = ApplyOverrides(Input=panel_73, Hdr=graft(executessh_13.Stdout))  # -> Output, DynamicOutput
executessh_15 = ExecuteSSH(
    _SSHCommands_=overrides_23.DynamicOutput,
    Run=executessh_13.Ran,
    addPrefix=True,
    description="""pcond -h /home/mss/simulation/Boston_Skylights/images/accelerad_rtrace_rendering.hdr /home/mss/simulation/Boston_Skylights/images/accelerad_rtrace_rendering_exposed.hdr
ra_tiff /home/mss/simulation/Boston_Skylights/images/accelerad_rtrace_rendering_exposed.hdr /home/mss/simulation/Boston_Skylights/images/accelerad_rtrace_rendering_exposed.tif
convert /home/mss/simulation/Boston_Skylights/images/accelerad_rtrace_rendering_exposed.tif /home/mss/simulation/Boston_Skylights/images/accelerad_rtrace_rendering_exposed.png
echo /home/mss/simulation/Boston_Skylights/images/accelerad_rtrace_rendering_exposed.png""",
    fireLogs=False,
    lastRunTime=546,
    suppressWarnings=False,
    results="/home/mss/MantaRay/UnnamedProject/images/rtrace_rendering_exposed.png",
    commands="""pcond -h /home/mss/MantaRay/UnnamedProject/images/rtrace_rendering.hdr /home/mss/MantaRay/UnnamedProject/images/rtrace_rendering_exposed.hdr
ra_tiff /home/mss/MantaRay/UnnamedProject/images/rtrace_rendering_exposed.hdr /home/mss/MantaRay/UnnamedProject/images/rtrace_rendering_exposed.tif
convert /home/mss/MantaRay/UnnamedProject/images/rtrace_rendering_exposed.tif /home/mss/MantaRay/UnnamedProject/images/rtrace_rendering_exposed.png
echo /home/mss/MantaRay/UnnamedProject/images/rtrace_rendering_exposed.png""")  # -> Stdout, Stderr_, Ran
download_3 = Download(
    LinuxFilePaths=executessh_15.Stdout,
    Run=executessh_15.Ran,
    stdouts="C:\Users\mm1013\MantaRay\UnnamedProject\rtrace_rendering_exposed.png")  # -> FilePaths, Status, Ran
imageviewer_3 = LBImageViewer(ImagePath_=download_3.FilePaths, _scale_="1.5", DisableClickable=False, SaveImgWithCoords=False, scale=1.5)  # -> ImagePath, Values, GIF

panel_74 = Panel(executessh_13.Stderr_)

# ----
# Using pfilt to downscale image
# radius per Mark Stock:
# http://markjstock.org/radmisc/aa0_test/final.html
panel_75 = Panel("pfilt -x /2 -y /2 -1 -r 0.7 <file> > <file-.>_filtered.hdr;echo <file-.>_filtered.hdr")
overrides_24 = ApplyOverrides(Input_=panel_75, File=graft(executessh_14.Stdout))  # -> Output, Pairs
executessh_16 = ExecuteSSH(
    _SSHCommands_=flatten(overrides_24.Output),
    Run=executessh_14.Ran,
    addPrefix=True,
    description="pfilt -x /2 -y /2 -1 -r 0.7 <file> > <file>_filtered.hdr;echo <file>_filtered.hdr",
    fireLogs=False,
    lastRunTime=2226,
    suppressWarnings=False)  # -> Stdout, Stderr_, Ran

# ----
# overture should now automatically be included in rtpict
# Parallel RTPICT render with ambient cache
viewfile_3 = Text(executessh_11.Stdout)
octree_4 = Text(executessh_10.Stdout)
modifierlist = Text(flatten(concat_2))
octree_overcast_2 = Text(octree_overcast)
entwine_6 = Entwine(Branch00=octree_overcast_2, Branch01=octree_4, FlattenInputs=True)  # -> flatten(Result)
division_2 = Division(A=resolution, B=1.5)
octree_5 = Text(graft(entwine_6))
list = ItemSelector(
    octree_5,
    {"/home/mss/MantaRay/UnnamedProject/octrees/my_test_scene.oct", "/home/mss/MantaRay/UnnamedProject/octrees/my_test_scene_0800.oct", "/home/mss/MantaRay/UnnamedProject/octrees/my_test_scene_0900.oct", "/home/mss/MantaRay/UnnamedProject/octrees/my_test_scene_1000.oct", "/home/mss/MantaRay/UnnamedProject/octrees/my_test_scene_1100.oct", "/home/mss/MantaRay/UnnamedProject/octrees/my_test_scene_1200.oct", "/home/mss/MantaRay/UnnamedProject/octrees/my_test_scene_1300.oct", "/home/mss/MantaRay/UnnamedProject/octrees/my_test_scene_1400.oct", "/home/mss/MantaRay/UnnamedProject/octrees/my_test_scene_1500.oct", "/home/mss/MantaRay/UnnamedProject/octrees/my_test_scene_1600.oct", "/home/mss/MantaRay/UnnamedProject/octrees/my_test_scene_1700.oct"}, selected="/home/mss/MantaRay/UnnamedProject/octrees/my_test_scene.oct")
y = Number(division_2)
eval = Evaluate(F="x=y", x=octree_5, y=list)
panel_76 = Panel("-ab 3 -ad 4096 -lw 0.0003 -aa 0.1 -ar 256 -as 1024")
panel_77 = Panel("""mkdir -p <proj>/images/
rtpict -n <cpus-1> -w -vf <vf> -x 400 -y 300 <radOptions> -af <ambFile> <oct> > /dev/null
rtpict -n <cpus-1> -w -vf <vf> -x <x> -y <y> <radOptions> -af <ambFile> <oct> | pfilt -x /2 -y /2 > <proj>/images/<target>;echo <proj>/images/<target>""")
x_3 = Number(x)
y_2 = Number(y)
run_3 = LBFalseStartToggle(False)

# ----
# exclude frames
panel_78 = Panel("frames")
python_16 = GhPythonScript(opaqueModifiers=modifierlist, search=panel_78)  # -> a; inputs opaqueModifiers: list, search: list
# ---------- python_16: Python ----------
__author__ = "mm1013"
__version__ = "2022.09.05"

import rhinoscriptsyntax as rs
#import Grasshopper.DataTree as dt
import ghpythonlib.treehelpers as th


o = []
for l in search:
    o.append([s for s in opaqueModifiers if l.lower() in s.lower()])
    

a = th.list_to_tree(o)
# ---------- end python_16 ----------
overrides_25 = ApplyOverrides(Input_="-ae <modifier>", Modifier=graft(python_16))  # -> Output, Pairs
join_5 = TextJoin(Text=flatten(overrides_25.Output), Join=" ")

hours_5 = Text(hours_2)
entwine_7 = Entwine(Branch00="ovc", Branch01=hours_5, FlattenInputs=True)  # -> flatten(Result)
cull_10 = CullPattern(List=graft(entwine_7), CullPattern=eval)  # -> flatten(List)
hours_6 = Text(cull_10)

merge = Merge(Data1=panel_76, Data2=list, Data3=join_5, Data4=Button())  # -> flatten(Result)
python_17 = GhPythonScript(update=merge)  # -> time; inputs update: tree
# ---------- python_17: Python ----------
#if not update:
#    return self.time
"""Provides a scripting component.
    Inputs:
        x: The x script variable
        y: The y script variable
    Output:
        a: The a output variable"""
        
__author__ = "mm1013"
__version__ = "2022.08.30"
        
import rhinoscriptsyntax as rs
        
from datetime import datetime
dt = datetime.now()
        
time = "%02d_%02d_%02d_%02d%02d_%02d" % (dt.year, dt.month, dt.day, dt.hour, dt.minute, dt.second)
# ---------- end python_17 ----------
overrides_26 = ApplyOverrides(Input_="ambfile_<time>.af", Time=graft(python_17))  # -> Output, Pairs
overrides_27 = ApplyOverrides(
    Input=panel_77,
    RadOptions=graft(panel_76),
    X=graft(x_3),
    Y=graft(y_2),
    Vf=graft(viewfile_3),
    Oct=graft(list),
    Target=graft("<time>_rtpict_rendering_aa0.1_<x>_sunny_ad4096_<h>.hdr"),
    Time=graft("<time>"),
    H=graft(hours_6),
    AmbFile=graft(overrides_26.Output),
    ExcludeFiles=graft(join_5))  # -> Output, Pairs
python_18 = GhPythonScript(update=overrides_27.Pairs)  # -> time; inputs update: tree; same code as python_17
overrides_28 = ApplyOverrides(Input_=overrides_27.Output, Time=graft(python_18))  # -> Output, Pairs
executessh_17 = ExecuteSSH(
    _SSHCommands_=flatten(overrides_28.Output),
    Run=run_3,
    addPrefix=True,
    description="""mkdir -p ~/MantaRay/UnnamedProject/images/
rtpict -n 10 -w -vf /home/mss/MantaRay/UnnamedProject/views/Perspective1.vf -x 400 -y 300 -ab 3 -ad 4096 -lw 0.0003 -aa 0.1 -ar 256 -as 1024 -af ambfile_2022_09_28_2130_47.af /home/mss/MantaRay/UnnamedProject/octrees/my_test_scene.oct > /dev/null
rtpict -n 10 -w -vf /home/mss/MantaRay/UnnamedProject/views/Perspective1.vf -x 5000 -y 3333.333333 -ab 3 -ad 4096 -lw 0.0003 -aa 0.1 -ar 256 -as 1024 -af ambfile_2022_09_28_2130_47.af /home/mss/MantaRay/UnnamedProject/octrees/my_test_scene.oct | pfilt -x /2 -y /2 > ~/MantaRay/UnnamedProject/images/2022_09_28_2130_47_rtpict_rendering_aa0.1_5000_sunny_ad4096_ovc.hdr;echo ~/MantaRay/UnnamedProject/images/2022_09_28_2130_47_rtpict_rendering_aa0.1_5000_sunny_ad4096_ovc.hdr""",
    fireLogs=True,
    lastRunTime=4228945,
    name="rtpict",
    suppressWarnings=False,
    results="/home/lio/simulation/boston/images/2022_09_05_2050_51_rtpict_rendering_aa0.1_5000_sunny_ad16_1000.hdr",
    commands="""mkdir -p ~/simulation/boston/images/
rtpict -n 62 -w -vf /home/lio/simulation/boston/views/Perspective.vf -x 400 -y 300 -ab 3 -ad 4096 -lw 0.0005 -aa 0.1 -ar 256 -as 1024 -af ambfile_2022_09_05_2050_29.af /home/lio/simulation/boston/octrees/my_test_scene_1100.oct > /dev/null
rtpict -n 62 -w -vf /home/lio/simulation/boston/views/Perspective.vf -x 5000 -y 3333.333333 -ab 3 -ad 4096 -lw 0.0005 -aa 0.1 -ar 256 -as 1024 -af ambfile_2022_09_05_2050_29.af /home/lio/simulation/boston/octrees/my_test_scene_1100.oct | pfilt -x /2 -y /2 > ~/simulation/boston/images/2022_09_05_2050_51_rtpict_rendering_aa0.1_5000_sunny_ad16_1000.hdr;echo ~/simulation/boston/images/2022_09_05_2050_51_rtpict_rendering_aa0.1_5000_sunny_ad16_1000.hdr""")  # -> Stdout, Stderr_, Ran
convertpaths_5 = ConvertPaths(I=executessh_17.Stdout)  # -> Linux, flatten(Windows)

imageviewer_4 = LBImageViewer(ImagePath_=convertpaths_5.Windows, _scale_=2, DisableClickable=False, SaveImgWithCoords=False, scale=2)  # -> ImagePath, Values, GIF

# ----
# Parallel RTRACE render (illuminance)
# echo "rvu -vtv -vp 0.5 4.5 1.6 -vd 0.830824 -1.13002 -0.181063 -vu 0 0 1 -vh 98.2132 -vv 79.2785 -vo 0 -va 0 -vs 0 -vl 0" > <proj>/views/myview.vf;echo <proj>/views/myview.vf
run_4 = LBFalseStartToggle(False)
panel_79 = Panel("""mkdir -p <proj>/images/
vwrays -ff -x <x> -y <y> -vf <vf> -pa 1 | rtrace -i <radOptions> -af <af> -w -n 11 `vwrays -d -ff -x <x> -y <y> -vf <vf> -pa 1` -ffc <oct> > <proj>/images/<target-.>.hdr
echo <proj>/images/<target-.>.hdr""")
octree_6 = Text(executessh_9.Stdout)
viewfile_4 = Text(executessh_11.Stdout)

python_19 = GhPythonScript(x=viewfile_4)  # -> a
# ---------- python_19: Python ----------
__author__ = "mm1013"
__version__ = "2022.09.13"

import rhinoscriptsyntax as rs

a = x.split("/")[-1].split(".")[0]
# ---------- end python_19 ----------

# ----
# Parallel RTRACE render
# echo "rvu -vtv -vp 0.5 4.5 1.6 -vd 0.830824 -1.13002 -0.181063 -vu 0 0 1 -vh 98.2132 -vv 79.2785 -vo 0 -va 0 -vs 0 -vl 0" > <proj>/views/myview.vf;echo <proj>/views/myview.vf
run_5 = LBFalseStartToggle(False)
octree_7 = Text(executessh_9.Stdout)
viewfile_5 = Text(executessh_11.Stdout)
panel_80 = Panel("""mkdir -p <LinuxHome>/images/
vwrays -ff -x <x> -y <y> -vf <vf> -pa 1 | rtrace <radOptions> -af <af> -w -n 11 `vwrays -d -ff -x <x> -y <y> -vf <vf> -pa 1` -ffc <oct> > <LinuxHome>/images/<target-.>.hdr
echo <LinuxHome>/images/<target-.>.hdr""")
panel_81 = Panel("-as 0 -ab 3 -aa 0.2 -ad 128")
overrides_29 = ApplyOverrides(
    Input=panel_80,
    X=graft("2000"),
    Y=graft("1100"),
    Vf=graft("<vf>"),
    RadOptions=graft(panel_81),
    Oct=graft(octree_7),
    Target=graft("<time>_<view>_render.hdr"),
    Af=graft("<af>"),
    Time=graft("<time>"),
    View=graft("<view>"))  # -> Output, DynamicOutput

python_20 = GhPythonScript(x=viewfile_5)  # -> a; same code as python_19
python_21 = GhPythonScript(update=overrides_29.Output)  # -> time; inputs update: tree; same code as python_17

overrides_30 = ApplyOverrides(
    Input=panel_79,
    X=graft("2000"),
    Y=graft("1100"),
    Vf=graft(viewfile_4),
    RadOptions=graft(panel_81),
    Oct=graft(octree_6),
    Target=graft("<time>_<view>_render_illum.hdr"),
    Af=graft("ambfile2_<time>.af"),
    Time=graft(python_21),
    View=graft(python_19))  # -> Output, DynamicOutput
executessh_18 = ExecuteSSH(
    _SSHCommands_=overrides_30.DynamicOutput,
    Run=run_4,
    addPrefix=True,
    description="""mkdir -p ~/MantaRay/UnnamedProject/images/
vwrays -ff -x 2000 -y 1100 -vf /home/mss/MantaRay/UnnamedProject/views/Perspective1.vf -pa 1 | rtrace -i -as 0 -ab 3 -aa 0.2 -ad 128 -af ambfile2_2022_09_28_2130_47.af -w -n 11 `vwrays -d -ff -x 2000 -y 1100 -vf /home/mss/MantaRay/UnnamedProject/views/Perspective1.vf -pa 1` -ffc /home/mss/MantaRay/UnnamedProject/octrees/my_test_scene.oct > ~/MantaRay/UnnamedProject/images/2022_09_28_2130_47_Perspective1_render_illum.hdr
echo ~/MantaRay/UnnamedProject/images/2022_09_28_2130_47_Perspective1_render_illum.hdr""",
    fireLogs=False,
    lastRunTime=6403,
    suppressWarnings=False,
    results="/home/mss/MantaRay/UnnamedProject/images/2022_09_28_1341_29_Perspective1_render_illum.hdr",
    commands="""mkdir -p ~/MantaRay/UnnamedProject/images/
vwrays -ff -x 2000 -y 1100 -vf /home/mss/MantaRay/UnnamedProject/views/Perspective1.vf -pa 1 | rtrace -i -as 0 -ab 3 -aa 0.2 -ad 128 -af ambfile2_2022_09_28_1341_29.af -w -n 11 `vwrays -d -ff -x 2000 -y 1100 -vf /home/mss/MantaRay/UnnamedProject/views/Perspective1.vf -pa 1` -ffc /home/mss/MantaRay/UnnamedProject/octrees/my_test_scene.oct > ~/MantaRay/UnnamedProject/images/2022_09_28_1341_29_Perspective1_render_illum.hdr
echo ~/MantaRay/UnnamedProject/images/2022_09_28_1341_29_Perspective1_render_illum.hdr""")  # -> Stdout, Stderr_, Ran

overrides_31 = ApplyOverrides(
    Input=overrides_29.DynamicOutput,
    Time=graft(python_21),
    View=graft(python_20),
    Vf=graft(viewfile_5),
    Af=graft("ambfile2_<time>.af"))  # -> Output, DynamicOutput

executessh_19 = ExecuteSSH(
    _SSHCommands_=overrides_31.DynamicOutput,
    Run=run_5,
    addPrefix=True,
    description="""mkdir -p ~/MantaRay/UnnamedProject/images/
vwrays -ff -x 2000 -y 1100 -vf /home/mss/MantaRay/UnnamedProject/views/Perspective1.vf -pa 1 | rtrace -as 0 -ab 3 -aa 0.2 -ad 128 -af ambfile2_2022_09_28_2130_47.af -w -n 11 `vwrays -d -ff -x 2000 -y 1100 -vf /home/mss/MantaRay/UnnamedProject/views/Perspective1.vf -pa 1` -ffc /home/mss/MantaRay/UnnamedProject/octrees/my_test_scene.oct > ~/MantaRay/UnnamedProject/images/2022_09_28_2130_47_Perspective1_render.hdr
echo ~/MantaRay/UnnamedProject/images/2022_09_28_2130_47_Perspective1_render.hdr""",
    fireLogs=False,
    lastRunTime=6402,
    suppressWarnings=False,
    results="/home/mss/MantaRay/UnnamedProject/images/2022_09_28_1341_29_Perspective1_render.hdr",
    commands="""mkdir -p ~/MantaRay/UnnamedProject/images/
vwrays -ff -x 2000 -y 1100 -vf /home/mss/MantaRay/UnnamedProject/views/Perspective1.vf -pa 1 | rtrace -as 0 -ab 3 -aa 0.2 -ad 128 -af ambfile2_2022_09_28_1341_29.af -w -n 11 `vwrays -d -ff -x 2000 -y 1100 -vf /home/mss/MantaRay/UnnamedProject/views/Perspective1.vf -pa 1` -ffc /home/mss/MantaRay/UnnamedProject/octrees/my_test_scene.oct > ~/MantaRay/UnnamedProject/images/2022_09_28_1341_29_Perspective1_render.hdr
echo ~/MantaRay/UnnamedProject/images/2022_09_28_1341_29_Perspective1_render.hdr""")  # -> Stdout, Stderr_, Ran

panel_82 = Panel(executessh_19.Stderr_)

# ----
# Using PCOND to set automatic exposure
# and convert to PNG
panel_83 = Panel("""pcond -h <hdr> <hdr-.>_exposed.hdr
ra_tiff <hdr-.>_exposed.hdr <hdr-.>_exposed.tif
convert <hdr-.>_exposed.tif <hdr-.>_exposed.png
echo <hdr-.>_exposed.png""")
overrides_32 = ApplyOverrides(Input=panel_83, Hdr=graft(executessh_18.Stdout))  # -> Output, DynamicOutput
executessh_20 = ExecuteSSH(
    _SSHCommands_=overrides_32.DynamicOutput,
    Run=executessh_18.Ran,
    addPrefix=True,
    description="""pcond -h /home/mss/MantaRay/UnnamedProject/images/2022_09_28_1341_29_Perspective1_render_illum.hdr /home/mss/MantaRay/UnnamedProject/images/2022_09_28_1341_29_Perspective1_render_illum_exposed.hdr
ra_tiff /home/mss/MantaRay/UnnamedProject/images/2022_09_28_1341_29_Perspective1_render_illum_exposed.hdr /home/mss/MantaRay/UnnamedProject/images/2022_09_28_1341_29_Perspective1_render_illum_exposed.tif
convert /home/mss/MantaRay/UnnamedProject/images/2022_09_28_1341_29_Perspective1_render_illum_exposed.tif /home/mss/MantaRay/UnnamedProject/images/2022_09_28_1341_29_Perspective1_render_illum_exposed.png
echo /home/mss/MantaRay/UnnamedProject/images/2022_09_28_1341_29_Perspective1_render_illum_exposed.png""",
    fireLogs=False,
    lastRunTime=2680,
    suppressWarnings=False,
    results="/home/mss/MantaRay/UnnamedProject/images/2022_09_28_1341_29_Perspective1_render_illum_exposed.png",
    commands="""pcond -h /home/mss/MantaRay/UnnamedProject/images/2022_09_28_1341_29_Perspective1_render_illum.hdr /home/mss/MantaRay/UnnamedProject/images/2022_09_28_1341_29_Perspective1_render_illum_exposed.hdr
ra_tiff /home/mss/MantaRay/UnnamedProject/images/2022_09_28_1341_29_Perspective1_render_illum_exposed.hdr /home/mss/MantaRay/UnnamedProject/images/2022_09_28_1341_29_Perspective1_render_illum_exposed.tif
convert /home/mss/MantaRay/UnnamedProject/images/2022_09_28_1341_29_Perspective1_render_illum_exposed.tif /home/mss/MantaRay/UnnamedProject/images/2022_09_28_1341_29_Perspective1_render_illum_exposed.png
echo /home/mss/MantaRay/UnnamedProject/images/2022_09_28_1341_29_Perspective1_render_illum_exposed.png""")  # -> Stdout, Stderr_, Ran
download_4 = Download(
    LinuxFilePaths=executessh_20.Stdout,
    Run=executessh_20.Ran,
    stdouts="C:\Users\mm1013\MantaRay\UnnamedProject\2022_09_28_1341_29_Perspective1_render_illum_exposed.png")  # -> FilePaths, Status, Ran
imageviewer_5 = LBImageViewer(ImagePath_=download_4.FilePaths, _scale_="1.5", DisableClickable=False, SaveImgWithCoords=False, scale=1.5)  # -> ImagePath, Values, GIF

# ----
# False color with illuminance curves
# on top of luminance picture
panel_84 = Panel("falsecolor -s 9000 -l lux -p <rad-.>_exposed.hdr -i <irrad> -cl -log 2 > <rad-.>_fc.hdr;echo <rad-.>_fc.hdr")
overrides_33 = ApplyOverrides(Input=panel_84, Rad=graft(executessh_19.Stdout), Irrad=graft(executessh_18.Stdout))  # -> Output, DynamicOutput
executessh_21 = ExecuteSSH(
    _SSHCommands_=overrides_33.DynamicOutput,
    Run=[executessh_19.Ran, executessh_18.Ran],
    addPrefix=True,
    description="falsecolor -s 9000 -l lux -p /home/mss/MantaRay/UnnamedProject/images/2022_09_28_1341_29_Perspective1_render_exposed.hdr -i /home/mss/MantaRay/UnnamedProject/images/2022_09_28_1341_29_Perspective1_render_illum.hdr -cl -log 2 > /home/mss/MantaRay/UnnamedProject/images/2022_09_28_1341_29_Perspective1_render_fc.hdr;echo /home/mss/MantaRay/UnnamedProject/images/2022_09_28_1341_29_Perspective1_render_fc.hdr",
    fireLogs=False,
    lastRunTime=4829,
    suppressWarnings=False,
    results="/home/mss/MantaRay/UnnamedProject/images/2022_09_28_1341_29_Perspective1_render_fc.hdr",
    commands="falsecolor -s 9000 -l lux -p /home/mss/MantaRay/UnnamedProject/images/2022_09_28_1341_29_Perspective1_render_exposed.hdr -i /home/mss/MantaRay/UnnamedProject/images/2022_09_28_1341_29_Perspective1_render_illum.hdr -cl -log 2 > /home/mss/MantaRay/UnnamedProject/images/2022_09_28_1341_29_Perspective1_render_fc.hdr;echo /home/mss/MantaRay/UnnamedProject/images/2022_09_28_1341_29_Perspective1_render_fc.hdr")  # -> Stdout, Stderr_, Ran
download_5 = Download(
    LinuxFilePaths=executessh_21.Stdout,
    Run=executessh_21.Ran,
    stdouts="C:\Users\mm1013\MantaRay\UnnamedProject\2022_09_28_1341_29_Perspective1_render_fc.hdr")  # -> FilePaths, Status, Ran
imageviewer_6 = LBImageViewer(ImagePath_=download_5.FilePaths, _scale_="2", DisableClickable=False, SaveImgWithCoords=False, scale=2)  # -> ImagePath, Values, GIF

# ----
# False color with illuminance curves
# on top of luminance picture
panel_85 = Panel("""pcond -h <irrad> <irrad-.>_exposed.hdr
falsecolor -s 9000 -d 0 -l lux -p <irrad-.>_exposed.hdr -i <irrad> -cl -log 2 > <rad-.>_fc.hdr;echo <rad-.>_fc.hdr""")
overrides_34 = ApplyOverrides(Input=panel_85, Rad=graft(executessh_19.Stdout), Irrad=graft(executessh_18.Stdout))  # -> Output, DynamicOutput
executessh_22 = ExecuteSSH(
    _SSHCommands_=overrides_34.DynamicOutput,
    Run=[executessh_19.Ran, executessh_18.Ran],
    addPrefix=True,
    description="""pcond -h /home/mss/MantaRay/UnnamedProject/images/2022_09_28_1341_29_Perspective1_render_illum.hdr /home/mss/MantaRay/UnnamedProject/images/2022_09_28_1341_29_Perspective1_render_illum_exposed.hdr
falsecolor -s 9000 -d 0 -l lux -p /home/mss/MantaRay/UnnamedProject/images/2022_09_28_1341_29_Perspective1_render_illum_exposed.hdr -i /home/mss/MantaRay/UnnamedProject/images/2022_09_28_1341_29_Perspective1_render_illum.hdr -cl -log 2 > /home/mss/MantaRay/UnnamedProject/images/2022_09_28_1341_29_Perspective1_render_fc.hdr;echo /home/mss/MantaRay/UnnamedProject/images/2022_09_28_1341_29_Perspective1_render_fc.hdr""",
    fireLogs=False,
    lastRunTime=5881,
    suppressWarnings=False,
    results="/home/mss/MantaRay/UnnamedProject/images/2022_09_28_1341_29_Perspective1_render_fc.hdr",
    commands="""pcond -h /home/mss/MantaRay/UnnamedProject/images/2022_09_28_1341_29_Perspective1_render_illum.hdr /home/mss/MantaRay/UnnamedProject/images/2022_09_28_1341_29_Perspective1_render_illum_exposed.hdr
falsecolor -s 9000 -d 0 -l lux -p /home/mss/MantaRay/UnnamedProject/images/2022_09_28_1341_29_Perspective1_render_illum_exposed.hdr -i /home/mss/MantaRay/UnnamedProject/images/2022_09_28_1341_29_Perspective1_render_illum.hdr -cl -log 2 > /home/mss/MantaRay/UnnamedProject/images/2022_09_28_1341_29_Perspective1_render_fc.hdr;echo /home/mss/MantaRay/UnnamedProject/images/2022_09_28_1341_29_Perspective1_render_fc.hdr""")  # -> Stdout, Stderr_, Ran
download_6 = Download(
    LinuxFilePaths=executessh_22.Stdout,
    Run=executessh_22.Ran,
    stdouts="C:\Users\mm1013\MantaRay\UnnamedProject\2022_09_28_1341_29_Perspective1_render_fc.hdr")  # -> FilePaths, Status, Ran
imageviewer_7 = LBImageViewer(ImagePath_=download_6.FilePaths, _scale_="2", DisableClickable=False, SaveImgWithCoords=False, scale=2)  # -> ImagePath, Values, GIF

# ----
# Using PCOND to set automatic exposure
# and convert to PNG
panel_86 = Panel("""pcond -h <hdr> <hdr-.>_exposed.hdr
ra_tiff <hdr-.>_exposed.hdr <hdr-.>_exposed.tif
convert <hdr-.>_exposed.tif <hdr-.>_exposed.png
echo <hdr-.>_exposed.png""")
overrides_35 = ApplyOverrides(Input=panel_86, Hdr=graft(executessh_19.Stdout))  # -> Output, DynamicOutput
executessh_23 = ExecuteSSH(
    _SSHCommands_=overrides_35.DynamicOutput,
    Run=executessh_19.Ran,
    addPrefix=True,
    description="""pcond -h /home/mss/MantaRay/UnnamedProject/images/2022_09_28_1341_29_Perspective1_render.hdr /home/mss/MantaRay/UnnamedProject/images/2022_09_28_1341_29_Perspective1_render_exposed.hdr
ra_tiff /home/mss/MantaRay/UnnamedProject/images/2022_09_28_1341_29_Perspective1_render_exposed.hdr /home/mss/MantaRay/UnnamedProject/images/2022_09_28_1341_29_Perspective1_render_exposed.tif
convert /home/mss/MantaRay/UnnamedProject/images/2022_09_28_1341_29_Perspective1_render_exposed.tif /home/mss/MantaRay/UnnamedProject/images/2022_09_28_1341_29_Perspective1_render_exposed.png
echo /home/mss/MantaRay/UnnamedProject/images/2022_09_28_1341_29_Perspective1_render_exposed.png""",
    fireLogs=False,
    lastRunTime=1599,
    suppressWarnings=False,
    results="/home/mss/MantaRay/UnnamedProject/images/2022_09_28_1341_29_Perspective1_render_exposed.png",
    commands="""pcond -h /home/mss/MantaRay/UnnamedProject/images/2022_09_28_1341_29_Perspective1_render.hdr /home/mss/MantaRay/UnnamedProject/images/2022_09_28_1341_29_Perspective1_render_exposed.hdr
ra_tiff /home/mss/MantaRay/UnnamedProject/images/2022_09_28_1341_29_Perspective1_render_exposed.hdr /home/mss/MantaRay/UnnamedProject/images/2022_09_28_1341_29_Perspective1_render_exposed.tif
convert /home/mss/MantaRay/UnnamedProject/images/2022_09_28_1341_29_Perspective1_render_exposed.tif /home/mss/MantaRay/UnnamedProject/images/2022_09_28_1341_29_Perspective1_render_exposed.png
echo /home/mss/MantaRay/UnnamedProject/images/2022_09_28_1341_29_Perspective1_render_exposed.png""")  # -> Stdout, Stderr_, Ran
download_7 = Download(
    LinuxFilePaths=executessh_23.Stdout,
    Run=executessh_23.Ran,
    stdouts="C:\Users\mm1013\MantaRay\UnnamedProject\2022_09_28_1341_29_Perspective1_render_exposed.png")  # -> FilePaths, Status, Ran
imageviewer_8 = LBImageViewer(ImagePath_=download_7.FilePaths, _scale_="1.5", DisableClickable=False, SaveImgWithCoords=False, scale=1.5)  # -> ImagePath, Values, GIF

overrides_36 = ApplyOverrides(Input=panel_42, Rad=graft(executessh_19.Stdout), Irrad=graft(executessh_18.Stdout))  # -> Output, DynamicOutput
executessh_24 = ExecuteSSH(
    _SSHCommands_=overrides_36.DynamicOutput,
    Run=[executessh_19.Ran, executessh_18.Ran],
    addPrefix=True,
    description="falsecolor -lw 0 -s 50 -n 10 -m 1.79 -l DF -p /home/mss/MantaRay/UnnamedProject/images/2022_09_28_1341_29_Perspective1_render_exposed.hdr -i /home/mss/MantaRay/UnnamedProject/images/2022_09_28_1341_29_Perspective1_render_illum.hdr -cp > /home/mss/MantaRay/UnnamedProject/images/2022_09_28_1341_29_Perspective1_render_fc4_lw0.hdr;echo /home/mss/MantaRay/UnnamedProject/images/2022_09_28_1341_29_Perspective1_render_fc4_lw0.hdr",
    fireLogs=False,
    lastRunTime=5356,
    suppressWarnings=False,
    results="/home/mss/MantaRay/UnnamedProject/images/2022_09_28_1341_29_Perspective1_render_fc4_lw0.hdr",
    commands="falsecolor -lw 0 -s 50 -n 10 -m 1.79 -l DF -p /home/mss/MantaRay/UnnamedProject/images/2022_09_28_1341_29_Perspective1_render_exposed.hdr -i /home/mss/MantaRay/UnnamedProject/images/2022_09_28_1341_29_Perspective1_render_illum.hdr -cp > /home/mss/MantaRay/UnnamedProject/images/2022_09_28_1341_29_Perspective1_render_fc4_lw0.hdr;echo /home/mss/MantaRay/UnnamedProject/images/2022_09_28_1341_29_Perspective1_render_fc4_lw0.hdr")  # -> Stdout, Stderr_, Ran
overrides_37 = ApplyOverrides(Input=panel_43, Rad=graft(executessh_18.Stdout), Fc=graft(executessh_24.Stdout))  # -> Output, DynamicOutput
subtraction = Subtraction(A="1100", B=pdecon.YComponent)
executessh_25 = ExecuteSSH(
    _SSHCommands_=overrides_37.DynamicOutput,
    Run=[executessh_19.Ran, executessh_18.Ran],
    addPrefix=True,
    description="""pcond -h /home/mss/MantaRay/UnnamedProject/images/2022_09_28_1341_29_Perspective1_render_illum.hdr /home/mss/MantaRay/UnnamedProject/images/2022_09_28_1341_29_Perspective1_render_illum_exposed2.hdr
pcomb /home/mss/MantaRay/UnnamedProject/images/2022_09_28_1341_29_Perspective1_render_illum_exposed2.hdr -s 0.2 /home/mss/MantaRay/UnnamedProject/images/2022_09_28_1341_29_Perspective1_render_fc4_lw0.hdr > /home/mss/MantaRay/UnnamedProject/images/2022_09_28_1341_29_Perspective1_render_illum_overlay.hdr
echo /home/mss/MantaRay/UnnamedProject/images/2022_09_28_1341_29_Perspective1_render_illum_overlay.hdr""",
    fireLogs=False,
    lastRunTime=1070,
    suppressWarnings=False,
    results="/home/mss/MantaRay/UnnamedProject/images/2022_09_28_1341_29_Perspective1_render_illum_overlay.hdr",
    commands="""pcond -h /home/mss/MantaRay/UnnamedProject/images/2022_09_28_1341_29_Perspective1_render_illum.hdr /home/mss/MantaRay/UnnamedProject/images/2022_09_28_1341_29_Perspective1_render_illum_exposed2.hdr
pcomb /home/mss/MantaRay/UnnamedProject/images/2022_09_28_1341_29_Perspective1_render_illum_exposed2.hdr -s 0.2 /home/mss/MantaRay/UnnamedProject/images/2022_09_28_1341_29_Perspective1_render_fc4_lw0.hdr > /home/mss/MantaRay/UnnamedProject/images/2022_09_28_1341_29_Perspective1_render_illum_overlay.hdr
echo /home/mss/MantaRay/UnnamedProject/images/2022_09_28_1341_29_Perspective1_render_illum_overlay.hdr""")  # -> Stdout, Stderr_, Ran
overrides_38 = ApplyOverrides(Input=panel_44, Hdr=graft(executessh_18.Stdout), X=graft(pdecon.XComponent), Y=graft(subtraction))  # -> Output, DynamicOutput
download_8 = Download(
    LinuxFilePaths=executessh_25.Stdout,
    Run=executessh_25.Ran,
    stdouts="C:\Users\mm1013\MantaRay\UnnamedProject\2022_09_28_1341_29_Perspective1_render_illum_overlay.hdr")  # -> FilePaths, Status, Ran
item_5 = ListItem(List=flatten(overrides_38.Output), Index=0, Wrap=True)
panel_87 = Panel(item_5)
imageviewer_9 = LBImageViewer(ImagePath_=download_8.FilePaths, _scale_="2", DisableClickable=False, SaveImgWithCoords=False, scale=2)  # -> ImagePath, Values, GIF

# ----
# RENDER WITH RAD (rif files)
# https://discourse.radiance-online.org/t/rad-program-for-generating-parameters/6026
panel_88 = Panel("scene.rif")
panel_89 = Panel("""rpict= rtpict -n <cpus>
RESOLUTION= 1500
QUALITY= H
DETAIL= H
EXPOSURE= 1
UP= Z
INDIRECT= 4
VARIABILITY= M
REPORT= 1
OCTREE=<oct>""")
panel_90 = Panel("""echo "<RIF>" > <LinuxHome>/<target>
rad -n -s <LinuxHome>/<target> OPTFILE=<LinuxHome>/render.opt
echo <LinuxHome>/render.opt""")
octree_8 = Data(octree_overcast, ParamAccess=0)
overrides_39 = ApplyOverrides(Input=panel_90, RIF=graft(panel_89), Target=graft(panel_88), Oct=graft(octree_8))  # -> Output, DynamicOutput
falsestart_10 = LBFalseStartToggle(True)
executessh_26 = ExecuteSSH(
    _SSHCommands_=overrides_39.Output,
    Run=falsestart_10,
    addPrefix=True,
    fireLogs=False,
    lastRunTime=11.1039,
    suppressWarnings=False,
    results="/home/mss/MantaRay/UnnamedProject/render.opt",
    commands="""echo "rpict= rtpict -n 11
RESOLUTION= 1500
QUALITY= H
DETAIL= H
EXPOSURE= 1
UP= Z
INDIRECT= 4
VARIABILITY= M
REPORT= 1
OCTREE=/home/mss/MantaRay/UnnamedProject/octrees/my_test_scene.oct" > ~/MantaRay/UnnamedProject/scene.rif
rad -n -s ~/MantaRay/UnnamedProject/scene.rif OPTFILE=~/MantaRay/UnnamedProject/render.opt
echo ~/MantaRay/UnnamedProject/render.opt""")  # -> Stdout, Stderr_, Ran
panel_91 = Panel("""rtpict -w -n 8 @<options> -x 500 -y 400 -vf <vf> -af <target-.>.amb <oct> > <LinuxHome>/<target-.>_overture.hdr
rtpict -w -n 8 @<options> -vf <vf> -af <target-.>.amb <oct> > <LinuxHome>/<target>
echo <LinuxHome>/<target>""")
overrides_40 = ApplyOverrides(Input="cat <target>", Target=graft(executessh_26.Stdout))  # -> Output, DynamicOutput
executessh_27 = ExecuteSSH(
    _SSHCommands_=overrides_40.Output,
    Run=executessh_26.Ran,
    addPrefix=True,
    fireLogs=False,
    lastRunTime=10.9279,
    suppressWarnings=False,
    results="""-dp 4096
-ar 128
-ms 0.3
-ds .2
-dt .05
-dc .75
-dr 3
-ss 16
-st .01
-ab 5
-aa .1
-ad 1536
-as 768
-av 0.5 0.5 0.5
-lr 12
-lw 1e-5""",
    commands="cat /home/mss/MantaRay/UnnamedProject/render.opt")  # -> Stdout, Stderr_, Ran
panel_92 = Panel(executessh_27.Stdout)
panel_93 = Panel("""pcond -h <hdr> <hdr-.>_exposed.hdr
ra_tiff <hdr-.>_exposed.hdr <hdr-.>_exposed.tif
convert <hdr-.>_exposed.tif <hdr-.>_exposed.png
echo <hdr-.>_exposed.png""")

view_2 = CreateView(Viewport="Perspective")  # -> ViewfileContent, ImageRatio
panel_94 = Panel(view_2.ViewfileContent)
panel_95 = Panel("""mkdir -p <proj>/views/
echo "<vf>" > <proj>/views/<target>.vf
echo <proj>/views/<target>.vf""")
concat_6 = Concatenate(FragmentA="Perspective", FragmentB="2")
vf_2 = Text(view_2.ViewfileContent)
overrides_41 = ApplyOverrides(Input=panel_95, Vf=graft(vf_2), Target=graft(concat_6))  # -> Output, DynamicOutput
executessh_28 = ExecuteSSH(
    _SSHCommands_=overrides_41.DynamicOutput,
    Run=Toggle(True),
    addPrefix=True,
    description="""mkdir -p ~/MantaRay/UnnamedProject/views/
echo "rvu -vtv -vp 70.3649228339276 14.9259793913805 1.78853978695151 -vd 0.317763786063118 0.921962886394164 0.221383405833804 -vu -0.0721375902336246 -0.20930069386856 0.975186847543293 -vh 91.058 -vv 50.000" > ~/MantaRay/UnnamedProject/views/Perspective2.vf
echo ~/MantaRay/UnnamedProject/views/Perspective2.vf""",
    fireLogs=False,
    lastRunTime=10.7018,
    suppressWarnings=False,
    results="/home/mss/MantaRay/UnnamedProject/views/Perspective2.vf",
    commands="""mkdir -p ~/MantaRay/UnnamedProject/views/
echo "rvu -vtv -vp 70.3649228339276 14.9259793913805 1.78853978695151 -vd 0.317763786063118 0.921962886394164 0.221383405833804 -vu -0.0721375902336246 -0.20930069386856 0.975186847543293 -vh 91.058 -vv 50.000" > ~/MantaRay/UnnamedProject/views/Perspective2.vf
echo ~/MantaRay/UnnamedProject/views/Perspective2.vf""")  # -> Stdout, Stderr_, Ran

overrides_42 = ApplyOverrides(
    Input=panel_91,
    Oct=graft(octree_8),
    Target=graft("myRender.hdr"),
    Options=graft(executessh_26.Stdout),
    Vf=graft(executessh_28.Stdout))  # -> Output, DynamicOutput
executessh_29 = ExecuteSSH(
    _SSHCommands=overrides_42.Output,
    Run=False,
    addPrefix=True,
    fireLogs=False,
    lastRunTime=314164.7529,
    suppressWarnings=False,
    results="/home/mss/MantaRay/UnnamedProject/myRender.hdr",
    commands="""rtpict -w -n 8 @/home/mss/MantaRay/UnnamedProject/render.opt -x 500 -y 400 -vf /home/mss/MantaRay/UnnamedProject/views/Perspective2.vf -af myRender.amb /home/mss/MantaRay/UnnamedProject/octrees/my_test_scene.oct > ~/MantaRay/UnnamedProject/myRender_overture.hdr
rtpict -w -n 8 @/home/mss/MantaRay/UnnamedProject/render.opt -vf /home/mss/MantaRay/UnnamedProject/views/Perspective2.vf -af myRender.amb /home/mss/MantaRay/UnnamedProject/octrees/my_test_scene.oct > ~/MantaRay/UnnamedProject/myRender.hdr
echo ~/MantaRay/UnnamedProject/myRender.hdr""")  # -> Stdout, Stderr_, Ran
overrides_43 = ApplyOverrides(Input=panel_93, Hdr=graft(executessh_29.Stdout))  # -> Output, DynamicOutput
executessh_30 = ExecuteSSH(
    _SSHCommands_=overrides_43.DynamicOutput,
    Run=executessh_29.Ran,
    addPrefix=True,
    description="""pcond -h /home/mss/MantaRay/UnnamedProject/myRender.hdr /home/mss/MantaRay/UnnamedProject/myRender_exposed.hdr
ra_tiff /home/mss/MantaRay/UnnamedProject/myRender_exposed.hdr /home/mss/MantaRay/UnnamedProject/myRender_exposed.tif
convert /home/mss/MantaRay/UnnamedProject/myRender_exposed.tif /home/mss/MantaRay/UnnamedProject/myRender_exposed.png
echo /home/mss/MantaRay/UnnamedProject/myRender_exposed.png""",
    fireLogs=False,
    lastRunTime=8.2714,
    suppressWarnings=False,
    results="/home/mss/MantaRay/UnnamedProject/myRenderX_exposed.png",
    commands="""pcond -h /home/mss/MantaRay/UnnamedProject/myRenderX.hdr /home/mss/MantaRay/UnnamedProject/myRenderX_exposed.hdr
ra_tiff /home/mss/MantaRay/UnnamedProject/myRenderX_exposed.hdr /home/mss/MantaRay/UnnamedProject/myRenderX_exposed.tif
convert /home/mss/MantaRay/UnnamedProject/myRenderX_exposed.tif /home/mss/MantaRay/UnnamedProject/myRenderX_exposed.png
echo /home/mss/MantaRay/UnnamedProject/myRenderX_exposed.png""")  # -> Stdout, Stderr_, Ran
download_9 = Download(
    LinuxFilePaths=executessh_30.Stdout,
    Run=executessh_30.Ran,
    stdouts="C:\Users\mm1013\MantaRay\UnnamedProject\myRenderX.hdr")  # -> FilePaths, Status, Ran
imageviewer_10 = LBImageViewer(ImagePath_=download_9.FilePaths, _scale_="1.5", DisableClickable=False, SaveImgWithCoords=False, scale=1.5)  # -> ImagePath, Values, GIF

panel_96 = Panel(overrides_42.Output)

# ----
# Parallel RTPICT render (luminance) no cache
viewfile_6 = Text(executessh_11.Stdout)
octree_9 = Text(executessh_10.Stdout)
octree_overcast_3 = Text(octree_overcast)
division_3 = Division(A=resolution_2, B=1.5)
entwine_8 = Entwine(Branch00=octree_overcast_3, Branch01=octree_9, FlattenInputs=True)  # -> flatten(Result)
octree_10 = Text(graft(entwine_8))
list_2 = ItemSelector(
    octree_10,
    {"/home/mss/MantaRay/UnnamedProject/octrees/my_test_scene.oct", "/home/mss/MantaRay/UnnamedProject/octrees/my_test_scene_0800.oct", "/home/mss/MantaRay/UnnamedProject/octrees/my_test_scene_0900.oct", "/home/mss/MantaRay/UnnamedProject/octrees/my_test_scene_1000.oct", "/home/mss/MantaRay/UnnamedProject/octrees/my_test_scene_1100.oct", "/home/mss/MantaRay/UnnamedProject/octrees/my_test_scene_1200.oct", "/home/mss/MantaRay/UnnamedProject/octrees/my_test_scene_1300.oct", "/home/mss/MantaRay/UnnamedProject/octrees/my_test_scene_1400.oct", "/home/mss/MantaRay/UnnamedProject/octrees/my_test_scene_1500.oct", "/home/mss/MantaRay/UnnamedProject/octrees/my_test_scene_1600.oct", "/home/mss/MantaRay/UnnamedProject/octrees/my_test_scene_1700.oct"}, selected="/home/mss/MantaRay/UnnamedProject/octrees/my_test_scene.oct")
panel_97 = Panel("""mkdir -p <proj>/images/
rtpict -n <cpus-1> -w -vf <vf> -x <x> -y <y> <radOptions> <oct> | pfilt -x /4 -y /4 -r 0.7 > <proj>/images/<target>;echo <proj>/images/<target>""")
eval_2 = Evaluate(F="x=y", x=octree_10, y=list_2)
x_4 = Number(x_2)
run_6 = LBFalseStartToggle(False)

y_3 = Number(division_3)

hours_7 = Text(hours_2)
entwine_9 = Entwine(Branch00="ovc", Branch01=hours_7, FlattenInputs=True)  # -> flatten(Result)
cull_11 = CullPattern(List=graft(entwine_9), CullPattern=eval_2)  # -> flatten(List)
hours_8 = Text(cull_11)

# ----
# Parallel RTPICT render (Illuminance)
# (takes 2.5X longer than above...)
# mkdir -p <proj>/images/
# rtpict -i -w -n 30 -vf <vf> -x <x> -y <y> <radOptions> <oct> | pfilt -x /4 -y /4 -r 0.7 > <proj>/images/<target>;echo <proj>/images/<target>
panel_98 = Panel("""mkdir -p <proj>/images/
rtpict -i -w -n <cpus-2> -vf <vf> -x <x> -y <y> <radOptions> <oct> | pfilt -x /4 -y /4 -r 0.7 > <proj>/images/<target>;echo <proj>/images/<target>""")
run_7 = LBFalseStartToggle(False)
y_4 = Number(y_3)
x_5 = Number(x_2)

y_5 = Number(y_3)
overrides_44 = ApplyOverrides(
    Input=panel_97,
    RadOptions=graft("-ab 3 -ad 16 -aa 0"),
    X=graft(x_4),
    Y=graft(y_5),
    Vf=graft(viewfile_6),
    Oct=graft(list_2),
    Target=graft("<time>_rtpict_rendering_aa0_<x>_sunny_ad16_<h>.hdr"),
    Time=graft("<time>"),
    H=graft(hours_8))  # -> Output, Pairs
python_22 = GhPythonScript(update=overrides_44.Pairs)  # -> time; inputs update: tree; same code as python_17

overrides_45 = ApplyOverrides(
    Input=panel_98,
    RadOptions=graft("-ab 3 -ad 16 -aa 0"),
    X=graft(x_5),
    Y=graft(y_4),
    Vf=graft(viewfile_6),
    Oct=graft(list_2),
    Target=graft("<time>_rtpict_rendering_aa0_<x>_sunny_ad8_<h>_illum.hdr"),
    Time=graft(python_22),
    H=graft(hours_8))  # -> Output, Pairs
executessh_31 = ExecuteSSH(
    _SSHCommands_=flatten(overrides_45.Output),
    Run=run_7,
    addPrefix=True,
    description="""mkdir -p ~/MantaRay/UnnamedProject/images/
rtpict -i -w -n 9 -vf /home/mss/MantaRay/UnnamedProject/views/Perspective1.vf -x 1500 -y 1000 -ab 3 -ad 16 -aa 0 /home/mss/MantaRay/UnnamedProject/octrees/my_test_scene.oct | pfilt -x /4 -y /4 -r 0.7 > ~/MantaRay/UnnamedProject/images/2022_09_28_2130_47_rtpict_rendering_aa0_1500_sunny_ad8_ovc_illum.hdr;echo ~/MantaRay/UnnamedProject/images/2022_09_28_2130_47_rtpict_rendering_aa0_1500_sunny_ad8_ovc_illum.hdr""",
    fireLogs=True,
    lastRunTime=423914,
    name="rtpict",
    suppressWarnings=False)  # -> Stdout, Stderr_, Ran

overrides_46 = ApplyOverrides(Input_=overrides_44.Output, Time=graft(python_22))  # -> Output, Pairs

executessh_32 = ExecuteSSH(
    _SSHCommands_=flatten(overrides_46.Output),
    Run=run_6,
    addPrefix=True,
    description="""mkdir -p ~/MantaRay/UnnamedProject/images/
rtpict -n 10 -w -vf /home/mss/MantaRay/UnnamedProject/views/Perspective1.vf -x 1500 -y 1000 -ab 3 -ad 16 -aa 0 /home/mss/MantaRay/UnnamedProject/octrees/my_test_scene.oct | pfilt -x /4 -y /4 -r 0.7 > ~/MantaRay/UnnamedProject/images/2022_09_28_2130_47_rtpict_rendering_aa0_1500_sunny_ad16_ovc.hdr;echo ~/MantaRay/UnnamedProject/images/2022_09_28_2130_47_rtpict_rendering_aa0_1500_sunny_ad16_ovc.hdr""",
    fireLogs=True,
    lastRunTime=5501,
    name="rtpict",
    suppressWarnings=False)  # -> Stdout, Stderr_, Ran

# ----
# orig dimensions
panel_99 = Panel("getinfo <f>")
overrides_47 = ApplyOverrides(Input_=panel_99, F=graft(executessh_31.Stdout))  # -> Output, Pairs
executessh_wip_7 = ExecuteSSHWIP(
    _SSHCommands_=overrides_47.Output,
    Run=executessh_31.Ran,
    addPrefix=True,
    description="getinfo <f>",
    fireLogs=False,
    lastRunTime=76,
    suppressWarnings=False)  # -> Stdout, Stderr_, Ran
x_6 = Number(x_2)
division_4 = Division(A=x_6, B=4)
python_23 = GhPythonScript(x=executessh_wip_7.Stdout)  # -> out, org_y
# ---------- python_23: Python ----------
__author__ = "mm1013"
__version__ = "2022.08.31"

import rhinoscriptsyntax as rs

lines = x.replace("\r","").split("\n")

for l in lines:
    line = l.strip()
    if line.startswith("rtrace"):
        print "RTRACE"
        li = line.split("-y")
        
        print li[1].strip().split(" ")[0]
        org_y = int(li[1].strip().split(" ")[0])
    elif line.startswith("pfilt"):
        print "PFIlT"
        li = line.split("-y")
        
        print li[1].strip().split(" ")[0]
        org_y = org_y / float(li[1].strip().split(" ")[0].replace("/",""))
# ---------- end python_23 ----------

panel_100 = Panel("""pcond -h <hdr> <hdr-.>_exposed.hdr
ra_tiff <hdr-.>_exposed.hdr <hdr-.>_exposed.tif
convert <hdr-.>_exposed.tif <hdr-.>_exposed.png
echo <hdr-.>_exposed.png""")
panel_101 = Panel("""ra_tiff <hdr-.>.hdr <hdr-.>.tif
convert <hdr-.>.tif <hdr-.>.png
echo <hdr-.>.png""")
entwine_10 = Entwine(Branch00=panel_100, Branch01=panel_101, FlattenInputs=True)
overrides_48 = ApplyOverrides(Input_=entwine_10, Hdr=graft(executessh_32.Stdout))  # -> Output, Pairs
executessh_wip_8 = ExecuteSSHWIP(
    _SSHCommands_=overrides_48.Output,
    Run=executessh_32.Ran,
    addPrefix=True,
    description="""pcond -h <hdr> <hdr>_exposed.hdr
ra_tiff <hdr>_exposed.hdr <hdr>_exposed.tif
convert <hdr>_exposed.tif <hdr>_exposed.png
echo <hdr>_exposed.png


- - -

ra_tiff <hdr>.hdr <hdr>.tif
convert <hdr>.tif <hdr>.png
echo <hdr>.png""",
    fireLogs=False,
    lastRunTime=10,
    suppressWarnings=False)  # -> Stdout, Stderr_, Ran
convertpaths_6 = ConvertPaths(I=executessh_wip_8.Stdout)  # -> Linux, flatten(Windows)
item_6 = ListItem(List=convertpaths_6.Windows, Index=0, Wrap=True)  # -> Item, Item1

# ----
# blurring the irrad
panel_102 = Panel("pfilt -x /3 -y /3 -r 1 <file> | pfilt -1 -x <x> -y <y> > <file-.>_filteredBlur.hdr;ra_tiff <file-.>_filteredBlur.hdr <file-.>_filteredBlur.tif;echo <file-.>_filteredBlur.hdr")
overrides_49 = ApplyOverrides(Input_=panel_102, File=graft(executessh_31.Stdout), X=graft(division_4), Y=graft(python_23.org_y))  # -> Output, Pairs
executessh_wip_9 = ExecuteSSHWIP(
    _SSHCommands_=overrides_49.Output,
    Run=executessh_31.Ran,
    addPrefix=True,
    description="pfilt -x /3 -y /3 -r 1 <file> | pfilt -1 -x 375 -y <y> > <file>_filteredBlur.hdr;ra_tiff <file>_filteredBlur.hdr <file>_filteredBlur.tif;echo <file>_filteredBlur.hdr",
    fireLogs=False,
    lastRunTime=1104,
    suppressWarnings=False)  # -> Stdout, Stderr_, Ran

# ----
# FalseColor
panel_103 = Panel("""pfilt -x /2 -y /2 -r 0.7 <irrad> | falsecolor -s 2000 -l lux -lw 200 -lh 300 > <irrad-.>_fc2.hdr
ra_tiff <irrad-.>_fc2.hdr <irrad-.>_fc2.tif
convert <irrad-.>_fc2.tif <irrad-.>_fc2.png
rm <irrad-.>_fc2.hdr
rm <irrad-.>_fc2.tif
echo <irrad-.>_fc2.png""")
overrides_50 = ApplyOverrides(Input_=panel_103, Irrad=graft(executessh_31.Stdout))  # -> Output, Pairs
executessh_wip_10 = ExecuteSSHWIP(
    _SSHCommands_=overrides_50.Output,
    Run=executessh_31.Ran,
    addPrefix=True,
    description="""pfilt -x /2 -y /2 -r 0.7 <irrad> | falsecolor -s 2000 -l lux -lw 200 -lh 300 > <irrad>_fc2.hdr
ra_tiff <irrad>_fc2.hdr <irrad>_fc2.tif
convert <irrad>_fc2.tif <irrad>_fc2.png
rm <irrad>_fc2.hdr
rm <irrad>_fc2.tif
echo <irrad>_fc2.png""",
    fireLogs=False,
    lastRunTime=1368,
    suppressWarnings=False)  # -> Stdout, Stderr_, Ran
convertpaths_7 = ConvertPaths(I=executessh_wip_10.Stdout)  # -> Linux, flatten(Windows)

# ----
# overlay illuminance falsecolor on luminance picture
panel_104 = Panel("""pcond -h <rad> | pfilt -x /2 -y /2 -r 0.7 > <rad-.>exposed_sd.hdr
pfilt -x /2 -y /2 -r 0.7 <irrad> > <irrad-.>_sd.hdr
falsecolor -s 2000 -l lux -lw 200 -lh 300 -p <rad-.>exposed_sd.hdr -i <irrad-.>_sd.hdr -cl > <rad-.>_fc.hdr
ra_tiff <rad-.>_fc.hdr <rad-.>_fc.tif
convert <rad-.>_fc.tif <rad-.>_fc.png
echo <rad-.>_fc.hdr""")
panel_105 = Panel("-log 2")
overrides_51 = ApplyOverrides(Input_=panel_104, Rad=graft(executessh_32.Stdout), Irrad=graft(executessh_wip_9.Stdout))  # -> Output, Pairs
and_4 = GateAnd(A=executessh_32.Ran, B=executessh_31.Ran)
executessh_wip_11 = ExecuteSSHWIP(
    _SSHCommands_=overrides_51.Output,
    Run=and_4,
    addPrefix=True,
    description="""pcond -h <rad> | pfilt -x /2 -y /2 -r 0.7 > <rad>exposed_sd.hdr
pfilt -x /2 -y /2 -r 0.7 <irrad> > <irrad>_sd.hdr
falsecolor -s 2000 -l lux -lw 200 -lh 300 -p <rad>exposed_sd.hdr -i <irrad>_sd.hdr -cl > <rad>_fc.hdr
ra_tiff <rad>_fc.hdr <rad>_fc.tif
convert <rad>_fc.tif <rad>_fc.png
echo <rad>_fc.hdr""",
    fireLogs=False,
    lastRunTime=18,
    suppressWarnings=False)  # -> Stdout, Stderr_, Ran
convertpaths_8 = ConvertPaths(I=executessh_wip_11.Stdout)  # -> Linux, flatten(Windows)

# ----
# save pngs exposed and raw
panel_106 = Panel("""ra_tiff <hdr-.>.hdr <hdr-.>.tif
convert <hdr-.>.tif <hdr-.>.png
rm <hdr-.>.tif
echo <hdr-.>.png""")
panel_107 = Panel("""pcond -h <hdr> <hdr-.>_exposed.hdr
ra_tiff <hdr-.>_exposed.hdr <hdr-.>_exposed.tif
convert <hdr-.>_exposed.tif <hdr-.>_exposed.png
rm <hdr-.>_exposed.tif
rm <hdr-.>_exposed.hdr
echo <hdr-.>_exposed.png""")
entwine_11 = Entwine(Branch00=panel_107, Branch01=panel_106, FlattenInputs=True)
overrides_52 = ApplyOverrides(Input_=entwine_11, Hdr=graft(executessh_31.Stdout))  # -> Output, Pairs
executessh_wip_12 = ExecuteSSHWIP(
    _SSHCommands_=overrides_52.Output,
    Run=executessh_31.Ran,
    addPrefix=True,
    description="""pcond -h <hdr> <hdr>_exposed.hdr
ra_tiff <hdr>_exposed.hdr <hdr>_exposed.tif
convert <hdr>_exposed.tif <hdr>_exposed.png
rm <hdr>_exposed.tif
rm <hdr>_exposed.hdr
echo <hdr>_exposed.png


- - -

ra_tiff <hdr>.hdr <hdr>.tif
convert <hdr>.tif <hdr>.png
rm <hdr>.tif
echo <hdr>.png""",
    fireLogs=False,
    lastRunTime=3436,
    suppressWarnings=False)  # -> Stdout, Stderr_, Ran
convertpaths_9 = ConvertPaths(I=executessh_wip_12.Stdout)  # -> Linux, flatten(Windows)
item_7 = ListItem(List=convertpaths_9.Windows, Index=0, Wrap=True)  # -> Item, Item1

imageviewer_11 = LBImageViewer(ImagePath_=item_6.Item, _scale_=3, DisableClickable=False, SaveImgWithCoords=False, scale=3)  # -> ImagePath, Values, GIF
imageviewer_12 = LBImageViewer(ImagePath_=convertpaths_7.Windows, _scale_=2, DisableClickable=False, SaveImgWithCoords=False, scale=2)  # -> ImagePath, Values, GIF
imageviewer_13 = LBImageViewer(ImagePath_=item_7.Item, _scale_=2, DisableClickable=False, SaveImgWithCoords=False, scale=2)  # -> ImagePath, Values, GIF
imageviewer_14 = LBImageViewer(ImagePath_=item_7.Item1, _scale_=2, DisableClickable=False, SaveImgWithCoords=False, scale=2)  # -> ImagePath, Values, GIF
imageviewer_15 = LBImageViewer(ImagePath_=convertpaths_8.Windows, _scale_=2, DisableClickable=False, SaveImgWithCoords=False, scale=2)  # -> ImagePath, Values, GIF

# ----
# Using PCOND to set automatic exposure
# and convert to PNG
# pcond -h <hdr> <hdr-.>_exposed.hdr
# ra_tiff <hdr-.>_exposed.hdr <hdr-.>_exposed.tif
# convert <hdr-.>_exposed.tif <hdr-.>_exposed.png
# echo <hdr-.>_exposed.png
# pcompos -a 15 -b 1 1 1 -s 5 <proj>/mtxs/skyRenders/skyTregenza*.hdr > <proj>/mtxs/skyRenders/all.hdr
panel_108 = Panel("pcond -h <hdr> <hdr-.>_exposed.hdr;echo <hdr-.>_exposed.hdr")
overrides_53 = ApplyOverrides(Input_=panel_108, Hdr=graft(executessh_16.Stdout))  # -> Output, Pairs
panel_109 = Panel("psign -h 15 <h> | pcompos <target> 0 0 - 570 20 > <target-.>_s.hdr;echo <target-.>_s.hdr")
executessh_wip_13 = ExecuteSSHWIP(
    _SSHCommands_=overrides_53.Output,
    Run=executessh_16.Ran,
    addPrefix=True,
    description="pcond -h <hdr> <hdr>_exposed.hdr;echo <hdr>_exposed.hdr",
    fireLogs=False,
    lastRunTime=1862,
    suppressWarnings=False)  # -> Stdout, Stderr_, Ran
hours_9 = Number(hours)
overrides_54 = ApplyOverrides(Input_=panel_109, H=graft(hours_9), Target=graft(executessh_wip_13.Stdout))  # -> Output, Pairs
panel_110 = Panel("""pcond -h <hdr> <hdr-.>_exposed.hdr
ra_tiff <hdr-.>_exposed.hdr <hdr-.>_exposed.tif
convert <hdr-.>_exposed.tif <hdr-.>_exposed.png
echo <hdr-.>_exposed.png""")
panel_111 = Panel(overrides_54.Output)
panel_112 = Panel("""pcompos -a 3 -s 10 -b 0.2 0.2 0.2 <hdrFiles> > <proj>/images/<target>
ra_tiff <proj>/images/<target> <proj>/images/<target-.>.tif
convert <proj>/images/<target-.>.tif <proj>/images/<target-.>.png
echo <proj>/images/<target-.>.png""")
# -la for titel: pcompos -la -a 3 -s 10 -b 1 1 1 <hdrFiles> > <proj>/images/<target>
# echo <proj>/images/<target>
panel_113 = Panel("combined.hdr")

lng = ListLength(List=flatten(executessh_wip_13.Stdout))
python_24 = GhPythonScript(cnt=lng, run=executessh_wip_13.Ran)  # -> out, ran; inputs cnt: Int32, run: Boolean
# ---------- python_24: Python ----------
__author__ = "mm1013"
__version__ = "2022.08.30"

import rhinoscriptsyntax as rs

ran = cnt > 1 and run
# ---------- end python_24 ----------

executessh_wip_14 = ExecuteSSHWIP(
    _SSHCommands_=overrides_54.Output,
    Run=python_24.ran,
    addPrefix=True,
    description="""psign -h 15 800 | pcompos <target> 0 0 - 570 20 > <target>_s.hdr;echo <target>_s.hdr


- - -

psign -h 15 900 | pcompos <target> 0 0 - 570 20 > <target>_s.hdr;echo <target>_s.hdr


- - -

psign -h 15 1000 | pcompos <target> 0 0 - 570 20 > <target>_s.hdr;echo <target>_s.hdr


- - -

psign -h 15 1100 | pcompos <target> 0 0 - 570 20 > <target>_s.hdr;echo <target>_s.hdr


- - -

psign -h 15 1200 | pcompos <target> 0 0 - 570 20 > <target>_s.hdr;echo <target>_s.hdr


- - -

psign -h 15 1300 | pcompos <target> 0 0 - 570 20 > <target>_s.hdr;echo <target>_s.hdr


- - -

psign -h 15 1400 | pcompos <target> 0 0 - 570 20 > <target>_s.hdr;echo <target>_s.hdr


- - -

psign -h 15 1500 | pcompos <target> 0 0 - 570 20 > <target>_s.hdr;echo <target>_s.hdr


- - -

psign -h 15 1600 | pcompos <target> 0 0 - 570 20 > <target>_s.hdr;echo <target>_s.hdr


- - -

psign -h 15 1700 | pcompos <target> 0 0 - 570 20 > <target>_s.hdr;echo <target>_s.hdr""",
    fireLogs=False,
    lastRunTime=4066,
    suppressWarnings=False)  # -> Stdout, Stderr_, Ran
overrides_55 = ApplyOverrides(Input_=panel_110, Hdr=graft(executessh_wip_14.Stdout))  # -> Output, Pairs
join_6 = TextJoin(Text=flatten(executessh_wip_14.Stdout), Join=" ")
overrides_56 = ApplyOverrides(Input_=panel_112, HdrFiles=graft(join_6), Target=graft(panel_113))  # -> Output, Pairs
executessh_wip_15 = ExecuteSSHWIP(
    _SSHCommands_=overrides_56.Output,
    Run=executessh_wip_14.Ran,
    addPrefix=True,
    description="""pcompos -a 3 -s 10 -b 0.2 0.2 0.2 <hdrFiles> > ~/MantaRay/UnnamedProject/images/combined.hdr
ra_tiff ~/MantaRay/UnnamedProject/images/combined.hdr ~/MantaRay/UnnamedProject/images/combined.tif
convert ~/MantaRay/UnnamedProject/images/combined.tif ~/MantaRay/UnnamedProject/images/combined.png
echo ~/MantaRay/UnnamedProject/images/combined.png""",
    fireLogs=False,
    lastRunTime=7,
    suppressWarnings=False)  # -> Stdout, Stderr_, Ran

# ----
# PNGS
executessh_wip_16 = ExecuteSSHWIP(
    _SSHCommands_=overrides_55.Output,
    Run=executessh_wip_13.Ran,
    addPrefix=True,
    description="""pcond -h <hdr> <hdr>_exposed.hdr
ra_tiff <hdr>_exposed.hdr <hdr>_exposed.tif
convert <hdr>_exposed.tif <hdr>_exposed.png
echo <hdr>_exposed.png


- - -

pcond -h <hdr> <hdr>_exposed.hdr
ra_tiff <hdr>_exposed.hdr <hdr>_exposed.tif
convert <hdr>_exposed.tif <hdr>_exposed.png
echo <hdr>_exposed.png


- - -

pcond -h <hdr> <hdr>_exposed.hdr
ra_tiff <hdr>_exposed.hdr <hdr>_exposed.tif
convert <hdr>_exposed.tif <hdr>_exposed.png
echo <hdr>_exposed.png


- - -

pcond -h <hdr> <hdr>_exposed.hdr
ra_tiff <hdr>_exposed.hdr <hdr>_exposed.tif
convert <hdr>_exposed.tif <hdr>_exposed.png
echo <hdr>_exposed.png


- - -

pcond -h <hdr> <hdr>_exposed.hdr
ra_tiff <hdr>_exposed.hdr <hdr>_exposed.tif
convert <hdr>_exposed.tif <hdr>_exposed.png
echo <hdr>_exposed.png


- - -

pcond -h <hdr> <hdr>_exposed.hdr
ra_tiff <hdr>_exposed.hdr <hdr>_exposed.tif
convert <hdr>_exposed.tif <hdr>_exposed.png
echo <hdr>_exposed.png


- - -

pcond -h <hdr> <hdr>_exposed.hdr
ra_tiff <hdr>_exposed.hdr <hdr>_exposed.tif
convert <hdr>_exposed.tif <hdr>_exposed.png
echo <hdr>_exposed.png


- - -

pcond -h <hdr> <hdr>_exposed.hdr
ra_tiff <hdr>_exposed.hdr <hdr>_exposed.tif
convert <hdr>_exposed.tif <hdr>_exposed.png
echo <hdr>_exposed.png


- - -

pcond -h <hdr> <hdr>_exposed.hdr
ra_tiff <hdr>_exposed.hdr <hdr>_exposed.tif
convert <hdr>_exposed.tif <hdr>_exposed.png
echo <hdr>_exposed.png


- - -

pcond -h <hdr> <hdr>_exposed.hdr
ra_tiff <hdr>_exposed.hdr <hdr>_exposed.tif
convert <hdr>_exposed.tif <hdr>_exposed.png
echo <hdr>_exposed.png""",
    fireLogs=False,
    lastRunTime=1962,
    suppressWarnings=False)  # -> Stdout, Stderr_, Ran
convertpaths_10 = ConvertPaths(I=executessh_wip_16.Stdout)  # -> Linux, flatten(Windows)
imageviewer_16 = LBImageViewer(ImagePath_=convertpaths_10.Windows, _scale_="2", DisableClickable=False, SaveImgWithCoords=False, scale=2)  # -> ImagePath, Values, GIF

# ----
# False color with illuminance curves
# on top of luminance picture
panel_114 = Panel("falsecolor -s 10000 -l lux -p <rad-.>_exposed.hdr -i <irrad> -log 2 > <rad-.>_fc2.hdr;echo <rad-.>_fc2.hdr")

overrides_57 = ApplyOverrides(Input=panel_114, Rad=graft(executessh_19.Stdout), Irrad=graft(executessh_18.Stdout))  # -> Output, DynamicOutput
executessh_33 = ExecuteSSH(
    _SSHCommands_=overrides_57.DynamicOutput,
    Run=[executessh_19.Ran, executessh_18.Ran],
    addPrefix=True,
    description="falsecolor -s 10000 -l lux -p /home/mss/MantaRay/UnnamedProject/images/2022_09_28_1341_29_Perspective1_render_exposed.hdr -i /home/mss/MantaRay/UnnamedProject/images/2022_09_28_1341_29_Perspective1_render_illum.hdr -log 2 > /home/mss/MantaRay/UnnamedProject/images/2022_09_28_1341_29_Perspective1_render_fc2.hdr;echo /home/mss/MantaRay/UnnamedProject/images/2022_09_28_1341_29_Perspective1_render_fc2.hdr",
    fireLogs=False,
    lastRunTime=5358,
    suppressWarnings=False,
    results="/home/mss/MantaRay/UnnamedProject/images/2022_09_28_1341_29_Perspective1_render_fc2.hdr",
    commands="falsecolor -s 10000 -l lux -p /home/mss/MantaRay/UnnamedProject/images/2022_09_28_1341_29_Perspective1_render_exposed.hdr -i /home/mss/MantaRay/UnnamedProject/images/2022_09_28_1341_29_Perspective1_render_illum.hdr -log 2 > /home/mss/MantaRay/UnnamedProject/images/2022_09_28_1341_29_Perspective1_render_fc2.hdr;echo /home/mss/MantaRay/UnnamedProject/images/2022_09_28_1341_29_Perspective1_render_fc2.hdr")  # -> Stdout, Stderr_, Ran
download_10 = Download(
    LinuxFilePaths=executessh_33.Stdout,
    Run=executessh_33.Ran,
    stdouts="C:\Users\mm1013\MantaRay\UnnamedProject\2022_09_28_1341_29_Perspective1_render_fc2.hdr")  # -> FilePaths, Status, Ran

imageviewer_17 = LBImageViewer(ImagePath_=download_10.FilePaths, _scale_="2", DisableClickable=False, SaveImgWithCoords=False, scale=2)  # -> ImagePath, Values, GIF

# ----
# False color with illuminance curves
# on top of luminance picture
panel_115 = Panel("falsecolor -s 10000 -pal hot -l lux -p <rad-.>_exposed.hdr -i <irrad> > <rad-.>_fc3.hdr;echo <rad-.>_fc3.hdr")

overrides_58 = ApplyOverrides(Input=panel_115, Rad=graft(executessh_19.Stdout), Irrad=graft(executessh_18.Stdout))  # -> Output, DynamicOutput
executessh_34 = ExecuteSSH(
    _SSHCommands_=overrides_58.DynamicOutput,
    Run=[executessh_19.Ran, executessh_18.Ran],
    addPrefix=True,
    description="falsecolor -s 10000 -pal hot -l lux -p /home/mss/MantaRay/UnnamedProject/images/2022_09_28_1341_29_Perspective1_render_exposed.hdr -i /home/mss/MantaRay/UnnamedProject/images/2022_09_28_1341_29_Perspective1_render_illum.hdr > /home/mss/MantaRay/UnnamedProject/images/2022_09_28_1341_29_Perspective1_render_fc3.hdr;echo /home/mss/MantaRay/UnnamedProject/images/2022_09_28_1341_29_Perspective1_render_fc3.hdr",
    fireLogs=False,
    lastRunTime=2709,
    suppressWarnings=False,
    results="/home/mss/MantaRay/UnnamedProject/images/2022_09_28_1341_29_Perspective1_render_fc3.hdr",
    commands="falsecolor -s 10000 -pal hot -l lux -p /home/mss/MantaRay/UnnamedProject/images/2022_09_28_1341_29_Perspective1_render_exposed.hdr -i /home/mss/MantaRay/UnnamedProject/images/2022_09_28_1341_29_Perspective1_render_illum.hdr > /home/mss/MantaRay/UnnamedProject/images/2022_09_28_1341_29_Perspective1_render_fc3.hdr;echo /home/mss/MantaRay/UnnamedProject/images/2022_09_28_1341_29_Perspective1_render_fc3.hdr")  # -> Stdout, Stderr_, Ran
download_11 = Download(
    LinuxFilePaths=executessh_34.Stdout,
    Run=executessh_34.Ran,
    stdouts="C:\Users\mm1013\MantaRay\UnnamedProject\2022_09_28_1341_29_Perspective1_render_fc3.hdr")  # -> FilePaths, Status, Ran

imageviewer_18 = LBImageViewer(ImagePath_=download_11.FilePaths, _scale_="2", DisableClickable=False, SaveImgWithCoords=False, scale=2)  # -> ImagePath, Values, GIF

# ----
# False color with illuminance curves
# on top of luminance picture
panel_116 = Panel("falsecolor -s 50 -n 10 -m 1.79 -l DF -p <rad-.>_exposed.hdr -i <irrad> -cp > <rad-.>_fc4.hdr;echo <rad-.>_fc4.hdr")

overrides_59 = ApplyOverrides(Input=panel_116, Rad=graft(executessh_19.Stdout), Irrad=graft(executessh_18.Stdout))  # -> Output, DynamicOutput
executessh_35 = ExecuteSSH(
    _SSHCommands_=overrides_59.DynamicOutput,
    Run=[executessh_19.Ran, executessh_18.Ran],
    addPrefix=True,
    description="falsecolor -s 50 -n 10 -m 1.79 -l DF -p /home/mss/MantaRay/UnnamedProject/images/2022_09_28_1341_29_Perspective1_render_exposed.hdr -i /home/mss/MantaRay/UnnamedProject/images/2022_09_28_1341_29_Perspective1_render_illum.hdr -cp > /home/mss/MantaRay/UnnamedProject/images/2022_09_28_1341_29_Perspective1_render_fc4.hdr;echo /home/mss/MantaRay/UnnamedProject/images/2022_09_28_1341_29_Perspective1_render_fc4.hdr",
    fireLogs=False,
    lastRunTime=3169,
    suppressWarnings=False,
    results="/home/mss/MantaRay/UnnamedProject/images/2022_09_28_1341_29_Perspective1_render_fc4.hdr",
    commands="falsecolor -s 50 -n 10 -m 1.79 -l DF -p /home/mss/MantaRay/UnnamedProject/images/2022_09_28_1341_29_Perspective1_render_exposed.hdr -i /home/mss/MantaRay/UnnamedProject/images/2022_09_28_1341_29_Perspective1_render_illum.hdr -cp > /home/mss/MantaRay/UnnamedProject/images/2022_09_28_1341_29_Perspective1_render_fc4.hdr;echo /home/mss/MantaRay/UnnamedProject/images/2022_09_28_1341_29_Perspective1_render_fc4.hdr")  # -> Stdout, Stderr_, Ran
download_12 = Download(
    LinuxFilePaths=executessh_35.Stdout,
    Run=executessh_35.Ran,
    stdouts="C:\Users\mm1013\MantaRay\UnnamedProject\2022_09_28_1341_29_Perspective1_render_fc4.hdr")  # -> FilePaths, Status, Ran
download_13 = Download(
    LinuxFilePaths=executessh_18.Stdout,
    Run=executessh_35.Ran,
    stdouts="C:\Users\mm1013\MantaRay\UnnamedProject\2022_09_28_1341_29_Perspective1_render_illum.hdr")  # -> FilePaths, Status, Ran; disabled
executessh_36 = ExecuteSSH(
    _SSHCommands_=overrides_38.DynamicOutput,
    Run=executessh_35.Ran,
    addPrefix=True,
    description="""pcomb -o /home/mss/MantaRay/UnnamedProject/images/2022_09_28_1341_29_Perspective1_render_illum.hdr | pcompos -x 2 -y 2 - -811 -470 | pvalue -h -H -df | total -if3 -m | sed -r 's/[\t]+/1/g'


- - -

pcomb -o /home/mss/MantaRay/UnnamedProject/images/2022_09_28_1341_29_Perspective1_render_illum.hdr | pcompos -x 2 -y 2 - -812 -432 | pvalue -h -H -df | total -if3 -m | sed -r 's/[\t]+/1/g'


- - -

pcomb -o /home/mss/MantaRay/UnnamedProject/images/2022_09_28_1341_29_Perspective1_render_illum.hdr | pcompos -x 2 -y 2 - -814 -385 | pvalue -h -H -df | total -if3 -m | sed -r 's/[\t]+/1/g'


- - -

pcomb -o /home/mss/MantaRay/UnnamedProject/images/2022_09_28_1341_29_Perspective1_render_illum.hdr | pcompos -x 2 -y 2 - -816 -347 | pvalue -h -H -df | total -if3 -m | sed -r 's/[\t]+/1/g'


- - -

pcomb -o /home/mss/MantaRay/UnnamedProject/images/2022_09_28_1341_29_Perspective1_render_illum.hdr | pcompos -x 2 -y 2 - -816 -302 | pvalue -h -H -df | total -if3 -m | sed -r 's/[\t]+/1/g'


- - -

pcomb -o /home/mss/MantaRay/UnnamedProject/images/2022_09_28_1341_29_Perspective1_render_illum.hdr | pcompos -x 2 -y 2 - -1312 -632 | pvalue -h -H -df | total -if3 -m | sed -r 's/[\t]+/1/g'


- - -

pcomb -o /home/mss/MantaRay/UnnamedProject/images/2022_09_28_1341_29_Perspective1_render_illum.hdr | pcompos -x 2 -y 2 - -1308 -594 | pvalue -h -H -df | total -if3 -m | sed -r 's/[\t]+/1/g'


- - -

pcomb -o /home/mss/MantaRay/UnnamedProject/images/2022_09_28_1341_29_Perspective1_render_illum.hdr | pcompos -x 2 -y 2 - -1305 -553 | pvalue -h -H -df | total -if3 -m | sed -r 's/[\t]+/1/g'


- - -

pcomb -o /home/mss/MantaRay/UnnamedProject/images/2022_09_28_1341_29_Perspective1_render_illum.hdr | pcompos -x 2 -y 2 - -1305 -526 | pvalue -h -H -df | total -if3 -m | sed -r 's/[\t]+/1/g'


- - -

pcomb -o /home/mss/MantaRay/UnnamedProject/images/2022_09_28_1341_29_Perspective1_render_illum.hdr | pcompos -x 2 -y 2 - -1299 -494 | pvalue -h -H -df | total -if3 -m | sed -r 's/[\t]+/1/g'


- - -

pcomb -o /home/mss/MantaRay/UnnamedProject/images/2022_09_28_1341_29_Perspective1_render_illum.hdr | pcompos -x 2 -y 2 - -1627 -690 | pvalue -h -H -df | total -if3 -m | sed -r 's/[\t]+/1/g'


- - -

pcomb -o /home/mss/MantaRay/UnnamedProject/images/2022_09_28_1341_29_Perspective1_render_illum.hdr | pcompos -x 2 -y 2 - -1619 -660 | pvalue -h -H -df | total -if3 -m | sed -r 's/[\t]+/1/g'


- - -

pcomb -o /home/mss/MantaRay/UnnamedProject/images/2022_09_28_1341_29_Perspective1_render_illum.hdr | pcompos -x 2 -y 2 - -1614 -632 | pvalue -h -H -df | total -if3 -m | sed -r 's/[\t]+/1/g'


- - -

pcomb -o /home/mss/MantaRay/UnnamedProject/images/2022_09_28_1341_29_Perspective1_render_illum.hdr | pcompos -x 2 -y 2 - -1608 -600 | pvalue -h -H -df | total -if3 -m | sed -r 's/[\t]+/1/g'


- - -

pcomb -o /home/mss/MantaRay/UnnamedProject/images/2022_09_28_1341_29_Perspective1_render_illum.hdr | pcompos -x 2 -y 2 - -132 -1079 | pvalue -h -H -df | total -if3 -m | sed -r 's/[\t]+/1/g'""",
    fireLogs=False,
    lastRunTime=1755,
    suppressWarnings=False,
    results=["24.125124.125124.125", "21.5625121.5625121.5625", "17.875117.875117.875", "14.953125114.953125114.953125", "54.625154.625154.625", "23123123", "19.625119.625119.625", "16.5116.5116.5", "24.7578125124.7578125124.7578125", "55.625155.625155.625", "21.15625121.15625121.15625", "20.1875120.1875120.1875", "19119119", "17.59375117.59375117.59375", "55.625155.625155.625"],
    commands=["pcomb -o /home/mss/MantaRay/UnnamedProject/images/2022_09_28_1341_29_Perspective1_render_illum.hdr | pcompos -x 2 -y 2 - -811 -470 | pvalue -h -H -df | total -if3 -m | sed -r 's/[\t]+/1/g'", "pcomb -o /home/mss/MantaRay/UnnamedProject/images/2022_09_28_1341_29_Perspective1_render_illum.hdr | pcompos -x 2 -y 2 - -812 -432 | pvalue -h -H -df | total -if3 -m | sed -r 's/[\t]+/1/g'", "pcomb -o /home/mss/MantaRay/UnnamedProject/images/2022_09_28_1341_29_Perspective1_render_illum.hdr | pcompos -x 2 -y 2 - -1627 -690 | pvalue -h -H -df | total -if3 -m | sed -r 's/[\t]+/1/g'", "pcomb -o /home/mss/MantaRay/UnnamedProject/images/2022_09_28_1341_29_Perspective1_render_illum.hdr | pcompos -x 2 -y 2 - -1308 -594 | pvalue -h -H -df | total -if3 -m | sed -r 's/[\t]+/1/g'", "pcomb -o /home/mss/MantaRay/UnnamedProject/images/2022_09_28_1341_29_Perspective1_render_illum.hdr | pcompos -x 2 -y 2 - -1614 -632 | pvalue -h -H -df | total -if3 -m | sed -r 's/[\t]+/1/g'", "pcomb -o /home/mss/MantaRay/UnnamedProject/images/2022_09_28_1341_29_Perspective1_render_illum.hdr | pcompos -x 2 -y 2 - -132 -1079 | pvalue -h -H -df | total -if3 -m | sed -r 's/[\t]+/1/g'", "pcomb -o /home/mss/MantaRay/UnnamedProject/images/2022_09_28_1341_29_Perspective1_render_illum.hdr | pcompos -x 2 -y 2 - -1305 -553 | pvalue -h -H -df | total -if3 -m | sed -r 's/[\t]+/1/g'", "pcomb -o /home/mss/MantaRay/UnnamedProject/images/2022_09_28_1341_29_Perspective1_render_illum.hdr | pcompos -x 2 -y 2 - -816 -347 | pvalue -h -H -df | total -if3 -m | sed -r 's/[\t]+/1/g'", "pcomb -o /home/mss/MantaRay/UnnamedProject/images/2022_09_28_1341_29_Perspective1_render_illum.hdr | pcompos -x 2 -y 2 - -1305 -526 | pvalue -h -H -df | total -if3 -m | sed -r 's/[\t]+/1/g'", "pcomb -o /home/mss/MantaRay/UnnamedProject/images/2022_09_28_1341_29_Perspective1_render_illum.hdr | pcompos -x 2 -y 2 - -816 -302 | pvalue -h -H -df | total -if3 -m | sed -r 's/[\t]+/1/g'"])  # -> Stdout, Stderr_, Ran

imageviewer_19 = LBImageViewer(ImagePath_=download_12.FilePaths, _scale_="2", DisableClickable=False, SaveImgWithCoords=False, scale=2)  # -> ImagePath, Values, GIF

python_25 = GhPythonScript(val=executessh_36.Stdout)  # -> x, y, z, ln
# ---------- python_25: Python ----------
__author__ = "mm1013"
__version__ = "2022.09.28"

import rhinoscriptsyntax as rs

length = int(len(val)/3.0)
x = val[0:length]
y = val[length:2*length]
z = val[2*length:3*length]
ln = length
# ---------- end python_25 ----------
panel_117 = Panel(executessh_36.Stdout)
imageviewer_20 = LBImageViewer(ImagePath_=download_13.FilePaths, _scale_="2", DisableClickable=False, SaveImgWithCoords=False, scale=2)  # -> ImagePath, Values, GIF
panel_118 = Panel(imageviewer_19.Values)

# ==== cluster DefaultMSS
default_value_flattened = ClusterInput()
data = ClusterInput()
data_2 = Data(data)
merge = Merge(Data1=flatten(data_2), Data2="0")  # -> flatten(Result)
default_value_flattened_2 = Data(flatten(default_value_flattened))
lng = ListLength(List=merge)
equals = Equality(FirstNumber=lng, SecondNumber="1")  # -> Equality, Inequality
cull = CullPattern(List=data_2, CullPattern=invert(equals.Equality))
panel = Panel(equals.Equality)
cull_2 = CullPattern(List=default_value_flattened_2, CullPattern=equals.Equality)
data_3 = Data([cull, cull_2])
data_4 = ClusterOutput(data_3)

# ==== cluster MeshIt2: Meshes everything in the input. Graft the input if you want to make several meshes, otherwise returns a joined mesh.
mesh_brep = ClusterInput()
mesh_brep_2 = Geometry(simplify(mesh_brep))
tmatch = MatchText(Text=mesh_brep_2, RegEx="(mesh)", Case=False)
tmatch_2 = MatchText(Text=mesh_brep_2, RegEx="(brep)|(polysurface)|(surface)|(extrusion)", Case=False)
group = Group(Objects=mesh_brep_2)
cull = CullPattern(List=mesh_brep_2, CullPattern=tmatch_2)
mesh = MeshBrep(
    Brep=cull,
    Settings={GridMaxCount=0, GridMinCount=16, JaggedSeams=False, MaxEdgeLength=0, MinEdgeLength=0.0001, MinTolerance=0, Refine=True, RefineAngle=0, RelativeTolerance=0.65, SimplePlanes=True, Tolerance=0})  # -> simplify(Mesh)
cull_2 = CullPattern(List=mesh_brep_2, CullPattern=tmatch)  # -> simplify(List)

# ----
# Fix invalid mesh
panel = Panel("Invalid Mesh")  # disabled
mesh_2 = Mesh(mesh)  # disabled
tmatch_3 = MatchText(Text=mesh_2, RegEx=panel, Case=False)  # disabled
unweave = Unweave(List=mesh_2, UnweavePattern=tmatch_3)  # -> Data0, Data1; disabled
explode = MeshExplode(Mesh=unweave.Data1, Interpolate=False)  # -> simplify(Faces); disabled
abc_a = ABC(data=explode)  # disabled
panel_2 = Panel("0")  # disabled
num = Number(panel_2)  # disabled
area = MeshArea(Mesh=abc_a)  # -> Area, Centroid; disabled
equals = Equality(FirstNumber=area.Area, SecondNumber=num)  # -> Equality, Inequality; disabled
cull_3 = CullPattern(List=abc_a, CullPattern=equals.Inequality)  # disabled
mjoin = MeshJoin(Meshes=[cull_3, unweave.Data0])  # disabled

# ----
# Fix invalid mesh
panel_3 = Panel("Invalid Mesh")  # disabled
mesh_3 = Mesh(cull_2)  # disabled
tmatch_4 = MatchText(Text=mesh_3, RegEx=panel_3, Case=False)  # disabled
unweave_2 = Unweave(List=mesh_3, UnweavePattern=tmatch_4)  # -> Data0, Data1; disabled
explode_2 = MeshExplode(Mesh=unweave_2.Data1, Interpolate=False)  # -> simplify(Faces); disabled
abc_a_2 = ABC(data=explode_2)  # disabled
panel_4 = Panel("0")  # disabled
num_2 = Number(panel_4)  # disabled
area_2 = MeshArea(Mesh=abc_a_2)  # -> Area, Centroid; disabled
equals_2 = Equality(FirstNumber=area_2.Area, SecondNumber=num_2)  # -> Equality, Inequality; disabled
cull_4 = CullPattern(List=abc_a_2, CullPattern=equals_2.Inequality)  # disabled
mjoin_2 = MeshJoin(Meshes=[cull_4, unweave_2.Data0])  # disabled

mjoin_3 = MeshJoin(Meshes=[mesh, cull_2])
c_script = CSharpScript(mesh=mjoin_3)  # -> A; inputs mesh: Mesh
# ---------- c_script: C# ----------
    mesh.Faces.CullDegenerateFaces();
    A = mesh;
# ---------- end c_script ----------
abc_a_3 = ABC(data=mjoin)  # disabled
abc_a_4 = ABC(data=mjoin_2)  # disabled
clean = CleanTree(RemoveNulls=True, RemoveInvalid=True, RemoveEmpty=False, Tree=[abc_a_3, abc_a_4])  # disabled
mjoin_4 = MeshJoin(Meshes=clean)  # disabled
unflatten = UnflattenTree(Tree=c_script, Guide=group)
mesh_explode = MeshExplode(m=mjoin_4)  # -> out, simplify(A); disabled
# ---------- mesh_explode: VB ----------
    Component.Params.Input(0).Name = "Mesh"
    Component.Params.Input(0).Description = "Open or closed mesh"

    Component.Params.Output(1).Name = "Mesh"
    Component.Params.Output(1).Description = "If successful, a valid mesh"

    If m IsNot Nothing Then
      Dim pts As Rhino.Geometry.Collections.MeshVertexList
      Dim faces As Rhino.Geometry.Collections.MeshFaceList
      Dim clrs As Rhino.Geometry.Collections.MeshVertexColorList
      Dim i As Integer
      Dim mshs As New list(Of mesh)

      faces = m.Faces
      pts = m.Vertices
      If m.VertexColors.count() = 0 Then m.VertexColors.CreateMonotoneMesh(color.FromArgb(100, 100, 100))
      clrs = m.VertexColors

      For i = 0 To faces.count() - 1 Step 1
        Dim fc As New meshFace
        Dim face As New MeshFace
        Dim ptList As New list(Of point3d)
        Dim clrList As New list(Of color)
        Dim msh As New mesh

        face = faces(i)

        ptList.add(New point3d(pts(face.A)))
        ptList.add(New point3d(pts(face.B)))
        ptList.add(New point3d(pts(face.C)))
        If face.IsQuad Then ptList.add(New point3d(pts(face.D)))

        clrList.add(clrs(face.A))
        clrList.add(clrs(face.B))
        clrList.add(clrs(face.C))
        If face.IsQuad Then clrList.add(clrs(face.D))

        If face.IsQuad Then fc = New meshFace(0, 1, 2, 3) Else fc = New meshface(0, 1, 2)

        msh.Vertices.AddVertices(ptList.toarray())
        msh.Faces.AddFace(fc)
        msh.VertexColors.SetColors(clrList.toarray())
        mshs.add(msh)
      Next

      A = mshs
    End If
# ---------- end mesh_explode ----------
c_script_2 = CSharpScript(mesh=mjoin_4)  # -> A; inputs mesh: Mesh; disabled; same code as c_script
c_script_3 = CSharpScript(mesh=mesh_explode.A)  # -> out, A; inputs mesh: list of Mesh; disabled
# ---------- c_script_3: C# ----------
    List<bool> isValid = new List<bool>();
    for (int i = 0; i < mesh.Count; i++)
    {
      isValid.Add(mesh[i].IsValid);
    }
    
    A = isValid;
# ---------- end c_script_3 ----------
mesh_joined = Mesh(unflatten)
cullf = CullFaces(Mesh=mjoin_4, Pattern=invert(c_script_3.A))  # disabled
mesh_joined_2 = ClusterOutput(mesh_joined)

# ==== cluster LargestBREP
window_breps = ClusterInput()
window_breps_2 = Brep(window_breps)
debrep = DeconstructBrep(Brep=window_breps_2)  # -> Faces, Edges, Vertices
area = Area(Geometry=debrep.Faces)  # -> Area, Centroid
sort = SortList(Keys=area.Area, ValuesA=debrep.Faces)  # -> Keys, ValuesA
item = ListItem(List=sort.ValuesA, Index=-1, Wrap=True)
group = Group(Objects=flatten(item))
grouped = ClusterOutput(group)

# ==== cluster Cluster
L = ClusterInput()
lng = ListLength(List=L)
default = DefaultMSS(data=flatten(lng), default_value_flattened=flatten("0"))
bool = Boolean(default)
bool_2 = ClusterOutput(bool)

# ==== cluster ABC
data = ClusterInput()
data_2 = Data(data)
path_mapper = PathMapper(
    data_2,
    source=["{A;B;C;D;E;F;G}", "{A;B;C;D;E;F}", "{A;B;C;D;E}", "{A;B;C;D}", "{A;B;C}", "{A;B}", "{A}"],
    target=["{A}", "{A}", "{A}", "{A}", "{A}", "{A}", "{A}"])
data_3 = Data(path_mapper)
data_4 = ClusterOutput(data_3)
